# Grasshopper definition tests.gh (Grasshopper 1.0.8)
# plug-ins: semio

# ----
# Point missing
# Direction missing
por = ModelPort()  # -> Port, Id, Point, Direction, Locators

spt = ModelScreenPoint()  # -> ScreenPoint, X, Y

# ----
# Group missing
loc = ModelLocator()  # -> Locator, Group, Subgroup

# ----
# Url missing
rep = ModelRepresentation()  # -> Representation, Url, Mime, Lod, Tags

# ---- group: Parameters
run = BooleanToggle(True)
futuristic = BooleanToggle(False)
list = ValueList({"1to500", "1to200"}, selected="1to500")
list_2 = ValueList({"Full": 0, "First Tower": 1, "Second Tower": 2}, selected="Full")

# ----
# Connected equal Connecting
con = ModelConnection()  # -> Connection, ConnectedPieceId, ConnectedPieceTypePortId, ConnectingPieceId, ConnectingPieceTypePortId, Rotation, Tilt, Offset

# ----
# Name missing
qal = ModelQuality()  # -> Quality, Name, Value, Unit, Definition

# ----
# Type Name missing
pce = ModelPiece()  # -> Piece, Id, TypeName, TypeVariant, Plane, ScreenPoint

# ----
# Name missing
# Port missing
# Representation missing
typ = ModelType()  # -> Type, Name, Description, Icon, Variant, Unit, Ports, Representations, Qualities

# ----
# Name missing
# Piece missing
dsn = ModelDesign()  # -> Design, Name, Description, Icon, Variant, Unit, Pieces, Connections, Qualities

# ----
# Name missing
kit = ModelKit()  # -> Kit, Name, Description, Icon, Url, Homepage, Types, Designs

panel = Panel("The second tower (eleven storey) of the Nakagin Capule Tower.")
panel_2 = Panel("NameToooooooooooooooooLoooooooooooooooooooooonggggggggggggggggggg")
panel_3 = Panel("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")
panel_4 = Panel("IdToooooooooooooooooooooooooooooooooooooooLooooooooooooooooooooooooooooooooooooooooooooooooooongggggggggggggggggggggggggggggggggg")
panel_5 = Panel("0001")
concat = Concatenate(FragmentB="9")
concat_2 = Concatenate(FragmentB="11")
genes = GenePool(Decimals=0, Maximum=10, Minimum=0, Value=[3, 6, 9])

# ----
# Description too long
vec = VectorXYZ(XComponent=0, YComponent=0, ZComponent=0)  # -> Vector, Length
pt = ConstructPoint(XCoordinate=0, YCoordinate=0, ZCoordinate=0)
rep_2 = ModelRepresentation(Url="https://url")  # -> Representation, Url, Mime, Lod, Tags
por_2 = ModelPort(Point=pt, Direction=vec.Vector)  # -> Port, Id, Point, Direction, Locators
typ_2 = ModelType(Name="Name", Description=panel_3, Ports=por_2.Port, Representations=rep_2.Representation)  # -> Type, Name, Description, Icon, Variant, Unit, Ports, Representations, Qualities

# ----
# Lod too long
rep_3 = ModelRepresentation(Url="https://url", Mime="https://url", Lod=panel_2)  # -> Representation, Url, Mime, Lod, Tags

# ----
# Id too long
por_3 = ModelPort(Id=panel_4)  # -> Port, Id, Point, Direction, Locators

# ----
# Url too long
rep_4 = ModelRepresentation(Url="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")  # -> Representation, Url, Mime, Lod, Tags

# ----
# Id too long
pce_2 = ModelPiece(Id=panel_4, TypeName="Name")  # -> Piece, Id, TypeName, TypeVariant, Plane, ScreenPoint

# ----
# Tag too long
rep_5 = ModelRepresentation(Url="https://url", Mime="https://url", Tags=panel_2)  # -> Representation, Url, Mime, Lod, Tags

# ----
# Description too long
pce_3 = ModelPiece(TypeName="Name")  # -> Piece, Id, TypeName, TypeVariant, Plane, ScreenPoint
dsn_2 = ModelDesign(Name="Name", Description=panel_3, Pieces=pce_3.Piece)  # -> Design, Name, Description, Icon, Variant, Unit, Pieces, Connections, Qualities

# ----
# Mime too long
rep_6 = ModelRepresentation(Url="https://url", Mime=panel_4)  # -> Representation, Url, Mime, Lod, Tags

# ----
# Description too long
kit_2 = ModelKit(Name="Name", Description=panel_3)  # -> Kit, Name, Description, Icon, Url, Homepage, Types, Designs

# ---- group: No impact on design. Only on drawing of diagram.
diagram_piece_diameter = Panel("40")
expression = Expression(x=diagram_piece_diameter, Expression="x/2")
addition = Addition(A=diagram_piece_diameter, B=Slider(10, range=0..10))
multiplication = Multiplication(A=diagram_piece_diameter, B=Slider(2, range=0..10))
neg = Negative(Value=multiplication)
neg_2 = Negative(Value=addition)
neg_3 = Negative(Value=addition)
model_screen_point = ModelScreenPoint(X=addition, Y=neg)  # -> ScreenPoint, X, Y
addition_2 = Addition(A=model_screen_point.Y, B=neg)
addition_3 = Addition(A=model_screen_point.Y, B=neg)
model_screen_point_2 = ModelScreenPoint(X=neg_2, Y=neg)  # -> ScreenPoint, X, Y
model_screen_point_3 = ModelScreenPoint(X=model_screen_point_2.X, Y=addition_3)  # -> ScreenPoint, X, Y
subtraction = Subtraction(A=model_screen_point_3.X, B=multiplication)
series = Series(Start=subtraction, Step=neg_2, Count="8")
trim = TrimTree(Tree=series, Depth=1)
model_screen_point_4 = ModelScreenPoint(X=model_screen_point.X, Y=addition_2)  # -> ScreenPoint, X, Y
addition_4 = Addition(A=model_screen_point_4.X, B=multiplication)
series_2 = Series(Start=addition_4, Step=addition, Count="8")
trim_2 = TrimTree(Tree=series_2, Depth=1)

# ----
genes_2 = GenePool(Decimals=0, Maximum=8, Minimum=0, Value=[6, 6, 6, 6, 6, 6, 6, 6, 6])
genes_3 = GenePool(Decimals=0, Maximum=8, Minimum=0, Value=[0, 0, 0, 0, 0, 0, 0, 0, 0])
genes_4 = GenePool(Decimals=0, Maximum=8, Minimum=0, Value=[6, 6, 6, 6, 6, 6, 6, 7, 7])
genes_5 = GenePool(Decimals=0, Maximum=8, Minimum=0, Value=[6, 0, 0, 6, 0, 3, 6, 6, 0])

# ---- group: No impact on design. Only on drawing of diagram. (continued)
expression_2 = Expression(x="9", Expression="x/2")
multiplication_2 = Multiplication(A=expression_2, B=neg_2)
addition_5 = Addition(A=model_screen_point_2.Y, B=multiplication_2, C=expression)
model_screen_point_5 = ModelScreenPoint(X=trim_2, Y=addition_5)  # -> ScreenPoint, X, Y

# ----
xy = XYPlane(Origin=Point(0, 0, 0))
pce_4 = ModelPiece(Id="b", TypeName="Base", Plane=xy)  # -> Piece, Id, TypeName, TypeVariant, Plane, ScreenPoint
core = Panel("c")
concat_3 = Concatenate(FragmentA=core, FragmentC="0")
concat_4 = Concatenate(FragmentA=core, FragmentC="1")
bottom = Panel("b")
neg_4 = Negative(Value="9")
top = Panel("t")
neg_5 = Negative(Value="90")
addition_6 = Addition(A="90", B=neg_4)
addition_7 = Addition(A="90", B=neg_4)
filter = StreamFilter(Gate=futuristic, Stream0="90", Stream1=addition_6)
filter_2 = StreamFilter(Gate=futuristic, Stream0="90", Stream1=addition_7)
neg_6 = Negative(Value=filter)

concat_5 = Concatenate(FragmentA="b", FragmentB="_", FragmentC=concat_3)
concat_6 = Concatenate(FragmentA="b", FragmentB="_", FragmentC=concat_4)

tower = Tower(
    number_of_floors="9",
    shaftpieceid=concat_5,
    capsulepatternnorthwest=genes_2,
    capsulepatternsoutheast=genes_5,
    capsulepatternsouthwest=genes_4,
    capsulepatternnortheast=genes_3,
    diagramcapsulestarts=model_screen_point_5.ScreenPoint,
    diagramverticaldirection=addition)  # -> pc_2, co_2, first_tambour_id_2, last_tambour_id_2

dsn_3 = ModelDesign(
    Name="Capsule Tower",
    Description="The first tower (nine storey) of the Nakagin Capule Tower.",
    Icon=concat,
    Variant="9",
    Pieces=tower.pc_2,
    Connections=tower.co_2)  # -> Design, Name, Description, Icon, Variant, Unit, Pieces, Connections, Qualities

genes_6 = GenePool(Decimals=0, Maximum=8, Minimum=0, Value=[6, 0, 0, 0, 6, 6, 0, 6, 0, 6, 3])
genes_7 = GenePool(Decimals=0, Maximum=8, Minimum=0, Value=[0, 0, 0, 0, 0, 0, 0, 0, 0, 0, 0])
genes_8 = GenePool(Decimals=0, Maximum=8, Minimum=0, Value=[6, 6, 6, 6, 6, 6, 6, 6, 6, 6, 6])
genes_9 = GenePool(Decimals=0, Maximum=8, Minimum=0, Value=[8, 8, 8, 8, 8, 8, 8, 8, 8, 8, 8])

# ---- group: No impact on design. Only on drawing of diagram. (continued)
expression_3 = Expression(x="11", Expression="x/2")
multiplication_3 = Multiplication(A=expression_3, B=neg_2)
addition_8 = Addition(A=model_screen_point.Y, B=multiplication_3, C=expression)
model_screen_point_6 = ModelScreenPoint(X=trim, Y=addition_8)  # -> ScreenPoint, X, Y

# ----
tower_2 = Tower(
    number_of_floors="11",
    shaftpieceid=concat_6,
    capsulepatternnorthwest=genes_8,
    capsulepatternsoutheast=genes_9,
    capsulepatternsouthwest=genes_6,
    capsulepatternnortheast=genes_7,
    diagramtambourstart=model_screen_point_2.ScreenPoint,
    diagramcapsulestarts=model_screen_point_6.ScreenPoint,
    diagramverticaldirection=addition)  # -> pc_2, co_2, first_tambour_id_2, last_tambour_id_2

concat_7 = Concatenate(FragmentD="ci", FragmentC="_", FragmentB=tower_2.last_tambour_id_2)
concat_8 = Concatenate(FragmentD="ci", FragmentC="_", FragmentB=tower.last_tambour_id_2)
pce_5 = ModelPiece(Id=concat_7, TypeName="Capital", ScreenPoint=model_screen_point_4.ScreenPoint)  # -> Piece, Id, TypeName, TypeVariant, Plane, ScreenPoint
pce_6 = ModelPiece(Id=concat_8, TypeName="Capital", ScreenPoint=model_screen_point_3.ScreenPoint)  # -> Piece, Id, TypeName, TypeVariant, Plane, ScreenPoint
con_2 = ModelConnection(
    ConnectedPieceId=pce_4.Id,
    ConnectedPieceTypePortId=concat_3,
    ConnectingPieceId=tower.first_tambour_id_2,
    ConnectingPieceTypePortId=bottom,
    Rotation=filter_2)  # -> Connection, ConnectedPieceId, ConnectedPieceTypePortId, ConnectingPieceId, ConnectingPieceTypePortId, Rotation, Tilt, Offset
con_3 = ModelConnection(
    ConnectedPieceId=pce_4.Id,
    ConnectedPieceTypePortId=concat_4,
    ConnectingPieceId=tower_2.first_tambour_id_2,
    ConnectingPieceTypePortId=top,
    Rotation=neg_5)  # -> Connection, ConnectedPieceId, ConnectedPieceTypePortId, ConnectingPieceId, ConnectingPieceTypePortId, Rotation, Tilt, Offset
con_4 = ModelConnection(ConnectedPieceId=tower.last_tambour_id_2, ConnectedPieceTypePortId=top, ConnectingPieceId=pce_6.Id, Rotation=neg_6)  # -> Connection, ConnectedPieceId, ConnectedPieceTypePortId, ConnectingPieceId, ConnectingPieceTypePortId, Rotation, Tilt, Offset
con_5 = ModelConnection(ConnectedPieceId=tower_2.last_tambour_id_2, ConnectingPieceId=pce_5.Id, Rotation="90")  # -> Connection, ConnectedPieceId, ConnectedPieceTypePortId, ConnectingPieceId, ConnectingPieceTypePortId, Rotation, Tilt, Offset

merge = Merge(Data1=pce_4.Piece, Data4=pce_6.Piece, Data5=pce_5.Piece)
merge_2 = Merge(Data1=tower.pc_2, Data2=tower_2.pc_2)
merge_3 = Merge(Data1=con_2.Connection, Data2=con_3.Connection, Data3=con_4.Connection, Data4=con_5.Connection)
merge_4 = Merge(Data1=tower.co_2, Data2=tower_2.co_2)
merge_5 = Merge(Data1=merge_3, Data2=merge_4)
merge_6 = Merge(Data1=merge, Data2=merge_2)
dsn_4 = ModelDesign(
    Name="Nakagin Capsule Tower",
    Description="The former Nakagin Capsule Tower from Tokyio.",
    Icon="🗼",
    Pieces=merge_6,
    Connections=merge_5)  # -> Design, Name, Description, Icon, Variant, Unit, Pieces, Connections, Qualities
dsn_5 = ModelDesign(Name="Capsule Tower", Description=panel, Icon=concat_2, Variant="11", Pieces=tower_2.pc_2, Connections=tower_2.co_2)  # -> Design, Name, Description, Icon, Variant, Unit, Pieces, Connections, Qualities
add_bridges = AddBridges(dn=dsn_4.Design, levels=genes)
filter_3 = StreamFilter(Gate=list_2, Stream0=add_bridges, Stream1=dsn_3.Design, Stream2=dsn_5.Design)

# ==== cluster Tower
diagramverticaldirection = ClusterInput()
number_of_floors = ClusterInput()
shaftpieceid = ClusterInput()
capsulepatternnorthwest = ClusterInput()
capsulepatternsoutheast = ClusterInput()
capsulepatternsouthwest = ClusterInput()
capsulepatternnortheast = ClusterInput()
floor = Panel("f")
diagramtambourstart = ClusterInput()
diagramcapsulestarts = ClusterInput()
panel = Panel("""0
0
1
0
1
0
2
3
3""")
panel_2 = Panel("""2
3
3
0
0
1
0
0
1""")
split_level = Panel("sl")
merge = Merge(Data1="1", Data2="3", Data3="5", Data4="7")
merge_2 = Merge(Data1="2", Data2="4", Data3="6", Data4="8")
door = Panel("d")
diagramcapsulestarts_2 = ScreenPoint(diagramcapsulestarts)
item = ListItem(List=diagramcapsulestarts_2, Index=0, Wrap=True)  # -> Item, Item1, Item2, Item3, Item4, Item5, Item6, Item7
model_screen_point = ModelScreenPoint(ScreenPoint=item.Item)  # -> ScreenPoint, X, Y
model_screen_point_2 = ModelScreenPoint(ScreenPoint=item.Item2)  # -> ScreenPoint, X, Y
model_screen_point_3 = ModelScreenPoint(ScreenPoint=item.Item4)  # -> ScreenPoint, X, Y
model_screen_point_4 = ModelScreenPoint(ScreenPoint=item.Item1)  # -> ScreenPoint, X, Y
model_screen_point_5 = ModelScreenPoint(ScreenPoint=item.Item6)  # -> ScreenPoint, X, Y
model_screen_point_6 = ModelScreenPoint(ScreenPoint=item.Item3)  # -> ScreenPoint, X, Y
model_screen_point_7 = ModelScreenPoint(ScreenPoint=item.Item5)  # -> ScreenPoint, X, Y
model_screen_point_8 = ModelScreenPoint(ScreenPoint=item.Item7)  # -> ScreenPoint, X, Y
diagramtambourstart_2 = ScreenPoint(diagramtambourstart)
model_screen_point_9 = ModelScreenPoint(ScreenPoint=diagramtambourstart_2)  # -> ScreenPoint, X, Y
diagramverticaldirection_2 = Integer(diagramverticaldirection)
number_of_floors_2 = Integer(number_of_floors)
series = Series(Start=model_screen_point_9.Y, Step=diagramverticaldirection_2, Count=number_of_floors_2)
series_2 = Series(Start=model_screen_point.Y, Step=diagramverticaldirection_2, Count=number_of_floors_2)
series_3 = Series(Start=model_screen_point_2.Y, Step=diagramverticaldirection_2, Count=number_of_floors_2)
series_4 = Series(Start=model_screen_point_3.Y, Step=diagramverticaldirection_2, Count=number_of_floors_2)
trim = TrimTree(Tree=series, Depth=1)
series_5 = Series(Start=model_screen_point_4.Y, Step=diagramverticaldirection_2, Count=number_of_floors_2)
series_6 = Series(Start=model_screen_point_5.Y, Step=diagramverticaldirection_2, Count=number_of_floors_2)
series_7 = Series(Start=model_screen_point_6.Y, Step=diagramverticaldirection_2, Count=number_of_floors_2)
series_8 = Series(Start=model_screen_point_7.Y, Step=diagramverticaldirection_2, Count=number_of_floors_2)
series_9 = Series(Start=model_screen_point_8.Y, Step=diagramverticaldirection_2, Count=number_of_floors_2)
trim_2 = TrimTree(Tree=series_2, Depth=1)
rev = ReverseList(List=trim)
trim_3 = TrimTree(Tree=series_3, Depth=1)
trim_4 = TrimTree(Tree=series_4, Depth=1)
trim_5 = TrimTree(Tree=series_5, Depth=1)
trim_6 = TrimTree(Tree=series_6, Depth=1)
trim_7 = TrimTree(Tree=series_7, Depth=1)
trim_8 = TrimTree(Tree=series_8, Depth=1)
trim_9 = TrimTree(Tree=series_9, Depth=1)
rev_2 = ReverseList(List=trim_2)
rev_3 = ReverseList(List=trim_3)
model_screen_point_10 = ModelScreenPoint(ScreenPoint=model_screen_point_9.ScreenPoint, Y=rev)  # -> ScreenPoint, X, Y
rev_4 = ReverseList(List=trim_4)
rev_5 = ReverseList(List=trim_5)
rev_6 = ReverseList(List=trim_7)
rev_7 = ReverseList(List=trim_6)
rev_8 = ReverseList(List=trim_8)
rev_9 = ReverseList(List=trim_9)
model_screen_point_11 = ModelScreenPoint(ScreenPoint=model_screen_point.ScreenPoint, Y=rev_2)  # -> ScreenPoint, X, Y
model_screen_point_12 = ModelScreenPoint(ScreenPoint=model_screen_point_2.ScreenPoint, Y=rev_3)  # -> ScreenPoint, X, Y
model_screen_point_13 = ModelScreenPoint(ScreenPoint=model_screen_point_3.ScreenPoint, Y=rev_4)  # -> ScreenPoint, X, Y
model_screen_point_14 = ModelScreenPoint(ScreenPoint=model_screen_point_4.ScreenPoint, Y=rev_5)  # -> ScreenPoint, X, Y
model_screen_point_15 = ModelScreenPoint(ScreenPoint=model_screen_point_5.ScreenPoint, Y=rev_7)  # -> ScreenPoint, X, Y
model_screen_point_16 = ModelScreenPoint(ScreenPoint=model_screen_point_6.ScreenPoint, Y=rev_6)  # -> ScreenPoint, X, Y
model_screen_point_17 = ModelScreenPoint(ScreenPoint=model_screen_point_7.ScreenPoint, Y=rev_8)  # -> ScreenPoint, X, Y
model_screen_point_18 = ModelScreenPoint(ScreenPoint=model_screen_point_8.ScreenPoint, Y=rev_9)  # -> ScreenPoint, X, Y
shaftpieceid_2 = Text(shaftpieceid)
capsulepatternnorthwest_2 = Integer(capsulepatternnorthwest)
item_2 = ListItem(List=panel, Index=capsulepatternnorthwest_2, Wrap=True)
item_3 = ListItem(List=panel_2, Index=capsulepatternnorthwest_2, Wrap=True)
item_4 = ListItem(List=merge, Index=item_2, Wrap=True)
item_5 = ListItem(List=merge_2, Index=item_3, Wrap=True)
capsulepatternsoutheast_2 = Integer(capsulepatternsoutheast)
item_6 = ListItem(List=panel_2, Index=capsulepatternsoutheast_2, Wrap=True)
item_7 = ListItem(List=panel, Index=capsulepatternsoutheast_2, Wrap=True)
item_8 = ListItem(List=merge, Index=item_7, Wrap=True)
item_9 = ListItem(List=merge_2, Index=item_6, Wrap=True)
capsulepatternnortheast_2 = Integer(capsulepatternnortheast)
item_10 = ListItem(List=panel, Index=capsulepatternnortheast_2, Wrap=True)
item_11 = ListItem(List=panel_2, Index=capsulepatternnortheast_2, Wrap=True)
item_12 = ListItem(List=merge_2, Index=item_11, Wrap=True)
item_13 = ListItem(List=merge, Index=item_10, Wrap=True)
capsulepatternsouthwest_2 = Integer(capsulepatternsouthwest)
item_14 = ListItem(List=panel, Index=capsulepatternsouthwest_2, Wrap=True)
item_15 = ListItem(List=panel_2, Index=capsulepatternsouthwest_2, Wrap=True)
item_16 = ListItem(List=merge, Index=item_14, Wrap=True)
item_17 = ListItem(List=merge_2, Index=item_15, Wrap=True)
bottom = Panel("b")
capsulevariantnorthright = Integer(item_12)
capsulevariantwestright = Integer(item_5)
capsulevarianteastleft = Integer(item_13)
capsulevariantwestleft = Integer(item_16)
capsulevariantsouthright = Integer(item_17)
capsulevariantsouthleft = Integer(item_8)
capsulevarianteastright = Integer(item_9)
capsulevariantnorthleft = Integer(item_4)
top = Panel("t")

series_10 = Series(Start=0, Step=1, Count=number_of_floors_2)
trim_10 = TrimTree(Tree=series_10, Depth=1)
concat = Concatenate(FragmentA=floor, FragmentB=trim_10)
concat_2 = Concatenate(FragmentD="t", FragmentE="_", FragmentA=concat, FragmentF="_", FragmentG=shaftpieceid_2)
lito3p = ListInto3Parts(ListToSlice=concat_2, StartIndex="1", EndIndex="-1")  # -> FilteredList, ItemsBefore, ItemsAfter; inputs ListToSlice: tree, StartIndex: tree of Int32, EndIndex: tree of Int32
# ---------- lito3p: Python ----------
if ghenv.Component.RunCount<2:
    __author__ = "Ueli Saluz"
    __version__ = "2020.05.28"
    
    ghenv.Component.Name = "ListInto3Parts"
    ghenv.Component.NickName = "LiTo3P"
    ghenv.Component.Description = "Slice list into 3 parts. All lists are sliced with the same indices. End index = 0 = length(list)."
    ghenv.Component.Message = "VER 1.6"

from System import Object
from Grasshopper import DataTree

def filterList(listToFilter,startIndex,endIndex):
    # Return: FilteredList, Before, After
    if (((startIndex == 0) or (startIndex is None)) and ((endIndex == 0) or (endIndex is None))) or (endIndex <= startIndex and endIndex > 0):
        return (listToFilter,None,None)
    elif (startIndex == 0) or (startIndex is None):
        return (listToFilter[:endIndex],None,listToFilter[endIndex:])
    elif (endIndex == 0) or (endIndex is None):
        print 1
        return (listToFilter[:startIndex],listToFilter[startIndex:],None)
    else:
        return (listToFilter[startIndex:endIndex],listToFilter[:startIndex],listToFilter[endIndex:])

if __name__ == "__main__":
    FilteredList = DataTree[Object]()
    ItemsBefore = DataTree[Object]()
    ItemsAfter = DataTree[Object]()
    
    for path in ListToSlice.Paths:
        listBranch = ListToSlice.Branch(path)
        pyList = list(listBranch)   #Convert .Net List to Python
        try: #terrible way of writing code but if I set the list to list access the performance decreases massivly due to many calls
            startIndex = StartIndex.Branch(path)
            startIndex = startIndex[0]
        except Exception:
            try:
                startIndex = StartIndex.Branch(0)
                startIndex = startIndex[0]
            except Exception:
                startIndex = 0
        try:
            endIndex = EndIndex.Branch(path)
            endIndex = endIndex[0]
        except Exception:
            try:
                endIndex = EndIndex.Branch(0)
                endIndex = endIndex[0]
            except Exception:
                endIndex = len(pyList)
        filtList=filterList(pyList,startIndex,endIndex)
        if filtList[0]:
            FilteredList.AddRange(filtList[0],path)
        if filtList[1]:
            ItemsBefore.AddRange(filtList[1],path)
        if filtList[2]:
            ItemsAfter.AddRange(filtList[2],path)
# ---------- end lito3p ----------
panel_3 = Panel("Single Storey")
pce = ModelPiece(Id=lito3p.FilteredList, TypeName="Tambour")  # -> Piece, Id, TypeName, TypeVariant, RootPlane, DiagramScreenPoint
pce_2 = ModelPiece(Id=lito3p.ItemsBefore, TypeName="Tambour", TypeVariant="First Storey")  # -> Piece, Id, TypeName, TypeVariant, RootPlane, DiagramScreenPoint
expression = Expression(x=number_of_floors_2, Expression="x=1")
pce_3 = ModelPiece(Id=lito3p.ItemsAfter, TypeName="Tambour", TypeVariant="Last Storey")  # -> Piece, Id, TypeName, TypeVariant, RootPlane, DiagramScreenPoint
merge_3 = Merge(Data1=pce_2.Piece, Data2=pce.Piece, Data3=pce_3.Piece)
pce_4 = ModelPiece(Id=concat_2, TypeName="Tambour")  # -> Piece, Id, TypeName, TypeVariant, RootPlane, DiagramScreenPoint
filter = StreamFilter(Gate=expression, Stream0=merge_3, Stream1=pce_4.Id)
pce_5 = ModelPiece(Piece=filter, TypeName="Tambour", DiagramScreenPoint=model_screen_point_10.ScreenPoint)  # -> Piece, Id, TypeName, TypeVariant, RootPlane, DiagramScreenPoint

concat_3 = Concatenate(FragmentA=split_level, FragmentB="0")
concat_4 = Concatenate(FragmentA=door, FragmentB="0")
concat_5 = Concatenate(FragmentA=concat_3, FragmentC="_", FragmentB=concat_4)
concat_6 = Concatenate(FragmentF="cs", FragmentA="_", FragmentD=concat_5, FragmentB="_", FragmentC=concat_2)
sde = ModelSide(PieceId=pce_5.Id, PieceTypePortId=concat_5)  # -> Side, PieceId, PieceTypePortId
pce_6 = ModelPiece(
    Id=concat_6,
    TypeName="Capsule",
    TypeVariant=capsulevarianteastleft,
    DiagramScreenPoint=model_screen_point_11.ScreenPoint)  # -> Piece, Id, TypeName, TypeVariant, RootPlane, DiagramScreenPoint
con = ModelConnection(ConnectedSide=sde.Side, ConnectingSide=pce_6.Id)  # -> Connection, ConnectedSide, ConnectingSide, Offset, Rotation, Offset_2, Tilt, Offset_3

concat_7 = Concatenate(FragmentA=split_level, FragmentB="0")
concat_8 = Concatenate(FragmentA=door, FragmentB="1")
concat_9 = Concatenate(FragmentA=concat_7, FragmentC="_", FragmentB=concat_8)
concat_10 = Concatenate(FragmentF="cs", FragmentA="_", FragmentD=concat_9, FragmentB="_", FragmentC=concat_2)
sde_2 = ModelSide(PieceId=pce_5.Id, PieceTypePortId=concat_9)  # -> Side, PieceId, PieceTypePortId
pce_7 = ModelPiece(
    Id=concat_10,
    TypeName="Capsule",
    TypeVariant=capsulevariantnorthright,
    DiagramScreenPoint=model_screen_point_11.ScreenPoint)  # -> Piece, Id, TypeName, TypeVariant, RootPlane, DiagramScreenPoint
con_2 = ModelConnection(ConnectedSide=sde_2.Side, ConnectingSide=pce_7.Id)  # -> Connection, ConnectedSide, ConnectingSide, Offset, Rotation, Offset_2, Tilt, Offset_3

concat_11 = Concatenate(FragmentA=split_level, FragmentB="0")
concat_12 = Concatenate(FragmentA=door, FragmentB="3")
concat_13 = Concatenate(FragmentA=concat_11, FragmentC="_", FragmentB=concat_12)
concat_14 = Concatenate(FragmentF="cs", FragmentA="_", FragmentD=concat_13, FragmentB="_", FragmentC=concat_2)
sde_3 = ModelSide(PieceId=pce_5.Id, PieceTypePortId=concat_13)  # -> Side, PieceId, PieceTypePortId
pce_8 = ModelPiece(
    Id=concat_14,
    TypeName="Capsule",
    TypeVariant=capsulevariantwestright,
    DiagramScreenPoint=model_screen_point_11.ScreenPoint)  # -> Piece, Id, TypeName, TypeVariant, RootPlane, DiagramScreenPoint
con_3 = ModelConnection(ConnectedSide=sde_3.Side, ConnectingSide=pce_8.Id)  # -> Connection, ConnectedSide, ConnectingSide, Offset, Rotation, Offset_2, Tilt, Offset_3

concat_15 = Concatenate(FragmentA=split_level, FragmentB="0")
concat_16 = Concatenate(FragmentA=door, FragmentB="2")
concat_17 = Concatenate(FragmentA=concat_15, FragmentC="_", FragmentB=concat_16)
concat_18 = Concatenate(FragmentF="cs", FragmentA="_", FragmentD=concat_17, FragmentB="_", FragmentC=concat_2)
sde_4 = ModelSide(PieceId=pce_5.Id, PieceTypePortId=concat_17)  # -> Side, PieceId, PieceTypePortId
pce_9 = ModelPiece(
    Id=concat_18,
    TypeName="Capsule",
    TypeVariant=capsulevariantnorthleft,
    DiagramScreenPoint=model_screen_point_11.ScreenPoint)  # -> Piece, Id, TypeName, TypeVariant, RootPlane, DiagramScreenPoint
con_4 = ModelConnection(ConnectedSide=sde_4.Side, ConnectingSide=pce_9.Id)  # -> Connection, ConnectedSide, ConnectingSide, Offset, Rotation, Offset_2, Tilt, Offset_3

concat_19 = Concatenate(FragmentA=split_level, FragmentB="1")
concat_20 = Concatenate(FragmentA=door, FragmentB="0")
concat_21 = Concatenate(FragmentA=concat_19, FragmentC="_", FragmentB=concat_20)
concat_22 = Concatenate(FragmentF="cs", FragmentA="_", FragmentD=concat_21, FragmentB="_", FragmentC=concat_2)
sde_5 = ModelSide(PieceId=pce_5.Id, PieceTypePortId=concat_21)  # -> Side, PieceId, PieceTypePortId
pce_10 = ModelPiece(
    Id=concat_22,
    TypeName="Capsule",
    TypeVariant=capsulevariantwestleft,
    DiagramScreenPoint=model_screen_point_11.ScreenPoint)  # -> Piece, Id, TypeName, TypeVariant, RootPlane, DiagramScreenPoint
con_5 = ModelConnection(ConnectedSide=sde_5.Side, ConnectingSide=pce_10.Id)  # -> Connection, ConnectedSide, ConnectingSide, Offset, Rotation, Offset_2, Tilt, Offset_3

concat_23 = Concatenate(FragmentA=split_level, FragmentB="1")
concat_24 = Concatenate(FragmentA=door, FragmentB="1")
concat_25 = Concatenate(FragmentA=concat_23, FragmentC="_", FragmentB=concat_24)
concat_26 = Concatenate(FragmentF="cs", FragmentA="_", FragmentD=concat_25, FragmentB="_", FragmentC=concat_2)
sde_6 = ModelSide(PieceId=pce_5.Id, PieceTypePortId=concat_25)  # -> Side, PieceId, PieceTypePortId
pce_11 = ModelPiece(
    Id=concat_26,
    TypeName="Capsule",
    TypeVariant=capsulevariantsouthright,
    DiagramScreenPoint=model_screen_point_11.ScreenPoint)  # -> Piece, Id, TypeName, TypeVariant, RootPlane, DiagramScreenPoint
con_6 = ModelConnection(ConnectedSide=sde_6.Side, ConnectingSide=pce_11.Id)  # -> Connection, ConnectedSide, ConnectingSide, Offset, Rotation, Offset_2, Tilt, Offset_3

item_18 = ListItem(List=pce_5.Piece, Index=0, Wrap=True)  # -> Item1, Item

shift = ShiftList(List=pce_5.Id, Shift="-1", Wrap="F")
shift_2 = ShiftList(List=pce_5.Id, Shift=1, Wrap="F")
trim_11 = TrimTree(Tree=shift_2, Depth=1)
trim_12 = TrimTree(Tree=shift, Depth=1)
sde_7 = ModelSide(PieceId=trim_12, PieceTypePortId=top)  # -> Side, PieceId, PieceTypePortId
sde_8 = ModelSide(PieceId=trim_11, PieceTypePortId=bottom)  # -> Side, PieceId, PieceTypePortId
con_7 = ModelConnection(ConnectedSide=sde_7.Side, ConnectingSide=sde_8.Side)  # -> Connection, ConnectedSide, ConnectingSide, Offset, Rotation, Offset_2, Tilt, Offset_3
filter_2 = StreamFilter(Gate=expression, Stream0=con_7.Connection)

pce_12 = ModelPiece(Piece=item_18.Item)  # -> Piece, Id, TypeName, TypeVariant, RootPlane, DiagramScreenPoint

concat_27 = Concatenate(FragmentA=split_level, FragmentB="2")
concat_28 = Concatenate(FragmentA=door, FragmentB="0")
concat_29 = Concatenate(FragmentA=concat_27, FragmentC="_", FragmentB=concat_28)
concat_30 = Concatenate(FragmentF="cs", FragmentA="_", FragmentD=concat_29, FragmentB="_", FragmentC=concat_2)
sde_9 = ModelSide(PieceId=pce_5.Id, PieceTypePortId=concat_29)  # -> Side, PieceId, PieceTypePortId
pce_13 = ModelPiece(
    Id=concat_30,
    TypeName="Capsule",
    TypeVariant=capsulevariantsouthleft,
    DiagramScreenPoint=model_screen_point_11.ScreenPoint)  # -> Piece, Id, TypeName, TypeVariant, RootPlane, DiagramScreenPoint
con_8 = ModelConnection(ConnectedSide=sde_9.Side, ConnectingSide=pce_13.Id)  # -> Connection, ConnectedSide, ConnectingSide, Offset, Rotation, Offset_2, Tilt, Offset_3

concat_31 = Concatenate(FragmentA=split_level, FragmentB="2")
concat_32 = Concatenate(FragmentA=door, FragmentB="1")
concat_33 = Concatenate(FragmentA=concat_31, FragmentC="_", FragmentB=concat_32)
concat_34 = Concatenate(FragmentF="cs", FragmentA="_", FragmentD=concat_33, FragmentB="_", FragmentC=concat_2)
sde_10 = ModelSide(PieceId=pce_5.Id, PieceTypePortId=concat_33)  # -> Side, PieceId, PieceTypePortId
pce_14 = ModelPiece(
    Id=concat_34,
    TypeName="Capsule",
    TypeVariant=capsulevarianteastright,
    DiagramScreenPoint=model_screen_point_11.ScreenPoint)  # -> Piece, Id, TypeName, TypeVariant, RootPlane, DiagramScreenPoint
con_9 = ModelConnection(ConnectedSide=sde_10.Side, ConnectingSide=pce_14.Id)  # -> Connection, ConnectedSide, ConnectingSide, Offset, Rotation, Offset_2, Tilt, Offset_3

merge_4 = Merge(
    Data1=filter_2,
    Data2=con.Connection,
    Data3=con_2.Connection,
    Data4=con_4.Connection,
    Data5=con_3.Connection,
    Data6=con_5.Connection,
    Data7=con_6.Connection,
    Data8=con_8.Connection,
    Data9=con_9.Connection)
merge_5 = Merge(
    Data1=pce_5.Piece,
    Data2=pce_6.Piece,
    Data3=pce_7.Piece,
    Data4=pce_9.Piece,
    Data5=pce_8.Piece,
    Data6=pce_10.Piece,
    Data7=pce_11.Piece,
    Data8=pce_13.Piece,
    Data9=pce_14.Piece)
co = Connection(merge_4)
pc = Piece(merge_5)
pc_2 = ClusterOutput(pc)
co_2 = ClusterOutput(co)
pce_15 = ModelPiece(Piece=item_18.Item1)  # -> Piece, Id, TypeName, TypeVariant, RootPlane, DiagramScreenPoint
first_tambour_id = Text(pce_12.Id)
first_tambour_id_2 = ClusterOutput(first_tambour_id)
last_tambour_id = Text(pce_15.Id)
last_tambour_id_2 = ClusterOutput(last_tambour_id)

# ==== cluster AddBridges
dn = ClusterInput()
levels = ClusterInput()
dn_2 = Design(dn)
levels_2 = Integer(levels)
expression = Expression(x=levels_2, Expression="x-1")
concat = Concatenate(
    FragmentA="cs(",
    FragmentD="sl",
    FragmentH="0",
    FragmentI="#d",
    FragmentJ="1",
    FragmentB=",t(f",
    FragmentC=expression,
    FragmentE=",b(c",
    FragmentF="1",
    FragmentG=")))")
concat_2 = Concatenate(
    FragmentA="cs(",
    FragmentD="sl",
    FragmentH="0",
    FragmentI="#d",
    FragmentJ="2",
    FragmentB=",t(f",
    FragmentC=expression,
    FragmentE=",b(c",
    FragmentF="0",
    FragmentG=")))")
merge = Merge(Data1=concat_2, Data2=concat)
removepiecesindesign = PcInDsn(dn=dn_2, ids=merge)  # -> dn_4, removed_pieces_2, removed_connections_2
lng = ListLength(List=levels_2)
dsn = ModelDesign(Design=removepiecesindesign.dn_4)  # -> Design, Name, Description, Icon, Variant, Unit, Pieces, Connections, Qualities
split = SplitList(List=removepiecesindesign.removed_pieces_2, Index=lng)  # -> ListA, ListB
split_2 = SplitList(List=removepiecesindesign.removed_connections_2, Index=lng)  # -> ListA, ListB
trim = TrimTree(Tree=dsn.Pieces, Depth=1)
trim_2 = TrimTree(Tree=dsn.Connections, Depth=1)
trim_3 = TrimTree(Tree=split.ListA, Depth=1)
concat_3 = Concatenate(
    FragmentA="br(",
    FragmentD="sl",
    FragmentH="0",
    FragmentI="#d",
    FragmentJ="2",
    FragmentB=",t(f",
    FragmentC=expression,
    FragmentE=",b(c",
    FragmentF="0",
    FragmentG=")))")
trim_4 = TrimTree(Tree=split_2.ListA, Depth=1)
pce = ModelPiece(Piece=trim_3, Id=concat_3, TypeName="Bridge")  # -> Piece, Id, TypeName, TypeVariant, RootPlane, DiagramScreenPoint
con = ModelConnection(Connection=trim_4)  # -> Connection, ConnectedSide, ConnectingSide, Offset, Rotation, Offset_2, Tilt, Offset_3
sde = ModelSide(Side=con.ConnectingSide, PieceId=pce.Id, PieceTypePortId="e")  # -> Side, PieceId, PieceTypePortId
con_2 = ModelConnection(Connection=con.Connection, ConnectingSide=sde.Side)  # -> Connection, ConnectedSide, ConnectingSide, Offset, Rotation, Offset_2, Tilt, Offset_3
merge_2 = Merge(Data1=trim, Data2=pce.Piece)
merge_3 = Merge(Data1=trim_2, Data2=con_2.Connection)
dsn_2 = ModelDesign(Design=dsn.Design, Pieces=merge_2, Connections=merge_3)  # -> Design, Name, Description, Icon, Variant, Unit, Pieces, Connections, Qualities
dn_3 = Design(dsn_2.Design)
dn_4 = ClusterOutput(dn_3)

# ==== cluster PcInDsn: Remove pieces and all connections with these pieces from a design.
dn = ClusterInput()
ids = ClusterInput()
dn_2 = Design(dn)
ids_2 = Text(ids)
dsn = ModelDesign(Design=dn_2)  # -> Design, Name, Description, Icon, Variant, Unit, Pieces, Connections, Qualities

trim = TrimTree(Tree=dsn.Connections, Depth=1)
con = ModelConnection(Connection=trim)  # -> Connection, ConnectedSide, ConnectingSide, Offset, Rotation, Offset_2, Tilt, Offset_3
sde = ModelSide(Side=con.ConnectedSide)  # -> Side, PieceId, PieceTypePortId
sde_2 = ModelSide(Side=con.ConnectingSide)  # -> Side, PieceId, PieceTypePortId
expression = Expression(x=graft(sde_2.PieceId), y=ids_2, Expression="x=y")
expression_2 = Expression(x=graft(sde.PieceId), y=ids_2, Expression="x=y")
ma = MassAddition(Input=expression_2)  # -> Result, PartialResults
ma_2 = MassAddition(Input=expression)  # -> Result, PartialResults
or = GateOr(A=ma.Result, B=ma_2.Result)
trim_2 = TrimTree(Tree=or, Depth=1)
dispatch = Dispatch(List=trim, DispatchPattern=trim_2)  # -> ListA, ListB

trim_3 = TrimTree(Tree=dsn.Pieces, Depth=1)
pce = ModelPiece(Piece=trim_3)  # -> Piece, Id, TypeName, TypeVariant, RootPlane, DiagramScreenPoint
expression_3 = Expression(x=graft(pce.Id), y=ids_2, Expression="x=y")
ma_3 = MassAddition(Input=expression_3)  # -> Result, PartialResults
trim_4 = TrimTree(Tree=ma_3.Result, Depth=1)
dispatch_2 = Dispatch(List=trim_3, DispatchPattern=trim_4)  # -> ListA, ListB

dsn_2 = ModelDesign(Design=dsn.Design, Pieces=dispatch_2.ListB, Connections=dispatch.ListB)  # -> Design, Name, Description, Icon, Variant, Unit, Pieces, Connections, Qualities
removed_connections = Connection(dispatch.ListA)
dn_3 = Design(dsn_2.Design)
removed_pieces = Piece(dispatch_2.ListA)
dn_4 = ClusterOutput(dn_3)
removed_pieces_2 = ClusterOutput(removed_pieces)
removed_connections_2 = ClusterOutput(removed_connections)
