# Grasshopper definition nakagin-capsule-tower-speckle.gh (Grasshopper 1.0.8)
# plug-ins: Speckle 2, semio

# mutation DeleteModel($input: DeleteModelInput!) {
#   modelMutations {
#     delete(input: $input)
#   }
# }
# 
# {
#   "input": {
#     "projectId": "e7de1a2f8f",
#     "id": ""
#   }
# }
list = Accounts(
    {"No account selected": , "Account (ueli.saluz@iek.uni-hannover.de | https://app.speckle.systems)": "https://app.speckle.systems/?id=9168be9d22"}, selected="Account (ueli.saluz@iek.uni-hannover.de | https://app.speckle.systems)",
    FirstSelectedItem="https://app.speckle.systems/?id=9168be9d22")
toggle = BooleanToggle(True)
curdir = CurrentDirectory()  # -> D, P, S
# ---------- curdir: Python ----------
#Component Information
#--------------------------------------------------------------------------------------------
if ghenv.Component.RunCount<2:
    #General
    #--------------------------------------------------------------------------------------------
    __author__ = "Ueli Saluz"
    __version__ = "2023.09.29"
    
    ghenv.Component.Name = "CurrentDirectory"
    ghenv.Component.NickName = "CurDir"
    ghenv.Component.Description = "Current directory of the current grasshopper file."
    ghenv.Component.Message = "VER 1.0"
    ghenv.Component.Category = "Params"
    ghenv.Component.SubCategory = "Util"
    
    #Outputs
    #--------------------------------------------------------------------------------------------
    outputIndex=0
    
    ghenv.Component.Params.Output[outputIndex].Name = "Directory"
    ghenv.Component.Params.Output[outputIndex].NickName = "D"
    ghenv.Component.Params.Output[outputIndex].Description = "Directory of the current grasshopper file."
    outputIndex+=1
    
    ghenv.Component.Params.Output[outputIndex].Name = "Path"
    ghenv.Component.Params.Output[outputIndex].NickName = "P"
    ghenv.Component.Params.Output[outputIndex].Description = "Path of the current grasshopper file."
    outputIndex+=1
    
    ghenv.Component.Params.Output[outputIndex].Name = "Separator"
    ghenv.Component.Params.Output[outputIndex].NickName = "S"
    ghenv.Component.Params.Output[outputIndex].Description = "Separator of the current system."
    outputIndex+=1

#Imports
#--------------------------------------------------------------------------------------------
from os.path import dirname
from os import sep

#Solver - Run with trees to enhance performance drastically
#--------------------------------------------------------------------------------------------
if __name__ == "__main__":
    P = ghenv.Component.OnPingDocument().FilePath
    D = dirname(P)
    S = sep
# ---------- end curdir ----------
# https://app.speckle.systems/explorer
# 
# {
#   activeUser {
#     projects {
#       items {
#         models {
#           items {
#             id
#             name
#           }
#         }
#       }
#     }
#   }
# }
toggle_2 = BooleanToggle(True)
curdir_2 = CurrentDirectory()  # -> PD, D, P, S
# ---------- curdir_2: Python ----------
# Component Information
# --------------------------------------------------------------------------------------------
if ghenv.Component.RunCount < 2:
    # General
    # --------------------------------------------------------------------------------------------
    __author__ = "Ueli Saluz"
    __version__ = "2024.07.26"

    ghenv.Component.Name = "CurrentDirectory"
    ghenv.Component.NickName = "CurDir"
    ghenv.Component.Description = "Current directory of the current grasshopper file."
    ghenv.Component.Message = "VER 1.1"
    ghenv.Component.Category = "Params"
    ghenv.Component.SubCategory = "Util"

    # Outputs
    # --------------------------------------------------------------------------------------------
    outputIndex = 0

    ghenv.Component.Params.Output[outputIndex].Name = "ParentDirectory"
    ghenv.Component.Params.Output[outputIndex].NickName = "PD"
    ghenv.Component.Params.Output[outputIndex].Description = "Parent directory of the current directory."
    outputIndex += 1

    ghenv.Component.Params.Output[outputIndex].Name = "Directory"
    ghenv.Component.Params.Output[outputIndex].NickName = "D"
    ghenv.Component.Params.Output[outputIndex].Description = "Directory of the current grasshopper file."
    outputIndex += 1

    ghenv.Component.Params.Output[outputIndex].Name = "Path"
    ghenv.Component.Params.Output[outputIndex].NickName = "P"
    ghenv.Component.Params.Output[outputIndex].Description = "Path of the current grasshopper file."
    outputIndex += 1

    ghenv.Component.Params.Output[outputIndex].Name = "Separator"
    ghenv.Component.Params.Output[outputIndex].NickName = "S"
    ghenv.Component.Params.Output[outputIndex].Description = "Separator of the current system."
    outputIndex += 1

# Imports
# --------------------------------------------------------------------------------------------
from os.path import dirname, abspath
from os import sep

# Solver - Run with trees to enhance performance drastically
# --------------------------------------------------------------------------------------------
if __name__ == "__main__":
    P = ghenv.Component.OnPingDocument().FilePath
    D = dirname(P)
    PD = dirname(D)
    S = sep
# ---------- end curdir_2 ----------
kit = LoadKit(Directory=curdir_2.PD, Run=toggle)  # -> Name, Description, Icon, Url, Homepage, Types, Formations
kit_2 = LoadKit(Directory=curdir_2.PD, Run=toggle_2)  # -> Name, Description, Icon, Url, Homepage, Types, Formations
trim = TrimTree(Tree=kit.Formations, Depth=1)
for = ModelFormation(Formation=trim)  # -> Formation, Name, Description, Icon, Variant, Unit, Pieces, Connections, Qualities
trim_2 = TrimTree(Tree=kit_2.Types, Depth=1)
block_instance = ModelBlockInstance()  # -> BlockInstance, Transform, BlockDefinition
typ = ModelType(Type=trim_2)  # -> Type, Name, Description, Icon, Variant, Unit, Representations, Ports, Qualities
expression = Expression(x=for.Variant, y="Futuristic", Expression="x=y")
expression_2 = Expression(x=for.Name, y="Nakagin Capsule Tower", Expression="x=y")
expression_3 = Expression(x=for.Variant, Expression="x=y")

curdir_3 = CurrentDirectory()  # -> PD, D, P, S; same code as curdir_2
series = Series(Start="1", Step=1, Count="8")
concat = Concatenate(FragmentA=curdir_3.PD, FragmentB=curdir_3.S, FragmentC="representations")
trim_3 = TrimTree(Tree=series, Depth=1)
concat_2 = Concatenate(FragmentA=concat, FragmentB=curdir_3.S, FragmentC="capsule")
panel = Panel("""1to500
1to200""")
concat_3 = Concatenate(FragmentA=concat_2, FragmentB="_", FragmentC=trim_3)
concat_4 = Concatenate(FragmentA=graft(concat_3), FragmentC="_", FragmentB=panel)
concat_5 = Concatenate(FragmentA=concat_3, FragmentB=".3dm")  # -> graft(Result)
concat_6 = Concatenate(FragmentA=concat_4, FragmentC="_", FragmentB="volume")
concat_7 = Concatenate(FragmentA=concat_6, FragmentB=".3dm")
merge = Merge(Data1=concat_5, Data2=concat_7)
panel_2 = Panel("""True
False
True""")
trim_4 = TrimTree(Tree=merge, Depth=1)
dispatch = Dispatch(List=trim_4, DispatchPattern=panel_2)  # -> ListA, ListB

ty = Type(null)
typ_url = Text()
rep_urls = Text()
and = GateAnd(A=expression_2, B=expression_3)
ty_2 = Type()
and_2 = GateAnd(A=expression_2, B=expression)
rep = ModelRepresentation(Representation=typ.Representations)  # -> Representation, Url, LoD, Tags, Tags_2
typ_2 = ModelType(Type=ty)  # -> Type, Name, Description, Icon, Variant, Unit, Representations, Ports, Qualities
block_definition = ModelBlockDefinition()  # -> BlockDefinition, Objects, Name
cull = CullPattern(List=trim, CullPattern=and)
typ_3 = ModelType(Type=ty_2)  # -> Type, Name, Description, Icon, Variant, Unit, Representations, Ports, Qualities
cull_2 = CullPattern(List=trim, CullPattern=and_2)
trim_5 = TrimTree(Tree=rep.Url, Depth=1)
for_2 = ModelFormation(Formation=cull)  # -> Formation, Name, Description, Icon, Variant, Unit, Pieces, Connections, Qualities
export_definition = ExportModelBlockDefinition(Overwrite=False, Export=False)  # -> BlockDefinition, FilePath, Exported
merge_2 = Merge(Data1=typ_3.Name, Data2=typ_3.Variant)
tsort = SortText(Keys=trim_5, Culture=127)  # -> Keys, Values
concat_8 = Concatenate(FragmentA=curdir_2.PD, FragmentB=curdir_2.S, FragmentC=trim_5)
panel_3 = Panel(concat_8)
trim_6 = TrimTree(Tree=typ_3.Representations, Depth=1)
screate = CreateStream()
scn = GetScene(FormationName=for_2.Name, FormationVariant=for_2.Variant, Run=toggle)
rep_2 = ModelRepresentation(Representation=trim_6)  # -> Representation, Url, LoD, Tags, Tags_2
panel_4 = Panel(tsort.Keys)
sup = StreamUpdate(Name=typ_2.Name, Description=typ_2.Description)
scn_2 = FilterScene(Scene=scn, Tags="volume")  # -> Representations, Planes, PiecesIds, ParentsPiecesIds
join = TextJoin(Text=rep_2.Tags, Join="-")
cluster = Cluster(paths=trim_4)

send = Send(
    Stream=cluster,
    AutoSend=False,
    CurrentComponentState="up_to_date",
    KitName="Objects",
    UseDefaultCache=True,
    selectedKitName="Objects")  # disabled
panel_5 = Panel("""b3c20db970
6f52c1e6b1
45ab357369
35296b2470
e6c366306e
f16baa9eba
dd564c0e68
9442aab847
29526c7d12
2e5ee46295
b3a9105a14
ff37b776dd
fc4aea84b4
b7243eed93
5004160f7d
02d90f65c0
b8c26ca1c9
a6e1f7d736
c5e7e776cc
0da1e26dff
a3b1c730a1
fa6f77ead5
c696cc23a3
532cc5697c""")
concat_9 = Concatenate(FragmentA="https://app.speckle.systems/projects/e7de1a2f8f/models/", FragmentB=panel_5)  # -> graft(Result)

null = NullItem(Item=join)  # -> NullFlags, InvalidFlags, Description
tstat = TreeStatistics(Tree=join)  # -> Paths, Length, Count
trim_7 = TrimTree(Tree=scn_2.Representations, Depth=1)
trim_8 = TrimTree(Tree=scn_2.Planes, Depth=1)
dispatch_2 = Dispatch(List=tstat.Paths, DispatchPattern=flatten(null.NullFlags))  # -> ListA, ListB
expression_4 = Expression(x=merge_2, y=join, Expression="x")
import = ImportContent(FilePath=concat_8, Import=toggle_2)  # -> ModelTransform, Objects, Layers, Linetypes, HatchPatterns, AnnotationStyles, Materials, BlockDefinitions
rep_3 = ModelRepresentation(Representation=trim_7)  # -> Representation, Url, LevelOfDetail, Tags, Tags_2
branch = TreeBranch(Tree=expression_4, Path=dispatch_2.ListA, MaintainPaths=True)
branch_2 = TreeBranch(Tree=join, Path=dispatch_2.ListB, MaintainPaths=True)
branch_3 = TreeBranch(Tree=expression_4, Path=dispatch_2.ListB, MaintainPaths=True)
object = ModelObject(Object=import.Objects)  # -> Object, Geometry, Name, Layer, Visibility, Display, Drafting, Render
# base/blob/1to200/volume
# base/blob/1to500/volume
# base/1to200/volume
# base/1to500/volume
# bridge/1to200/volume
# bridge/1to500/volume
# cylindric capital/1to200/volume
# cylindric capital/1to500/volume
# cylindric capital
# capital/1to200/volume
# capital/1to500/volume
# cylindric shaft/4/1to200/volume
# cylindric shaft/3/1to200/volume
# cylindric shaft/2/1to200/volume
# cylindric shaft/1/1to200/volume
# cylindric shaft/4
# cylindric shaft/3
# cylindric shaft/2
# cylindric shaft/1
# cylindric shaft/4/1to500/volume
# cylindric shaft/3/1to500/volume
# cylindric shaft/2/1to500/volume
# cylindric shaft/1/1to500/volume
# ellipsoid capsule/1/1to200/volume
# ellipsoid capsule/2/1to200/volume
# ellipsoid capsule/3/1to200/volume
# ellipsoid capsule/4/1to200/volume
# ellipsoid capsule/5/1to200/volume
# ellipsoid capsule/6/1to200/volume
# ellipsoid capsule/1/1to500/volume
# ellipsoid capsule/2/1to500/volume
# ellipsoid capsule/3/1to500/volume
# ellipsoid capsule/4/1to500/volume
# ellipsoid capsule/5/1to500/volume
# ellipsoid capsule/6/1to500/volume
# ellipsoid capsule/7/1to200/volume
# ellipsoid capsule/7/1to500/volume
# ellipsoid capsule/8/1to500/volume
# ellipsoid capsule/8/1to200/volume
# shaft/3/1to200/volume
# shaft/3/1to500/volume
# shaft/2/1to200/volume
# shaft/2/1to500/volume
# shaft/1/1to200/volume
# shaft/1/1to500/volume
# shaft/4
# shaft/3
# shaft/2
# shaft/1
# ellipsoid capsule/8
# ellipsoid capsule/7
# ellipsoid capsule/6
# ellipsoid capsule/5
# ellipsoid capsule/4
# ellipsoid capsule/3
# ellipsoid capsule/2
# ellipsoid capsule/1
# capital
# bridge
# base/blob
# base
# capsule/2
# capsule/2/1to200/volume
# capsule/2/1to500/volume
# capsule/8/1to200/volume
# capsule/8/1to500/volume
# capsule/8
# capsule/7/1to200/volume
# capsule/7
# capsule/7/1to500/volume
# capsule/6/1to200/volume
# capsule/5/1to200/volume
# capsule/6/1to500/volume
# capsule/6
# capsule/5/1to500/volume
# capsule/5
# capsule/4/1to200/volume
# capsule/4/1to500/volume
# capsule/4
# capsule/3/1to200/volume
# capsule/3/1to500/volume
# capsule/3
# capsule/1/1to200/volume
# capsule/1/1to500/volume
# capsule/1
panel_6 = Panel("""2069b62658
e5d9d8631c
b394acfd5c
e5267da44d
c7c924a1d6
833a270493
9e40d26d9a
ae4ed21120
91a2467032
90435c0046
82fd28f19e
2e28aa8793
ee2abc0933
b2a77f0b14
ee75062a05
b2bfd6c511
15b951df21
aa88f8ad85
2abea47208
8c8a379457
53ad93189b
12e646f641
8f7a2dc253
f8a0750f34
d7c20e7ea4
58af8da8c8
80ad44ffe9
22564f1ee2
c35e56f23a
08abe6efbe
2a87d1fb6f
d6ddf1d05d
0c53ae86dc
19c41d4361
fa19ddafc5
c5306eb015
bfdbce0be1
ba36f367e7
ada7ff222e
2e1c4e9276
d334e95f16
1686af0764
0b0a7d176f
d9f3f12fb2
a345480d70
5f7925052c
800fc8722c
87cf9a1f06
fe5014698c
7e83bbd58f
798de822b1
f2f4600e82
e1470f6d13
f0c1dd4f19
0b45e76f8a
c9161c3f93
2704ef9cec
47481b6b08
bffc47943f
1f928d8bba
e99ae73f1a
35296b2470
f16baa9eba
e6c366306e
532cc5697c
c696cc23a3
fa6f77ead5
a3b1c730a1
c5e7e776cc
0da1e26dff
a6e1f7d736
5004160f7d
b8c26ca1c9
02d90f65c0
b7243eed93
fc4aea84b4
ff37b776dd
b3a9105a14
2e5ee46295
29526c7d12
9442aab847
dd564c0e68
45ab357369
6f52c1e6b1
b3c20db970""")
merge_3 = Merge(Data1=branch_3, Data2=branch_2)
layer = ModelLayer(Layer=object.Layer)  # -> Layer, Name, Hidden, Locked, DisplayColour, Material, Linetype
merge_4 = Merge(Data1=branch, Data2=merge_3)
csokv = CreateSpeckleObjectByKeyValue(Keys=layer.Name, Values=object.Geometry, selectedKitName="Objects")

bang = ExplodeTree(Data=cluster)  # -> Branch0, Branch1, Branch2, Branch3, Branch4, Branch5, Branch6, Branch7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
bang_2 = ExplodeTree()  # -> Branch0, Branch1, Branch2, Branch3, Branch4, Branch5, Branch6, Branch7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
send_2 = Send(
    Stream=bang.Branch0,
    Data=bang_2.Branch0,
    AutoSend=False,
    BaseId="3b42f447e43b6af45f6783af376f4cd5",
    CurrentComponentState="expired",
    KitName="Objects",
    OutputWrappers="https://app.speckle.systems\te7de1a2f8f\t433b4b98f3",
    UseDefaultCache=True,
    selectedKitName="Objects")
send_3 = Send(
    Stream=bang.Branch3,
    Data=bang_2.Branch3,
    AutoSend=False,
    BaseId="213c204cf515bcf11437be5809e71718",
    CurrentComponentState="expired",
    KitName="Objects",
    OutputWrappers="https://app.speckle.systems\te7de1a2f8f\t7832664e01",
    UseDefaultCache=True,
    selectedKitName="Objects")
send_4 = Send(
    Stream=bang.Branch6,
    Data=bang_2.Branch6,
    AutoSend=False,
    BaseId="4378f388df04bba2706aecf89db4f635",
    CurrentComponentState="expired",
    KitName="Objects",
    OutputWrappers="https://app.speckle.systems\te7de1a2f8f\t9d0c379d10",
    UseDefaultCache=True,
    selectedKitName="Objects")
send_5 = Send(
    Stream=bang.Branch9,
    Data=bang_2.Branch9,
    AutoSend=False,
    BaseId="2220ddcf2ccf7dc17fac0516f677a9c9",
    CurrentComponentState="expired",
    KitName="Objects",
    OutputWrappers="https://app.speckle.systems\te7de1a2f8f\tf0d9172377",
    UseDefaultCache=True,
    selectedKitName="Objects")
send_6 = Send(
    Stream=bang.Branch12,
    Data=bang_2.Branch12,
    AutoSend=False,
    BaseId="c31bedfb9aec055ed0fd24c9de38d4a3",
    CurrentComponentState="expired",
    KitName="Objects",
    OutputWrappers="https://app.speckle.systems\te7de1a2f8f\t669fae4816",
    UseDefaultCache=True,
    selectedKitName="Objects")
send_7 = Send(
    Stream=bang.Branch15,
    Data=bang_2.Branch15,
    AutoSend=False,
    BaseId="d41258c5ae9da4c3f03af1be56f3336f",
    CurrentComponentState="expired",
    KitName="Objects",
    OutputWrappers="https://app.speckle.systems\te7de1a2f8f\tcb98b9fed6",
    UseDefaultCache=True,
    selectedKitName="Objects")
send_8 = Send(
    Stream=bang.Branch18,
    Data=bang_2.Branch18,
    AutoSend=False,
    BaseId="71e40983b48e2267a66c6adebeaa54ac",
    CurrentComponentState="expired",
    KitName="Objects",
    OutputWrappers="https://app.speckle.systems\te7de1a2f8f\t521e866ac6",
    UseDefaultCache=True,
    selectedKitName="Objects")
send_9 = Send(
    Stream=bang.Branch21,
    Data=bang_2.Branch21,
    AutoSend=False,
    BaseId="65e5d881d267c0c21baa4a1565ae3c95",
    CurrentComponentState="expired",
    KitName="Objects",
    OutputWrappers="https://app.speckle.systems\te7de1a2f8f\td14d808898",
    UseDefaultCache=True,
    selectedKitName="Objects")
send_10 = Send(
    Stream=bang.Branch1,
    Data=bang_2.Branch1,
    AutoSend=False,
    BaseId="b1f973a595372dd2237a7e559214bfe2",
    CurrentComponentState="expired",
    KitName="Objects",
    OutputWrappers="https://app.speckle.systems\te7de1a2f8f\tb255c9b6b3",
    UseDefaultCache=True,
    selectedKitName="Objects")
send_11 = Send(
    Stream=bang.Branch4,
    Data=bang_2.Branch4,
    AutoSend=False,
    BaseId="c240fb45dd218b8e88724bb42db66139",
    CurrentComponentState="expired",
    KitName="Objects",
    OutputWrappers="https://app.speckle.systems\te7de1a2f8f\t4cff71de9f",
    UseDefaultCache=True,
    selectedKitName="Objects")
send_12 = Send(
    Stream=bang.Branch7,
    Data=bang_2.Branch7,
    AutoSend=False,
    BaseId="638de490dd1162f4aaf95a9137b557de",
    CurrentComponentState="expired",
    KitName="Objects",
    OutputWrappers="https://app.speckle.systems\te7de1a2f8f\t8b166ebb33",
    UseDefaultCache=True,
    selectedKitName="Objects")
send_13 = Send(
    Stream=bang.Branch10,
    Data=bang_2.Branch10,
    AutoSend=False,
    BaseId="322e4f2a30077588df4aa16f3f79e31c",
    CurrentComponentState="expired",
    KitName="Objects",
    OutputWrappers="https://app.speckle.systems\te7de1a2f8f\t6af26bb462",
    UseDefaultCache=True,
    selectedKitName="Objects")
send_14 = Send(
    Stream=bang.Branch13,
    Data=bang_2.Branch13,
    AutoSend=False,
    BaseId="279efc5d74020046ec642f167f082284",
    CurrentComponentState="expired",
    KitName="Objects",
    OutputWrappers="https://app.speckle.systems\te7de1a2f8f\t9c54bd194d",
    UseDefaultCache=True,
    selectedKitName="Objects")
send_15 = Send(
    Stream=bang.Branch16,
    Data=bang_2.Branch16,
    AutoSend=False,
    BaseId="860efa16c3ee09d8cbd35822150aa8ad",
    CurrentComponentState="expired",
    KitName="Objects",
    OutputWrappers="https://app.speckle.systems\te7de1a2f8f\t2d3604828c",
    UseDefaultCache=True,
    selectedKitName="Objects")
send_16 = Send(
    Stream=bang.Branch19,
    Data=bang_2.Branch19,
    AutoSend=False,
    BaseId="ad80cf7e6bc34b6e1d2d8f1b8a7664bd",
    CurrentComponentState="expired",
    KitName="Objects",
    OutputWrappers="https://app.speckle.systems\te7de1a2f8f\t05a392a329",
    UseDefaultCache=True,
    selectedKitName="Objects")
send_17 = Send(
    Stream=bang.Branch22,
    Data=bang_2.Branch22,
    AutoSend=False,
    BaseId="dca148403483c93b0b36b166d176992f",
    CurrentComponentState="expired",
    KitName="Objects",
    OutputWrappers="https://app.speckle.systems\te7de1a2f8f\tbaca132240",
    UseDefaultCache=True,
    selectedKitName="Objects")
send_18 = Send(
    Stream=bang.Branch2,
    Data=bang_2.Branch2,
    AutoSend=False,
    BaseId="bd9c06a2db308c4affb8fa9817186308",
    CurrentComponentState="expired",
    KitName="Objects",
    OutputWrappers="https://app.speckle.systems\te7de1a2f8f\tcf0329dbd8",
    UseDefaultCache=True,
    selectedKitName="Objects")
send_19 = Send(
    Stream=bang.Branch5,
    Data=bang_2.Branch5,
    AutoSend=False,
    BaseId="49208f564267d7c0fba7b27f009ed157",
    CurrentComponentState="expired",
    KitName="Objects",
    OutputWrappers="https://app.speckle.systems\te7de1a2f8f\t7bf618c472",
    UseDefaultCache=True,
    selectedKitName="Objects")
send_20 = Send(
    Stream=bang.Branch8,
    Data=bang_2.Branch8,
    AutoSend=False,
    BaseId="eafa42eda353225e7a0b1d98629dcc7a",
    CurrentComponentState="expired",
    KitName="Objects",
    OutputWrappers="https://app.speckle.systems\te7de1a2f8f\tdf3de042ab",
    UseDefaultCache=True,
    selectedKitName="Objects")
send_21 = Send(
    Stream=bang.Branch11,
    Data=bang_2.Branch11,
    AutoSend=False,
    BaseId="1d8389dc14d37b292ae90c5751148979",
    CurrentComponentState="expired",
    KitName="Objects",
    OutputWrappers="https://app.speckle.systems\te7de1a2f8f\te363f58d78",
    UseDefaultCache=True,
    selectedKitName="Objects")
send_22 = Send(
    Stream=bang.Branch14,
    Data=bang_2.Branch14,
    AutoSend=False,
    BaseId="c21a868a5626e23985d96665fbf50a31",
    CurrentComponentState="expired",
    KitName="Objects",
    OutputWrappers="https://app.speckle.systems\te7de1a2f8f\tedd125a722",
    UseDefaultCache=True,
    selectedKitName="Objects")
send_23 = Send(
    Stream=bang.Branch17,
    Data=bang_2.Branch17,
    AutoSend=False,
    BaseId="343f36bbc912d00420a14ba1aafede6b",
    CurrentComponentState="expired",
    KitName="Objects",
    OutputWrappers="https://app.speckle.systems\te7de1a2f8f\t405e10e597",
    UseDefaultCache=True,
    selectedKitName="Objects")
send_24 = Send(
    Stream=bang.Branch20,
    Data=bang_2.Branch20,
    AutoSend=False,
    BaseId="c50ea2d20eb791bece2349a18b4909fe",
    CurrentComponentState="expired",
    KitName="Objects",
    OutputWrappers="https://app.speckle.systems\te7de1a2f8f\t7d9e5c3ba3",
    UseDefaultCache=True,
    selectedKitName="Objects")
send_25 = Send(
    Stream=bang.Branch23,
    Data=bang_2.Branch23,
    AutoSend=False,
    BaseId="dc78a17bf1ebcc9839f7db1b8116030f",
    CurrentComponentState="expired",
    KitName="Objects",
    OutputWrappers="https://app.speckle.systems\te7de1a2f8f\ta69897b4e1",
    UseDefaultCache=True,
    selectedKitName="Objects")

join_2 = TextJoin(Text=merge_4, Join="/")
so = SpeckleObject(csokv)
txt = Text(join_2)
panel_7 = Panel(cluster)

# ==== cluster Cluster
paths = ClusterInput()
paths_2 = FilePath(paths)
import = ImportContent(FilePath=paths_2, Import=Toggle(True))  # -> ModelTransform, Objects, Layers, Linetypes, HatchPatterns, AnnotationStyles, Materials, BlockDefinitions
object = ModelObject(Object=import.Objects)  # -> Object, Geometry, Name, Layer, Visibility, Display, Drafting, Render
layer = ModelLayer(Layer=object.Layer)  # -> Layer, Name, Hidden, Locked, DisplayColour, Material, Linetype
csokv = CreateSpeckleObjectByKeyValue(Keys=layer.Name, Values=object.Geometry, selectedKitName="Objects")
so = SpeckleObject(csokv)
so_2 = ClusterOutput(so)
