# Grasshopper definition nakagin-capsule-tower.gh (Grasshopper 1.0.7)
# plug-ins: semio

curdir = CurrentDirectory()  # -> D, P, S
# ---------- curdir: Python ----------
#Component Information
#--------------------------------------------------------------------------------------------
if ghenv.Component.RunCount<2:
    #General
    #--------------------------------------------------------------------------------------------
    __author__ = "Ueli Saluz"
    __version__ = "2023.09.29"
    
    ghenv.Component.Name = "CurrentDirectory"
    ghenv.Component.NickName = "CurDir"
    ghenv.Component.Description = "Current directory of the current grasshopper file."
    ghenv.Component.Message = "VER 1.0"
    ghenv.Component.Category = "Params"
    ghenv.Component.SubCategory = "Util"
    
    #Outputs
    #--------------------------------------------------------------------------------------------
    outputIndex=0
    
    ghenv.Component.Params.Output[outputIndex].Name = "Directory"
    ghenv.Component.Params.Output[outputIndex].NickName = "D"
    ghenv.Component.Params.Output[outputIndex].Description = "Directory of the current grasshopper file."
    outputIndex+=1
    
    ghenv.Component.Params.Output[outputIndex].Name = "Path"
    ghenv.Component.Params.Output[outputIndex].NickName = "P"
    ghenv.Component.Params.Output[outputIndex].Description = "Path of the current grasshopper file."
    outputIndex+=1
    
    ghenv.Component.Params.Output[outputIndex].Name = "Separator"
    ghenv.Component.Params.Output[outputIndex].NickName = "S"
    ghenv.Component.Params.Output[outputIndex].Description = "Separator of the current system."
    outputIndex+=1

#Imports
#--------------------------------------------------------------------------------------------
from os.path import dirname
from os import sep

#Solver - Run with trees to enhance performance drastically
#--------------------------------------------------------------------------------------------
if __name__ == "__main__":
    P = ghenv.Component.OnPingDocument().FilePath
    D = dirname(P)
    S = sep
# ---------- end curdir ----------

remove_formations = BooleanToggle(False)
remove_types = BooleanToggle(False)
read_kit = BooleanToggle(True)
kit = CreateKit(
    Name="Metabolism",
    Explanation="Everything for metabolistic architecture.",
    Url="https://github.com/usalu/semio/examples/metabolism",
    Run=Toggle(False))
kit_2 = DeleteKit(Run=Toggle(False))
panel = Panel("Cylindric Shaft")
panel_2 = Panel("Cylindric Capital")
panel_3 = Panel("Capsule")
panel_4 = Panel("Base")
panel_5 = Panel("Capital")
kit_3 = LoadKit(Run=read_kit)  # -> Name, Description, Icon, Url, Types, Formations
panel_6 = Panel("Shaft")
typ = ModelType(Type=kit_3.Types)  # -> Type, Name, Description, Icon, Variant, Unit, Representations, Ports, Qualities
panel_7 = Panel(typ.Type)
for = ModelFormation(Formation=kit_3.Formations)  # -> Formation, Name, Description, Icon, Variant, Unit, Pieces, Attractions, Qualities
for_2 = RemoveFormation(FormationName=for.Name, FormationVariant=for.Variant, Run=remove_formations)
tmatch = MatchText(Text=typ.Name, Pattern="*", Case=True)
trim = TrimTree(Tree=kit_3.Types, Depth=1)
cull = CullPattern(List=kit_3.Types, CullPattern=tmatch)
typ_2 = ModelType(Type=cull)  # -> Type, Name, Description, Icon, Variant, Unit, Representations, Ports, Qualities
panel_8 = Panel(typ_2.Type)
typ_3 = RemoveType(TypeName=typ_2.Name, TypeVariant=typ_2.Variant, Run=remove_types)

panel_9 = Panel("The second tower (eleven storey) of the Nakagin Capule Tower.")
genes = GenePool(Decimals=0, Maximum=10, Minimum=0, Value=[3, 6, 9])

energy_global_warming_potential_kgco2e_k = ValueList({"Natural Gas": 0.201, "Heating Oil": 0.216, "Electricity Non-Renewable": 0.5, "Electricity Renewable": 0}, selected="Natural Gas")  # "Energy Global Warming Potential [kgCO2e/kWh]"
energy_global_warming_potential_kgco2e_k_2 = ValueList({"Natural Gas": 0.201, "Heating Oil": 0.216, "Electricity Non-Renewable": 0.5, "Electricity Renewable": 0}, selected="Electricity Non-Renewable")  # "Energy Global Warming Potential [kgCO2e/kWh]"
energy_price_kwh = ValueList({"Natural Gas": 0.095, "Heating Oil": 0.10, "Electricity Non-Renewable": 0.25, "Electrictiy Renewable": 0.35}, selected="Natural Gas")
energy_price_kwh_2 = ValueList({"Natural Gas": 0.095, "Heating Oil": 0.10, "Electricity Non-Renewable": 0.25, "Electrictiy Renewable": 0.35}, selected="Electricity Non-Renewable")
list = ValueList({"Full": 0, "First Tower": 1, "Second Tower": 2}, selected="Full")
futuristic = BooleanToggle(False)
list_2 = ValueList({"1to500", "1to200"}, selected="1to200")
run = BooleanToggle(True)

heating_energy_price_kwh = Number(energy_price_kwh)
heating_efficiency_factor = Number(Slider(0.9, range=0.5..4))
heating_global_warming_potential_kgco2e = Number(energy_global_warming_potential_kgco2e_k)  # "Heating Global Warming Potential [kgCO2e/kWh]"
cooling_energy_price_kwh = Number(energy_price_kwh_2)
cooling_efficiency_factor = Number(Slider(0.9, range=0.5..4))
cooling_global_warming_potential_kgco2e = Number(energy_global_warming_potential_kgco2e_k_2)  # "Cooling Global Warming Potential [kgCO2e/kWh]"
electrictiy_energy_price_cent_kwh = Number(energy_price_kwh_2)
electrictiy_global_warming_potential_kgc = Number(energy_global_warming_potential_kgco2e_k_2)  # "Electrictiy Global Warming Potential [kgCO2e/kWh]"

# ---- group: No impact on design. Only on drawing of diagram.
diagram_piece_diameter = Panel("40")
expression = Expression(x=diagram_piece_diameter, Expression="x/2")
addition = Addition(A=diagram_piece_diameter, B=Slider(10, range=0..10))
multiplication = Multiplication(A=diagram_piece_diameter, B=Slider(2, range=0..10))
neg = Negative(Value=multiplication)
neg_2 = Negative(Value=addition)
neg_3 = Negative(Value=addition)
model_screen_point = ModelScreenPoint(X=addition, Y=neg)  # -> ScreenPoint, X, Y
addition_2 = Addition(A=model_screen_point.Y, B=neg)
addition_3 = Addition(A=model_screen_point.Y, B=neg)
model_screen_point_2 = ModelScreenPoint(X=model_screen_point.X, Y=addition_2)  # -> ScreenPoint, X, Y
addition_4 = Addition(A=model_screen_point_2.X, B=multiplication)
series = Series(Start=addition_4, Step=addition, Count="8")
trim_2 = TrimTree(Tree=series, Depth=1)
model_screen_point_3 = ModelScreenPoint(X=neg_2, Y=neg)  # -> ScreenPoint, X, Y
model_screen_point_4 = ModelScreenPoint(X=model_screen_point_3.X, Y=addition_3)  # -> ScreenPoint, X, Y
subtraction = Subtraction(A=model_screen_point_4.X, B=multiplication)
series_2 = Series(Start=subtraction, Step=neg_2, Count="8")
trim_3 = TrimTree(Tree=series_2, Depth=1)

# ----
concat = Concatenate(FragmentD="b", FragmentC="_", FragmentA="s", FragmentB="2")
concat_2 = Concatenate(FragmentD=concat, FragmentC="_", FragmentA="c")
concat_3 = Concatenate(FragmentD="b", FragmentC="_", FragmentA="s", FragmentB="1")
concat_4 = Concatenate(FragmentD=concat_3, FragmentC="_", FragmentA="c")
pce = ModelPiece(Id="b", TypeName="Base")  # -> Piece, Id, TypeName, TypeVariant, RootPlane, DiagramScreenPoint
pce_2 = ModelPiece(Id=concat_3, TypeName="Shaft", TypeVariant="1", DiagramScreenPoint=model_screen_point.ScreenPoint)  # -> Piece, Id, TypeName, TypeVariant, RootPlane, DiagramScreenPoint
pce_3 = ModelPiece(Id=concat, TypeName="Shaft", TypeVariant="2", DiagramScreenPoint=model_screen_point_3.ScreenPoint)  # -> Piece, Id, TypeName, TypeVariant, RootPlane, DiagramScreenPoint
pce_4 = ModelPiece(Id=concat_2, TypeName="Capital", DiagramScreenPoint=model_screen_point_4.ScreenPoint)  # -> Piece, Id, TypeName, TypeVariant, RootPlane, DiagramScreenPoint
pce_5 = ModelPiece(Id=concat_4, TypeName="Capital", DiagramScreenPoint=model_screen_point_2.ScreenPoint)  # -> Piece, Id, TypeName, TypeVariant, RootPlane, DiagramScreenPoint
core = Panel("c")
concat_5 = Concatenate(FragmentA=core, FragmentB="-", FragmentC="0")
concat_6 = Concatenate(FragmentA=core, FragmentB="-", FragmentC="1")
bottom = Panel("b")
top = Panel("t")
sde = ModelSide(PieceId=pce.Id, PieceTypePortId=concat_6)  # -> Side, PieceId, PieceTypePortId
sde_2 = ModelSide(PieceId=pce_3.Id, PieceTypePortId=bottom)  # -> Side, PieceId, PieceTypePortId
sde_3 = ModelSide(PieceId=pce.Id, PieceTypePortId=concat_5)  # -> Side, PieceId, PieceTypePortId
sde_4 = ModelSide(PieceId=pce_2.Id, PieceTypePortId=bottom)  # -> Side, PieceId, PieceTypePortId
sde_5 = ModelSide(PieceId=pce_5.Id)  # -> Side, PieceId, PieceTypePortId
sde_6 = ModelSide(PieceId=pce_3.Id, PieceTypePortId=top)  # -> Side, PieceId, PieceTypePortId
sde_7 = ModelSide(PieceId=pce_2.Id, PieceTypePortId=top)  # -> Side, PieceId, PieceTypePortId
sde_8 = ModelSide(PieceId=pce_4.Id)  # -> Side, PieceId, PieceTypePortId
atr = ModelAttraction(AttractingSide=sde_6.Side, AttractedSide=sde_8.Side)  # -> Attraction, AttractingSide, AttractedSide
atr_2 = ModelAttraction(AttractingSide=sde.Side, AttractedSide=sde_2.Side)  # -> Attraction, AttractingSide, AttractedSide
atr_3 = ModelAttraction(AttractingSide=sde_3.Side, AttractedSide=sde_4.Side)  # -> Attraction, AttractingSide, AttractedSide
atr_4 = ModelAttraction(AttractingSide=sde_7.Side, AttractedSide=sde_5.Side)  # -> Attraction, AttractingSide, AttractedSide

merge = Merge(Data1=pce.Piece, Data2=pce_3.Piece, Data3=pce_2.Piece, Data4=pce_4.Piece, Data5=pce_5.Piece)
merge_2 = Merge(Data1=atr_2.Attraction, Data2=atr_3.Attraction, Data3=atr_4.Attraction, Data4=atr.Attraction)

genes_2 = GenePool(Decimals=0, Maximum=8, Minimum=0, Value=[0, 0, 0, 0, 0, 0, 0, 0, 0])
genes_3 = GenePool(Decimals=0, Maximum=8, Minimum=0, Value=[6, 6, 6, 6, 6, 6, 6, 6, 6])
genes_4 = GenePool(Decimals=0, Maximum=8, Minimum=0, Value=[6, 0, 0, 6, 6, 3, 3, 6, 0])
genes_5 = GenePool(Decimals=0, Maximum=8, Minimum=0, Value=[0, 1, 2, 3, 4, 5, 6, 7, 8])

# ---- group: No impact on design. Only on drawing of diagram. (continued)
expression_2 = Expression(x="9", Expression="x/2")
multiplication_2 = Multiplication(A=expression_2, B=neg_2)
addition_5 = Addition(A=model_screen_point_3.Y, B=multiplication_2, C=expression)
model_screen_point_5 = ModelScreenPoint(X=trim_2, Y=addition_5)  # -> ScreenPoint, X, Y

# ----
tower = Tower(
    number_of_floors="9",
    shaftpieceid=pce_2.Id,
    capsulepatternnortheast=genes_2,
    capsulepatternsoutheast=genes_3,
    capsulepatternsouthwest=genes_4,
    capsulepatternnorthwest=genes_5,
    diagramstarts=model_screen_point_5.ScreenPoint,
    diagramverticaldirection=addition)  # -> pc_2, at_2

merge_3 = Merge(Data1=atr_4.Attraction, Data2=tower.at_2)
merge_4 = Merge(Data1=pce_2.Piece, Data2=pce_5.Piece, Data3=tower.pc_2)
for_3 = ModelFormation(
    Name="Capsule Tower",
    Description="The first tower (nine storey) of the Nakagin Capule Tower.",
    Icon="9",
    Variant="1",
    Pieces=merge_4,
    Attractions=merge_3)  # -> Formation, Name, Description, Icon, Variant, Unit, Pieces, Attractions, Qualities

genes_6 = GenePool(Decimals=0, Maximum=8, Minimum=0, Value=[0, 0, 0, 0, 0, 0, 0, 0, 0, 0, 0])
genes_7 = GenePool(Decimals=0, Maximum=8, Minimum=0, Value=[6, 0, 0, 0, 6, 6, 0, 6, 0, 6, 3])
genes_8 = GenePool(Decimals=0, Maximum=8, Minimum=0, Value=[6, 6, 6, 6, 6, 6, 6, 6, 6, 6, 6])
genes_9 = GenePool(Decimals=0, Maximum=8, Minimum=0, Value=[8, 8, 8, 8, 8, 8, 8, 8, 8, 8, 8])

# ---- group: No impact on design. Only on drawing of diagram. (continued)
expression_3 = Expression(x="11", Expression="x/2")
multiplication_3 = Multiplication(A=expression_3, B=neg_2)
addition_6 = Addition(A=model_screen_point.Y, B=multiplication_3, C=expression)
model_screen_point_6 = ModelScreenPoint(X=trim_3, Y=addition_6)  # -> ScreenPoint, X, Y

# ----
tower_2 = Tower(
    number_of_floors="11",
    shaftpieceid=pce_3.Id,
    capsulepatternnortheast=genes_6,
    capsulepatternsoutheast=genes_8,
    capsulepatternsouthwest=genes_9,
    capsulepatternnorthwest=genes_7,
    diagramstarts=model_screen_point_6.ScreenPoint,
    diagramverticaldirection=addition)  # -> pc_2, at_2

merge_5 = Merge(Data1=tower_2.pc_2, Data2=tower.pc_2)
merge_6 = Merge(Data1=tower_2.at_2, Data2=tower.at_2)
merge_7 = Merge(Data1=atr.Attraction, Data2=tower_2.at_2)
merge_8 = Merge(Data1=pce_3.Piece, Data2=pce_4.Piece, Data3=tower_2.pc_2)
merge_9 = Merge(Data1=merge, Data2=merge_5)
merge_10 = Merge(Data1=merge_2, Data2=merge_6)
for_4 = ModelFormation(Name="Capsule Tower", Description=panel_9, Icon="11", Variant="2", Pieces=merge_8, Attractions=merge_7)  # -> Formation, Name, Description, Icon, Variant, Unit, Pieces, Attractions, Qualities
for_5 = ModelFormation(
    Name="Nakagin Capsule Tower",
    Description="The former Nakagin Capsule Tower from Tokyio.",
    Pieces=merge_9,
    Attractions=merge_10)  # -> Formation, Name, Description, Icon, Variant, Unit, Pieces, Attractions, Qualities
add_bridges = AddBridges(fo=for_5.Formation, levels=genes)
filter = StreamFilter(Gate=list, Stream0=add_bridges, Stream1=for_3.Formation, Stream2=for_4.Formation)

replacetypeinformation = ReplaceTypeInFormation(fo=filter, old_type_name="Capsule", new_type_name="Ellipsoid Capsule")
replacetypeinformation_2 = ReplaceTypeInFormation(fo=replacetypeinformation, old_type_name="Shaft", new_type_name="Cylindric Shaft")
panel_10 = Panel("A futuristic version of the former Nakagin Capsule Tower from Tokyio.")
replacetypeinformation_3 = ReplaceTypeInFormation(fo=replacetypeinformation_2, old_type_name="Capital", new_type_name="Cylindric Capital")
for_6 = ModelFormation(Formation=replacetypeinformation_3, Description=panel_10, Variant="Futuristic")  # -> Formation, Name, Description, Icon, Variant, Unit, Pieces, Attractions, Qualities
filter_2 = StreamFilter(Gate=futuristic, Stream0=filter, Stream1=for_6.Formation)

for_7 = ModelFormation(Formation=filter_2)  # -> Formation, Name, Description, Icon, Variant, Unit, Pieces, Attractions, Qualities
for_8 = RemoveFormation(FormationName=for_7.Name, FormationVariant=for_7.Variant, Run=run)
or = GateOr(A=run, B=for_8)
for_9 = AddFormation(Formation=for_7.Formation, Run=or)
scn = GetScene(FormationName=for_7.Name, FormationVariant=for_7.Variant, Run=for_9)
scn_2 = FilterScene(Scene=scn, LevelOfDetails=list_2, Tags="volume", Formats=".3dm")  # -> Representations, Planes, PiecesIds, ParentsPiecesIds
trim_4 = TrimTree(Tree=scn_2.Representations, Depth=1)
trim_5 = TrimTree(Tree=scn_2.Planes, Depth=1)
load_geometry = LoadGeometry(rp=trim_4, pln=trim_5, di=curdir.D, sep=curdir.S)

performance_assessment = PerformanceAssessment(
    fo=filter_2,
    ty=trim,
    heating_energy_price_cent_kwh=heating_energy_price_kwh,
    heating_efficiency_factor=heating_efficiency_factor,
    heating_global_warming_potential_kgco2e=heating_global_warming_potential_kgco2e,
    cooling_energy_price_cent_kwh=cooling_energy_price_kwh,
    cooling_efficiency_factor=cooling_efficiency_factor,
    cooling_global_warming_potential_kgco2e=cooling_global_warming_potential_kgco2e,
    electrictiy_energy_price_cent_kwh=electrictiy_energy_price_cent_kwh,
    electrictiy_global_warming_potential_kgc=electrictiy_global_warming_potential_kgc)  # -> effective_floor_area_m²_2, specific_operational_global_warming_pote_2, construction_cost_2, return_a_2, construction_global_warming_potential_kg_2, operational_cost_a_2, operational_global_warming_potential_kgc_2, income_2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
expression_4 = Expression(x=performance_assessment.construction_cost_2, Expression="x/1000000")
expression_5 = Expression(x=performance_assessment.operational_cost_a_2, Expression="x/1000000")
expression_6 = Expression(x=performance_assessment.maintenance_expenses_a_2, Expression="x/1000000")
expression_7 = Expression(x=performance_assessment.income_2, Expression="x/1000000")
expression_8 = Expression(x=performance_assessment.return_a_2, Expression="x/1000000")
expression_9 = Expression(x=performance_assessment.operational_energy_cost_a_2, Expression="x/1000000")
expression_10 = Expression(x=performance_assessment.construction_global_warming_potential_kg_2, Expression="x/1000")
expression_11 = Expression(x=performance_assessment.operational_global_warming_potential_kgc_2, Expression="x/1000")
expression_12 = Expression(x=performance_assessment.heating_energy_demand_kwh_a_2, Expression="x/1000")
expression_13 = Expression(x=performance_assessment.cooling_energy_demand_kwh_a_2, Expression="x/1000")
expression_14 = Expression(x=performance_assessment.technical_equipment_energy_demand_kwh_a_2, Expression="x/1000")
roundmult = RoundToMultiple(N=expression_7, M="0.05")  # -> R; inputs N: tree, M: tree
# ---------- roundmult: Python ----------
#Component Information
#--------------------------------------------------------------------------------------------
if ghenv.Component.RunCount<2:
    #General
    #--------------------------------------------------------------------------------------------
    __author__ = "YOUR NAME"
    __version__ = "2000.00.00"
    
    ghenv.Component.Name = "Round to Multiple"
    ghenv.Component.NickName = "RoundMult"
    ghenv.Component.Description = "Rounds a number to the nearest specified multiple."
    ghenv.Component.Message = "VER 1.0"
    ghenv.Component.Category = "Math"
    ghenv.Component.SubCategory = "Arithmetic"
    
     #Inputs
    #--------------------------------------------------------------------------------------------
    inputIndex=0
    
    ghenv.Component.Params.Input[inputIndex].Name = "Number"
    ghenv.Component.Params.Input[inputIndex].NickName = "N"
    ghenv.Component.Params.Input[inputIndex].Description = "Number to round."
    ghenv.Component.Params.Input[inputIndex].Optional = False
    inputIndex+=1
    
    ghenv.Component.Params.Input[inputIndex].Name = "Multiple"
    ghenv.Component.Params.Input[inputIndex].NickName = "M"
    ghenv.Component.Params.Input[inputIndex].Description = "Multiple to round to."
    ghenv.Component.Params.Input[inputIndex].Optional = False
    inputIndex+=1
    
    #Outputs
    #--------------------------------------------------------------------------------------------
    outputIndex=0
    
    ghenv.Component.Params.Output[outputIndex].Name = "Rounded"
    ghenv.Component.Params.Output[outputIndex].NickName = "R"
    ghenv.Component.Params.Output[outputIndex].Description = "Number rounded to the nearest specified multiple."
    outputIndex+=1


#Imports
#--------------------------------------------------------------------------------------------
from System import Object
from Grasshopper import DataTree
import math


#The Component function - Business logic only (e.g. working without trees)
#--------------------------------------------------------------------------------------------
"""Function that this component is computing.
    Inputs:
        number: The number to round.
        multiple: The multiple to round to.
    Output:
        rounded: The number rounded to the nearest specified multiple."""
def RoundToMultiple(number, multiple):
    rounded = math.ceil(number / multiple) * multiple
    return rounded

#Solver - Run with trees to enhance performance drastically
#--------------------------------------------------------------------------------------------
if __name__ == "__main__":
    
    #Initialize trees
    #--------------------------------------------------------------------------------------------
    RoundedTree = DataTree[Object]()
    
    #Data matching
    #--------------------------------------------------------------------------------------------
    for path in N.Paths:
        numberBranch = N.Branch(path)
        for i, number in enumerate(numberBranch):
            multiple = M.Branch(path)[i]
            rounded = RoundToMultiple(number, multiple)
            RoundedTree.Add(rounded, path)
    
     #Assign trees to output
    #--------------------------------------------------------------------------------------------
    R = RoundedTree
# ---------- end roundmult ----------
roundmult_2 = RoundToMultiple(N=expression_6, M="0.05")  # -> R; inputs N: tree, M: tree; same code as roundmult
roundmult_3 = RoundToMultiple(N=performance_assessment.specific_energy_demand_kwh_m²a_2, M="2.5")  # -> R; inputs N: tree, M: tree; same code as roundmult
roundmult_4 = RoundToMultiple(N=expression_9, M="0.05")  # -> R; inputs N: tree, M: tree; same code as roundmult
roundmult_5 = RoundToMultiple(N=expression_12, M=1)  # -> R; inputs N: tree, M: tree; same code as roundmult
roundmult_6 = RoundToMultiple(N=expression_13, M=1)  # -> R; inputs N: tree, M: tree; same code as roundmult
roundmult_7 = RoundToMultiple(N=expression_14, M=1)  # -> R; inputs N: tree, M: tree; same code as roundmult
roundmult_8 = RoundToMultiple(N=performance_assessment.effective_floor_area_m²_2, M="25")  # -> R; inputs N: tree, M: tree; same code as roundmult
roundmult_9 = RoundToMultiple(N=performance_assessment.specific_operational_global_warming_pote_2, M=1)  # -> R; inputs N: tree, M: tree; same code as roundmult
roundmult_10 = RoundToMultiple(N=expression_4, M="0.05")  # -> R; inputs N: tree, M: tree; same code as roundmult
roundmult_11 = RoundToMultiple(N=expression_8, M="0.05")  # -> R; inputs N: tree, M: tree; same code as roundmult
roundmult_12 = RoundToMultiple(N=expression_10, M="25")  # -> R; inputs N: tree, M: tree; same code as roundmult
roundmult_13 = RoundToMultiple(N=expression_5, M="0.05")  # -> R; inputs N: tree, M: tree; same code as roundmult
roundmult_14 = RoundToMultiple(N=expression_11, M="5")  # -> R; inputs N: tree, M: tree; same code as roundmult
previewplane = PreviewPlane(plane=trim_5, axis_length=Slider(2, range=0..10))
semio_preview = SemioPreview(geo=load_geometry)
effective_floor_area_m² = Number(roundmult_8)
specific_operational_global_warming_pote = Number(roundmult_9)  # "Specific Operational Global Warming Potential [kgCO2e/m²a]"
construction_cost_mio = Number(roundmult_10)
return_a = Number(roundmult_11)
construction_global_warming_potential_tc = Number(roundmult_12)  # "Construction Global Warming Potential [tCO2e]"
operational_cost_mio_a = Number(roundmult_13)
operational_global_warming_potential_tco = Number(roundmult_14)  # "Operational Global Warming Potential [tCO2e/a]"
income_mio_a = Number(roundmult)
maintenance_expenses_mio_a = Number(roundmult_2)
specific_energy_demand_kwh_m²a = Number(roundmult_3)
operational_energy_cost_a = Number(roundmult_4)
heating_energy_demand_mwh_a = Number(roundmult_5)
cooling_energy_demand_mwh_a = Number(roundmult_6)
technical_equipment_energy_demand_mwh_a = Number(roundmult_7)

effective_floor_area_m²_2 = Panel(effective_floor_area_m²)
construction_cost_mio_2 = Panel(construction_cost_mio)
return_a_2 = Panel(return_a)
income_mio_a_2 = Panel(income_mio_a)
operational_cost_mio_a_2 = Panel(operational_cost_mio_a)
operational_energy_cost_a_2 = Panel(operational_energy_cost_a)
maintenance_expenses_mio_a_2 = Panel(maintenance_expenses_mio_a)
operational_global_warming_potential_tco_2 = Panel(operational_global_warming_potential_tco)  # "Operational Global Warming Potential [tCO2e/a]"
heating_energy_demand_mwh_a_2 = Panel(heating_energy_demand_mwh_a)
cooling_energy_demand_mwh_a_2 = Panel(cooling_energy_demand_mwh_a)
technical_equipment_energy_demand_mwh_a_2 = Panel(technical_equipment_energy_demand_mwh_a)
specific_operational_global_warming_pote_2 = Panel(specific_operational_global_warming_pote)  # "Specific Operational Global Warming Potential [kgCO2e/m²a]"
construction_global_warming_potential_tc_2 = Panel(construction_global_warming_potential_tc)  # "Construction Global Warming Potential [tCO2e]"
specific_energy_demand_kwh_m²a_2 = Panel(specific_energy_demand_kwh_m²a)

# ==== cluster PreviewPlane: Preview a plane with axis colors and naming.
axis_length = ClusterInput()
plane = ClusterInput()
axis_length_2 = Number(axis_length)
plane_2 = Plane(plane)
deplane = DeconstructPlane(Plane=plane_2)  # -> Origin, XAxis, YAxis, ZAxis
line = LineSDL(Start=deplane.Origin, Direction=deplane.YAxis, Length=axis_length_2)
line_2 = LineSDL(Start=deplane.Origin, Direction=deplane.XAxis, Length=axis_length_2)
line_3 = LineSDL(Start=deplane.Origin, Direction=deplane.ZAxis, Length=axis_length_2)
swatch = ColourSwatch(SwatchColor=RGB(235, 52, 79))
swatch_2 = ColourSwatch(SwatchColor=RGB(0, 166, 157))
swatch_3 = ColourSwatch(SwatchColor=RGB(240, 117, 24))
end = EndPoints(Curve=line_2)  # -> Start, End
end_2 = EndPoints(Curve=line)  # -> Start, End
end_3 = EndPoints(Curve=line_3)  # -> Start, End
tag = TextTag(Location=end.End, Text="X", Colour=swatch)
tag_2 = TextTag(Location=end_2.End, Text="Y", Colour=swatch_2)
tag_3 = TextTag(Location=end_3.End, Text="Z", Colour=swatch_3)
preview = CustomPreview(Geometry=line_2, Material=swatch)
preview_2 = CustomPreview(Geometry=line, Material=swatch_2)
preview_3 = CustomPreview(Geometry=line_3, Material=swatch_3)

# ==== cluster Tower
diagramverticaldirection = ClusterInput()
number_of_floors = ClusterInput()
shaftpieceid = ClusterInput()
capsulepatternnortheast = ClusterInput()
capsulepatternsoutheast = ClusterInput()
capsulepatternsouthwest = ClusterInput()
capsulepatternnorthwest = ClusterInput()
diagramstarts = ClusterInput()
diagramverticaldirection_2 = Integer(diagramverticaldirection)
capsulepatternnorthwest_2 = Integer(capsulepatternnorthwest)
capsulepatternsoutheast_2 = Integer(capsulepatternsoutheast)
number_of_floors_2 = Integer(number_of_floors)
shaftpieceid_2 = Text(shaftpieceid)
capsulepatternsouthwest_2 = Integer(capsulepatternsouthwest)
diagramstarts_2 = ScreenPoint(diagramstarts)
item = ListItem(List=diagramstarts_2, Index=0, Wrap=True)  # -> Item, Item1, Item2, Item3, Item4, Item5, Item6, Item7
model_screen_point = ModelScreenPoint(ScreenPoint=item.Item)  # -> ScreenPoint, X, Y
model_screen_point_2 = ModelScreenPoint(ScreenPoint=item.Item2)  # -> ScreenPoint, X, Y
model_screen_point_3 = ModelScreenPoint(ScreenPoint=item.Item4)  # -> ScreenPoint, X, Y
model_screen_point_4 = ModelScreenPoint(ScreenPoint=item.Item1)  # -> ScreenPoint, X, Y
model_screen_point_5 = ModelScreenPoint(ScreenPoint=item.Item6)  # -> ScreenPoint, X, Y
model_screen_point_6 = ModelScreenPoint(ScreenPoint=item.Item3)  # -> ScreenPoint, X, Y
model_screen_point_7 = ModelScreenPoint(ScreenPoint=item.Item5)  # -> ScreenPoint, X, Y
model_screen_point_8 = ModelScreenPoint(ScreenPoint=item.Item7)  # -> ScreenPoint, X, Y
series = Series(Start=model_screen_point.Y, Step=diagramverticaldirection_2, Count=number_of_floors_2)
series_2 = Series(Start=model_screen_point_2.Y, Step=diagramverticaldirection_2, Count=number_of_floors_2)
series_3 = Series(Start=model_screen_point_3.Y, Step=diagramverticaldirection_2, Count=number_of_floors_2)
series_4 = Series(Start=model_screen_point_4.Y, Step=diagramverticaldirection_2, Count=number_of_floors_2)
series_5 = Series(Start=model_screen_point_5.Y, Step=diagramverticaldirection_2, Count=number_of_floors_2)
series_6 = Series(Start=model_screen_point_6.Y, Step=diagramverticaldirection_2, Count=number_of_floors_2)
series_7 = Series(Start=model_screen_point_7.Y, Step=diagramverticaldirection_2, Count=number_of_floors_2)
series_8 = Series(Start=model_screen_point_8.Y, Step=diagramverticaldirection_2, Count=number_of_floors_2)
trim = TrimTree(Tree=series, Depth=1)
trim_2 = TrimTree(Tree=series_2, Depth=1)
trim_3 = TrimTree(Tree=series_3, Depth=1)
trim_4 = TrimTree(Tree=series_4, Depth=1)
trim_5 = TrimTree(Tree=series_5, Depth=1)
trim_6 = TrimTree(Tree=series_6, Depth=1)
trim_7 = TrimTree(Tree=series_7, Depth=1)
trim_8 = TrimTree(Tree=series_8, Depth=1)
model_screen_point_9 = ModelScreenPoint(ScreenPoint=model_screen_point.ScreenPoint, Y=trim)  # -> graft(ScreenPoint), X, Y
model_screen_point_10 = ModelScreenPoint(ScreenPoint=model_screen_point_2.ScreenPoint, Y=trim_2)  # -> graft(ScreenPoint), X, Y
model_screen_point_11 = ModelScreenPoint(ScreenPoint=model_screen_point_3.ScreenPoint, Y=trim_3)  # -> graft(ScreenPoint), X, Y
model_screen_point_12 = ModelScreenPoint(ScreenPoint=model_screen_point_4.ScreenPoint, Y=trim_4)  # -> graft(ScreenPoint), X, Y
model_screen_point_13 = ModelScreenPoint(ScreenPoint=model_screen_point_5.ScreenPoint, Y=trim_5)  # -> graft(ScreenPoint), X, Y
model_screen_point_14 = ModelScreenPoint(ScreenPoint=model_screen_point_6.ScreenPoint, Y=trim_6)  # -> graft(ScreenPoint), X, Y
model_screen_point_15 = ModelScreenPoint(ScreenPoint=model_screen_point_7.ScreenPoint, Y=trim_7)  # -> graft(ScreenPoint), X, Y
model_screen_point_16 = ModelScreenPoint(ScreenPoint=model_screen_point_8.ScreenPoint, Y=trim_8)  # -> graft(ScreenPoint), X, Y
capsulepatternnortheast_2 = Integer(capsulepatternnortheast)
panel = Panel("""0
0
1
0
1
0
2
3
3""")
merge = Merge(Data1="1", Data2="3", Data3="5", Data4="7")
merge_2 = Merge(Data1="2", Data2="4", Data3="6", Data4="8")
panel_2 = Panel("""2
3
3
0
0
1
0
0
1""")

item_2 = ListItem(List=panel_2, Index=capsulepatternnortheast_2, Wrap=True)
capsuletypeeastleft = Integer(item_2)

item_3 = ListItem(List=panel, Index=capsulepatternnortheast_2, Wrap=True)
capsuletypenorthright = Integer(item_3)

item_4 = ListItem(List=panel, Index=capsulepatternsouthwest_2, Wrap=True)
capsuletypewestleft = Integer(item_4)
item_5 = ListItem(List=merge, Index=capsuletypewestleft, Wrap=True)  # -> graft(Item)

series_9 = Series(Start=0, Step=1, Count=number_of_floors_2)
trim_9 = TrimTree(Tree=series_9, Depth=1)  # -> graft(Tree)
door = Panel("d")
split_level = Panel("sl")
floor = Panel("f")
concat = Concatenate(FragmentA=floor, FragmentC="-", FragmentB=trim_9)

expression = Expression(x="2", y=trim_9, Expression="x")
concat_2 = Concatenate(FragmentA=door, FragmentC="-", FragmentB=expression)

item_6 = ListItem(List=panel_2, Index=capsulepatternsoutheast_2, Wrap=True)
capsuletypesouthleft = Integer(item_6)
item_7 = ListItem(List=merge, Index=capsuletypesouthleft, Wrap=True)  # -> graft(Item)

expression_2 = Expression(x="1", y=trim_9, Expression="x")
concat_3 = Concatenate(FragmentA=split_level, FragmentC="-", FragmentB=expression_2)

expression_3 = Expression(x="0", y=trim_9, Expression="x")
expression_4 = Expression(x="0", y=trim_9, Expression="x")

expression_5 = Expression(x="2", y=trim_9, Expression="x")
concat_4 = Concatenate(FragmentA=split_level, FragmentC="-", FragmentB=expression_5)

item_8 = ListItem(List=panel, Index=capsulepatternnorthwest_2, Wrap=True)
capsuletypenorthleft = Integer(item_8)
item_9 = ListItem(List=merge, Index=capsuletypenorthleft, Wrap=True)  # -> graft(Item)

item_10 = ListItem(List=merge, Index=capsuletypeeastleft, Wrap=True)  # -> graft(Item)

concat_5 = Concatenate(FragmentA=split_level, FragmentC="-", FragmentB=expression_3)
concat_6 = Concatenate(FragmentA=door, FragmentC="-", FragmentB=expression_4)
concat_7 = Concatenate(FragmentA=concat, FragmentD="#", FragmentB=concat_5, FragmentC="#", FragmentE=concat_6)
sde = ModelSide(PieceId=shaftpieceid_2, PieceTypePortId=concat_7)  # -> Side, PieceId, PieceTypePortId
concat_8 = Concatenate(FragmentA=shaftpieceid_2, FragmentB="_", FragmentD="c", FragmentE="#", FragmentC=concat_7)

pce = ModelPiece(Id=concat_8, TypeName="Capsule", TypeVariant=item_7, DiagramScreenPoint=model_screen_point_9.ScreenPoint)  # -> Piece, Id, TypeName, TypeVariant, RootPlane, DiagramScreenPoint
trim_10 = TrimTree(Tree=pce.Piece, Depth=1)
trim_11 = TrimTree(Tree=pce.Id, Depth=1)

sde_2 = ModelSide(PieceId=trim_11)  # -> Side, PieceId, PieceTypePortId

trim_12 = TrimTree(Tree=sde.Side, Depth=1)
atr = ModelAttraction(AttractingSide=trim_12, AttractedSide=sde_2.Side)  # -> Attraction, AttractingSide, AttractedSide

concat_9 = Concatenate(FragmentA=concat, FragmentD="#", FragmentB=concat_3, FragmentC="#", FragmentE=concat_6)
sde_3 = ModelSide(PieceId=shaftpieceid_2, PieceTypePortId=concat_9)  # -> Side, PieceId, PieceTypePortId
trim_13 = TrimTree(Tree=sde_3.Side, Depth=1)

concat_10 = Concatenate(FragmentA=shaftpieceid_2, FragmentB="_", FragmentD="c", FragmentE="#", FragmentC=concat_9)
pce_2 = ModelPiece(Id=concat_10, TypeName="Capsule", TypeVariant=item_9, DiagramScreenPoint=model_screen_point_11.ScreenPoint)  # -> Piece, Id, TypeName, TypeVariant, RootPlane, DiagramScreenPoint
trim_14 = TrimTree(Tree=pce_2.Id, Depth=1)
trim_15 = TrimTree(Tree=pce_2.Piece, Depth=1)

sde_4 = ModelSide(PieceId=trim_14)  # -> Side, PieceId, PieceTypePortId
atr_2 = ModelAttraction(AttractingSide=trim_13, AttractedSide=sde_4.Side)  # -> Attraction, AttractingSide, AttractedSide

concat_11 = Concatenate(FragmentA=concat, FragmentD="#", FragmentB=concat_4, FragmentC="#", FragmentE=concat_6)
sde_5 = ModelSide(PieceId=shaftpieceid_2, PieceTypePortId=concat_11)  # -> Side, PieceId, PieceTypePortId
trim_16 = TrimTree(Tree=sde_5.Side, Depth=1)

concat_12 = Concatenate(FragmentA=shaftpieceid_2, FragmentB="_", FragmentD="c", FragmentE="#", FragmentC=concat_11)
pce_3 = ModelPiece(Id=concat_12, TypeName="Capsule", TypeVariant=item_5, DiagramScreenPoint=model_screen_point_13.ScreenPoint)  # -> Piece, Id, TypeName, TypeVariant, RootPlane, DiagramScreenPoint
trim_17 = TrimTree(Tree=pce_3.Id, Depth=1)
trim_18 = TrimTree(Tree=pce_3.Piece, Depth=1)

sde_6 = ModelSide(PieceId=trim_17)  # -> Side, PieceId, PieceTypePortId
atr_3 = ModelAttraction(AttractingSide=trim_16, AttractedSide=sde_6.Side)  # -> Attraction, AttractingSide, AttractedSide

concat_13 = Concatenate(FragmentA=concat, FragmentD="#", FragmentB=concat_5, FragmentE="#", FragmentC=concat_2)
sde_7 = ModelSide(PieceId=shaftpieceid_2, PieceTypePortId=concat_13)  # -> Side, PieceId, PieceTypePortId
trim_19 = TrimTree(Tree=sde_7.Side, Depth=1)

concat_14 = Concatenate(FragmentA=shaftpieceid_2, FragmentB="_", FragmentD="c", FragmentE="#", FragmentC=concat_13)
pce_4 = ModelPiece(Id=concat_14, TypeName="Capsule", TypeVariant=item_10, DiagramScreenPoint=model_screen_point_10.ScreenPoint)  # -> Piece, Id, TypeName, TypeVariant, RootPlane, DiagramScreenPoint
trim_20 = TrimTree(Tree=pce_4.Piece, Depth=1)
trim_21 = TrimTree(Tree=pce_4.Id, Depth=1)

sde_8 = ModelSide(PieceId=trim_21)  # -> Side, PieceId, PieceTypePortId
atr_4 = ModelAttraction(AttractingSide=trim_19, AttractedSide=sde_8.Side)  # -> Attraction, AttractingSide, AttractedSide

item_11 = ListItem(List=panel_2, Index=capsulepatternnorthwest_2, Wrap=True)
capsuletypewestright = Integer(item_11)
item_12 = ListItem(List=merge_2, Index=capsuletypewestright, Wrap=True)  # -> graft(Item)

item_13 = ListItem(List=panel_2, Index=capsulepatternsouthwest_2, Wrap=True)
capsuletypesouthrigh = Integer(item_13)
item_14 = ListItem(List=merge_2, Index=capsuletypesouthrigh, Wrap=True)  # -> graft(Item)

expression_6 = Expression(x="3", y=trim_9, Expression="x")
concat_15 = Concatenate(FragmentA=door, FragmentC="-", FragmentB=expression_6)
concat_16 = Concatenate(FragmentA=concat, FragmentD="#", FragmentB=concat_5, FragmentC="#", FragmentE=concat_15)
sde_9 = ModelSide(PieceId=shaftpieceid_2, PieceTypePortId=concat_16)  # -> Side, PieceId, PieceTypePortId
trim_22 = TrimTree(Tree=sde_9.Side, Depth=1)

item_15 = ListItem(List=merge_2, Index=capsuletypenorthright, Wrap=True)  # -> graft(Item)
concat_17 = Concatenate(FragmentA=shaftpieceid_2, FragmentB="_", FragmentD="c", FragmentE="#", FragmentC=concat_16)
pce_5 = ModelPiece(Id=concat_17, TypeName="Capsule", TypeVariant=item_15, DiagramScreenPoint=model_screen_point_14.ScreenPoint)  # -> Piece, Id, TypeName, TypeVariant, RootPlane, DiagramScreenPoint
trim_23 = TrimTree(Tree=pce_5.Id, Depth=1)
trim_24 = TrimTree(Tree=pce_5.Piece, Depth=1)

sde_10 = ModelSide(PieceId=trim_23)  # -> Side, PieceId, PieceTypePortId
atr_5 = ModelAttraction(AttractingSide=trim_22, AttractedSide=sde_10.Side)  # -> Attraction, AttractingSide, AttractedSide

item_16 = ListItem(List=panel, Index=capsulepatternsoutheast_2, Wrap=True)
capsuletypeeastright = Integer(item_16)

expression_7 = Expression(x="1", y=trim_9, Expression="x")
concat_18 = Concatenate(FragmentA=door, FragmentC="-", FragmentB=expression_7)
concat_19 = Concatenate(FragmentA=concat, FragmentD="#", FragmentB=concat_5, FragmentC="#", FragmentE=concat_18)
sde_11 = ModelSide(PieceId=shaftpieceid_2, PieceTypePortId=concat_19)  # -> Side, PieceId, PieceTypePortId
trim_25 = TrimTree(Tree=sde_11.Side, Depth=1)

item_17 = ListItem(List=merge_2, Index=capsuletypeeastright, Wrap=True)  # -> graft(Item)
concat_20 = Concatenate(FragmentA=shaftpieceid_2, FragmentB="_", FragmentD="c", FragmentE="#", FragmentC=concat_19)
pce_6 = ModelPiece(Id=concat_20, TypeName="Capsule", TypeVariant=item_17, DiagramScreenPoint=model_screen_point_12.ScreenPoint)  # -> Piece, Id, TypeName, TypeVariant, RootPlane, DiagramScreenPoint
trim_26 = TrimTree(Tree=pce_6.Id, Depth=1)
trim_27 = TrimTree(Tree=pce_6.Piece, Depth=1)

sde_12 = ModelSide(PieceId=trim_26)  # -> Side, PieceId, PieceTypePortId

atr_6 = ModelAttraction(AttractingSide=trim_25, AttractedSide=sde_12.Side)  # -> Attraction, AttractingSide, AttractedSide

concat_21 = Concatenate(FragmentA=concat, FragmentD="#", FragmentB=concat_3, FragmentC="#", FragmentE=concat_18)
sde_13 = ModelSide(PieceId=shaftpieceid_2, PieceTypePortId=concat_21)  # -> Side, PieceId, PieceTypePortId
trim_28 = TrimTree(Tree=sde_13.Side, Depth=1)

concat_22 = Concatenate(FragmentA=shaftpieceid_2, FragmentB="_", FragmentD="c", FragmentE="#", FragmentC=concat_21)
pce_7 = ModelPiece(Id=concat_22, TypeName="Capsule", TypeVariant=item_12, DiagramScreenPoint=model_screen_point_15.ScreenPoint)  # -> Piece, Id, TypeName, TypeVariant, RootPlane, DiagramScreenPoint
trim_29 = TrimTree(Tree=pce_7.Id, Depth=1)
trim_30 = TrimTree(Tree=pce_7.Piece, Depth=1)

sde_14 = ModelSide(PieceId=trim_29)  # -> Side, PieceId, PieceTypePortId
atr_7 = ModelAttraction(AttractingSide=trim_28, AttractedSide=sde_14.Side)  # -> Attraction, AttractingSide, AttractedSide

concat_23 = Concatenate(FragmentA=concat, FragmentD="#", FragmentB=concat_4, FragmentC="#", FragmentE=concat_18)
sde_15 = ModelSide(PieceId=shaftpieceid_2, PieceTypePortId=concat_23)  # -> Side, PieceId, PieceTypePortId
trim_31 = TrimTree(Tree=sde_15.Side, Depth=1)

concat_24 = Concatenate(FragmentA=shaftpieceid_2, FragmentB="_", FragmentD="c", FragmentE="#", FragmentC=concat_23)
pce_8 = ModelPiece(Id=concat_24, TypeName="Capsule", TypeVariant=item_14, DiagramScreenPoint=model_screen_point_16.ScreenPoint)  # -> Piece, Id, TypeName, TypeVariant, RootPlane, DiagramScreenPoint
trim_32 = TrimTree(Tree=pce_8.Id, Depth=1)
trim_33 = TrimTree(Tree=pce_8.Piece, Depth=1)

sde_16 = ModelSide(PieceId=trim_32)  # -> Side, PieceId, PieceTypePortId
atr_8 = ModelAttraction(AttractingSide=trim_31, AttractedSide=sde_16.Side)  # -> Attraction, AttractingSide, AttractedSide

merge_3 = Merge(Data1=trim_10, Data2=trim_27, Data3=trim_20, Data4=trim_24, Data5=trim_15, Data6=trim_30, Data7=trim_18, Data8=trim_33)
merge_4 = Merge(
    Data1=atr.Attraction,
    Data2=atr_6.Attraction,
    Data3=atr_4.Attraction,
    Data4=atr_5.Attraction,
    Data5=atr_2.Attraction,
    Data6=atr_7.Attraction,
    Data7=atr_3.Attraction,
    Data8=atr_8.Attraction)
pc = Piece(merge_3)
at = Attraction(merge_4)
at_2 = ClusterOutput(at)
pc_2 = ClusterOutput(pc)

# ==== cluster ReplaceTypeInFormation
fo = ClusterInput()
old_type_name = ClusterInput()
new_type_name = ClusterInput()
fo_2 = Formation(fo)
old_type_name_2 = Text(old_type_name)
new_type_name_2 = Text(new_type_name)
for = ModelFormation(Formation=fo_2)  # -> Formation, Name, Description, Icon, Variant, Unit, Pieces, Attractions, Qualities
trim = TrimTree(Tree=for.Pieces, Depth=1)
pce = ModelPiece(Piece=trim)  # -> Piece, Id, TypeName, TypeVariant, RootPlane, DiagramScreenPoint
tmatch = MatchText(Text=pce.TypeName, Pattern=old_type_name_2, Case=True)
dispatch = Dispatch(List=pce.Piece, DispatchPattern=tmatch)  # -> ListA, ListB
pce_2 = ModelPiece(Piece=dispatch.ListA, TypeName=new_type_name_2)  # -> Piece, Id, TypeName, TypeVariant, RootPlane, DiagramScreenPoint
merge = Merge(Data1=pce_2.Piece, Data2=dispatch.ListB)
for_2 = ModelFormation(Formation=fo_2, Pieces=merge)  # -> Formation, Name, Description, Icon, Variant, Unit, Pieces, Attractions, Qualities
fo_3 = Formation(for_2.Formation)
fo_4 = ClusterOutput(fo_3)

# ==== cluster AddBridges
fo = ClusterInput()
levels = ClusterInput()
fo_2 = Formation(fo)
levels_2 = Integer(levels)
expression = Expression(x=levels_2, Expression="x-1")
concat = Concatenate(FragmentA="b_s1_c#f-", FragmentB=expression, FragmentC="#sl-0#d-2")
concat_2 = Concatenate(FragmentA="b_s2_c#f-", FragmentB=expression, FragmentC="#sl-0#d-1")
merge = Merge(Data1=concat, Data2=concat_2)
remove_pieces = Pc(fo=fo_2, ids=merge)  # -> fo_4, removed_pieces_2, removed_attractions_2
lng = ListLength(List=levels_2)
for = ModelFormation(Formation=remove_pieces.fo_4)  # -> Formation, Name, Description, Icon, Variant, Unit, Pieces, Attractions, Qualities
trim = TrimTree(Tree=for.Pieces, Depth=1)
trim_2 = TrimTree(Tree=for.Attractions, Depth=1)
split = SplitList(List=remove_pieces.removed_attractions_2, Index=lng)  # -> ListA, ListB
split_2 = SplitList(List=remove_pieces.removed_pieces_2, Index=lng)  # -> ListA, ListB
trim_3 = TrimTree(Tree=split_2.ListB, Depth=1)
trim_4 = TrimTree(Tree=split.ListB, Depth=1)
atr = ModelAttraction(Attraction=trim_4)  # -> Attraction, AttractingSide, AttractedSide
pce = ModelPiece(Piece=trim_3, TypeName="Bridge")  # -> Piece, Id, TypeName, TypeVariant, RootPlane, DiagramScreenPoint
sde = ModelSide(Side=atr.AttractedSide, PieceId=pce.Id, PieceTypePortId="e")  # -> Side, PieceId, PieceTypePortId
atr_2 = ModelAttraction(Attraction=atr.Attraction, AttractedSide=sde.Side)  # -> Attraction, AttractingSide, AttractedSide
merge_2 = Merge(Data1=trim, Data2=pce.Piece)
merge_3 = Merge(Data1=trim_2, Data2=atr_2.Attraction)
for_2 = ModelFormation(Formation=for.Formation, Pieces=merge_2, Attractions=merge_3)  # -> Formation, Name, Description, Icon, Variant, Unit, Pieces, Attractions, Qualities
fo_3 = Formation(for_2.Formation)
fo_4 = ClusterOutput(fo_3)

# ==== cluster LoadGeometry
di = ClusterInput()
sep = ClusterInput()
rp = ClusterInput()
pln = ClusterInput()

pln_2 = Plane(graft(pln))
rp_2 = Representation(rp)
di_2 = FilePath(di)
sep_2 = Text(sep)
rep = ModelRepresentation(Representation=rp_2)  # -> Representation, Url, LevelOfDetail, Tags
concat = Concatenate(FragmentA=di_2, FragmentB=sep_2, FragmentC=rep.Url)

cset = CreateSet(List=concat)  # -> Set, Map
refbake = ReferenceByBakeName(FilePath=graft(cset.Set), BakeName="*", Key="*", Val="*", lightweight=False, DisableAutoUpdate=True)
panel = Panel(pln_2)

brep = Brep(refbake)

trim = TrimTree(Tree=brep, Depth=1)
tstat = TreeStatistics(Tree=trim)  # -> Paths, Length, Count
item = ListItem(List=tstat.Paths, Index=cset.Map, Wrap=True)
branch = TreeBranch(Tree=trim, Path=item, MaintainPaths=False)
match = MatchTree(Tree=branch, Guide=pln_2)

mtchanc = MatchAncestor(AT=pln_2, CT=graft(match))  # -> MAT; inputs AT: tree, CT: tree
# ---------- mtchanc: Python ----------
if ghenv.Component.RunCount<2:
    __author__ = "Ueli Saluz"
    __version__ = "2022.04.25"
    
    ghenv.Component.Name = "Match Ancestor"
    ghenv.Component.NickName = "MtchAnc"
    ghenv.Component.Description = "Duplicates all elements of an ancestor tree to match the amount of elements in the child tree."
    ghenv.Component.Message = "VER 1.1"
    
    ghenv.Component.Params.Input[0].Name = "AncestorTree"
    ghenv.Component.Params.Input[0].NickName = "AT"
    ghenv.Component.Params.Input[0].Description = "Ancestor tree that data will the duplicated until it matches the child tree"
    ghenv.Component.Params.Input[0].Optional = False
    
    ghenv.Component.Params.Input[1].Name = "ChildTree"
    ghenv.Component.Params.Input[1].NickName = "CT"
    ghenv.Component.Params.Input[1].Description = "Child tree that branches will the guide to duplicat the data of the ancestor tree"
    ghenv.Component.Params.Input[0].Optional = False
    
    ghenv.Component.Params.Output[0].Name = "MatchedAncestorTree"
    ghenv.Component.Params.Output[0].NickName = "MAT"
    ghenv.Component.Params.Output[0].Description = "Matched ancestor tree with the amount of items and the branch paths of the child tree"

from System import Object
from Grasshopper import DataTree

"""Returns a new tree with the ancestor data being duplicated along all child branches which where child paths of that ancestor.
    Inputs:
        ancestorTree: Ancestor tree that data will the duplicated until it matches the child tree
        childTree: Child tree that branches will the guide to duplicat the data of the ancestor tree
    Output:
        matchedAncestorTree: Matched ancestor tree with the amount of items and the branch paths of the child tree"""
def MatchAncestorTreeToChildTree (ancestorTree, childTree):
    
    matchedAncestorTree = DataTree[Object]()
    dummy = 0
    for i,pathAncestor in enumerate(ancestorTree.Paths):
        branch = ancestorTree.Branch(pathAncestor)
        if len(branch)!=1:
            raise Exception("Ancestor must be grafted and containing one item per branch")
        #The item to be duplicated
        item = branch[0]
        for j,pathChild in enumerate(childTree.Paths):
            #Returns a tuple and not like in the documentation described a bool with a pointer to the int to store the generations
            checkAncestor = pathChild.IsAncestor(pathAncestor,dummy)
            if(checkAncestor[0]):
                matchedAncestorTree.AddRange([item]*childTree.Branch(pathChild).Count,pathChild)
    return matchedAncestorTree

if __name__ == "__main__":
    MAT = MatchAncestorTreeToChildTree (AT,CT)
# ---------- end mtchanc ----------
trim_2 = TrimTree(Tree=mtchanc, Depth=1)

pl2pl = MoveObjectPlaneToPlane(G=match, S=PlaneXY(0, 0, 0), T=trim_2)  # -> TG, T; inputs S: Plane, T: Plane
# ---------- pl2pl: Python ----------
#Component Information
#--------------------------------------------------------------------------------------------
if ghenv.Component.RunCount<2:
    #General
    #--------------------------------------------------------------------------------------------
    __author__ = "Ueli Saluz"
    __version__ = "2023.02.12"
    
    ghenv.Component.Name = "MoveObjectPlaneToPlane"
    ghenv.Component.NickName = "Pl2Pl"
    ghenv.Component.Description = "Moves abitrary geometry from a source plane to a target plane."
    ghenv.Component.Message = "VER 1.2"
    ghenv.Component.Category = "Transform"
    ghenv.Component.SubCategory = "Euclidean"
    
     #Inputs
    #--------------------------------------------------------------------------------------------
    inputIndex=0
    
    ghenv.Component.Params.Input[inputIndex].Name = "Geometry"
    ghenv.Component.Params.Input[inputIndex].NickName = "G"
    ghenv.Component.Params.Input[inputIndex].Description = "Geometry to move."
    ghenv.Component.Params.Input[inputIndex].Optional = False
    inputIndex+=1
    
    ghenv.Component.Params.Input[inputIndex].Name = "SourcePlane"
    ghenv.Component.Params.Input[inputIndex].NickName = "S"
    ghenv.Component.Params.Input[inputIndex].Description = "Source plane of object."
    ghenv.Component.Params.Input[inputIndex].Optional = False
    inputIndex+=1
    
    ghenv.Component.Params.Input[inputIndex].Name = "TargetPlane"
    ghenv.Component.Params.Input[inputIndex].NickName = "T"
    ghenv.Component.Params.Input[inputIndex].Description = "Target plane of object."
    ghenv.Component.Params.Input[inputIndex].Optional = False
    inputIndex+=1
    
    #Outputs
    #--------------------------------------------------------------------------------------------
    outputIndex=0
    
    ghenv.Component.Params.Output[outputIndex].Name = "TranslatedGeometry"
    ghenv.Component.Params.Output[outputIndex].NickName = "TG"
    ghenv.Component.Params.Output[outputIndex].Description = "Translated geometry in target plane."
    outputIndex+=1
    
    ghenv.Component.Params.Output[outputIndex].Name = "Trasnform"
    ghenv.Component.Params.Output[outputIndex].NickName = "T"
    ghenv.Component.Params.Output[outputIndex].Description = "Transform describing translation form source to target plane."
    outputIndex+=1


#Imports
#--------------------------------------------------------------------------------------------
import Rhino.Geometry.Transform as trsf

def MvObjPlnToPln (geo,plnObj,plnDest):
    transform = trsf.PlaneToPlane(plnObj,plnDest)
    geo.Transform(transform)
    return (geo,transform)

TG, T = MvObjPlnToPln(G,S,T)
# ---------- end pl2pl ----------

geo = Geometry(pl2pl.TG)

geo_2 = ClusterOutput(geo)

# ==== cluster SemioPreview
geo = ClusterInput()

geo_2 = Geometry(geo)
swatch = ColourSwatch(SwatchColor=RGB(0, 0, 0))
filtertype = FilterByType(ObjectType="Curve", Geometry=flatten(geo_2), invertFilter=False, returnNulls=False)  # -> ExcludedGeometry, IncludedGeometry
filtertype_2 = FilterByType(ObjectType="Brep", Geometry=flatten(geo_2), invertFilter=False, returnNulls=False)  # -> ExcludedGeometry, IncludedGeometry
debrep = DeconstructBrep(Brep=filtertype_2.IncludedGeometry)  # -> Faces, Edges, Vertices
preview = CustomPreview(Geometry=flatten(filtertype.IncludedGeometry), Material=swatch)
preview_2 = CustomPreview(Geometry=flatten(filtertype_2.IncludedGeometry), Material=ColourSwatch(SwatchColor=RGB(255, 255, 255)))
preview_3 = CustomPreview(Geometry=flatten(debrep.Edges), Material=swatch)

# ==== cluster PerformanceAssessment
fo = ClusterInput()
ty = ClusterInput()
heating_energy_price_cent_kwh = ClusterInput()
heating_efficiency_factor = ClusterInput()
heating_global_warming_potential_kgco2e = ClusterInput()  # "Heating Global Warming Potential [kgCO2e/kWh]"
cooling_energy_price_cent_kwh = ClusterInput()
cooling_efficiency_factor = ClusterInput()
cooling_global_warming_potential_kgco2e = ClusterInput()  # "Cooling Global Warming Potential [kgCO2e/kWh]"
electrictiy_energy_price_cent_kwh = ClusterInput()
electrictiy_global_warming_potential_kgc = ClusterInput()  # "Electrictiy Global Warming Potential [kgCO2e/kWh]"
heating_energy_price_cent_kwh_2 = Number(heating_energy_price_cent_kwh)
heating_efficiency_factor_2 = Number(heating_efficiency_factor)
heating_global_warming_potential_kgco2e_2 = Number(heating_global_warming_potential_kgco2e)  # "Heating Global Warming Potential [kgCO2e/kWh]"
cooling_energy_price_cent_kwh_2 = Number(cooling_energy_price_cent_kwh)
cooling_efficiency_factor_2 = Number(cooling_efficiency_factor)
cooling_global_warming_potential_kgco2e_2 = Number(cooling_global_warming_potential_kgco2e)  # "Cooling Global Warming Potential [kgCO2e/kWh]"
electrictiy_energy_price_cent_kwh_2 = Number(electrictiy_energy_price_cent_kwh)
electrictiy_global_warming_potential_kgc_2 = Number(electrictiy_global_warming_potential_kgc)  # "Electrictiy Global Warming Potential [kgCO2e/kWh]"
ty_2 = Type(ty)
fo_2 = Formation(fo)
sum_qualities = SumQal(fo=fo_2, ty=ty_2, name="effective floor area")  # -> num_2, ql_2
sum_qualities_2 = SumQal(fo=fo_2, ty=ty_2, name="construction cost")  # -> num_2, ql_2
sum_qualities_3 = SumQal(fo=fo_2, ty=ty_2, name=graft("heating energy demand"))  # -> num_2, ql_2
sum_qualities_4 = SumQal(fo=fo_2, ty=ty_2, name=graft("cooling energy demand"))  # -> num_2, ql_2
sum_qualities_5 = SumQal(fo=fo_2, ty=ty_2, name="maintenance expenses")  # -> num_2, ql_2
sum_qualities_6 = SumQal(fo=fo_2, ty=ty_2, name=graft("technical equipment energy demand"))  # -> num_2, ql_2
sum_qualities_7 = SumQal(fo=fo_2, ty=ty_2, name="income")  # -> num_2, ql_2
expression = Expression(x=sum_qualities_3.num_2, y=heating_efficiency_factor_2, Expression="x*(1/y)")
expression_2 = Expression(x=sum_qualities_4.num_2, y=cooling_efficiency_factor_2, Expression="x*(1/y)")
addition = Addition(A=expression, B=expression_2, C=sum_qualities_6.num_2)
multiplication = Multiplication(A=heating_energy_price_cent_kwh_2, B=expression)
multiplication_2 = Multiplication(A=heating_global_warming_potential_kgco2e_2, B=expression)
multiplication_3 = Multiplication(A=cooling_energy_price_cent_kwh_2, B=expression_2)
multiplication_4 = Multiplication(A=cooling_global_warming_potential_kgco2e_2, B=expression_2)
multiplication_5 = Multiplication(A=sum_qualities_6.num_2, B=electrictiy_energy_price_cent_kwh_2)
multiplication_6 = Multiplication(A=electrictiy_global_warming_potential_kgc_2, B=electrictiy_global_warming_potential_kgc_2)
sum_qualities_8 = SumQal(fo=fo_2, ty=ty_2, name="construction global warming potential")  # -> num_2, ql_2
division = Division(A=addition, B=sum_qualities.num_2)
addition_2 = Addition(A=multiplication, B=multiplication_3, C=multiplication_5)
addition_3 = Addition(A=multiplication_2, B=multiplication_4, C=multiplication_6)
division_2 = Division(A=addition_3, B=sum_qualities.num_2)
addition_4 = Addition(A=sum_qualities_5.num_2, B=addition_2)
subtraction = Subtraction(A=sum_qualities_7.num_2, B=addition_4)
effective_floor_area_m² = Number(sum_qualities.num_2)
specific_operational_global_warming_pote = Number(division_2)  # "Specific Operational Global Warming Potential [kgCO2e/m²a]"
construction_cost = Number(sum_qualities_2.num_2)
return_a = Number(subtraction)
construction_global_warming_potential_kg = Number(sum_qualities_8.num_2)  # "Construction Global Warming Potential [kgCO2e]"
operational_cost_a = Number(addition_4)
operational_global_warming_potential_kgc = Number(addition_3)  # "Operational Global Warming Potential [kgCO2e/a]"
income = Number(sum_qualities_7.num_2)
maintenance_expenses_a = Number(sum_qualities_5.num_2)
specific_energy_demand_kwh_m²a = Number(division)
operational_energy_cost_a = Number(addition_2)
heating_energy_demand_kwh_a = Number(sum_qualities_3.num_2)
cooling_energy_demand_kwh_a = Number(sum_qualities_4.num_2)
technical_equipment_energy_demand_kwh_a = Number(sum_qualities_6.num_2)
effective_floor_area_m²_2 = ClusterOutput(effective_floor_area_m²)
specific_operational_global_warming_pote_2 = ClusterOutput(specific_operational_global_warming_pote)  # "Specific Operational Global Warming Potential [kgCO2e/m²a]"
construction_cost_2 = ClusterOutput(construction_cost)
return_a_2 = ClusterOutput(return_a)
construction_global_warming_potential_kg_2 = ClusterOutput(construction_global_warming_potential_kg)  # "Construction Global Warming Potential [kgCO2e]"
operational_cost_a_2 = ClusterOutput(operational_cost_a)
operational_global_warming_potential_kgc_2 = ClusterOutput(operational_global_warming_potential_kgc)  # "Operational Global Warming Potential [kgCO2e/a]"
income_2 = ClusterOutput(income)
maintenance_expenses_a_2 = ClusterOutput(maintenance_expenses_a)
specific_energy_demand_kwh_m²a_2 = ClusterOutput(specific_energy_demand_kwh_m²a)
operational_energy_cost_a_2 = ClusterOutput(operational_energy_cost_a)
heating_energy_demand_kwh_a_2 = ClusterOutput(heating_energy_demand_kwh_a)
cooling_energy_demand_kwh_a_2 = ClusterOutput(cooling_energy_demand_kwh_a)
technical_equipment_energy_demand_kwh_a_2 = ClusterOutput(technical_equipment_energy_demand_kwh_a)

# ==== cluster Pc: Remove pieces and all attractions with these pieces from a formation.
fo = ClusterInput()
ids = ClusterInput()
fo_2 = Formation(fo)
ids_2 = Text(ids)
for = ModelFormation(Formation=fo_2)  # -> Formation, Name, Description, Icon, Variant, Unit, Pieces, Attractions, Qualities

trim = TrimTree(Tree=for.Attractions, Depth=1)
atr = ModelAttraction(Attraction=trim)  # -> Attraction, AttractingSide, AttractedSide
sde = ModelSide(Side=atr.AttractedSide)  # -> Side, PieceId, PieceTypePortId
sde_2 = ModelSide(Side=atr.AttractingSide)  # -> Side, PieceId, PieceTypePortId
expression = Expression(x=graft(sde.PieceId), y=ids_2, Expression="x=y")
expression_2 = Expression(x=graft(sde_2.PieceId), y=ids_2, Expression="x=y")
ma = MassAddition(Input=expression_2)  # -> Result, PartialResults
ma_2 = MassAddition(Input=expression)  # -> Result, PartialResults
or = GateOr(A=ma.Result, B=ma_2.Result)
trim_2 = TrimTree(Tree=or, Depth=1)
dispatch = Dispatch(List=trim, DispatchPattern=trim_2)  # -> ListA, ListB

trim_3 = TrimTree(Tree=for.Pieces, Depth=1)
pce = ModelPiece(Piece=trim_3)  # -> Piece, Id, TypeName, TypeVariant, RootPlane, DiagramScreenPoint
expression_3 = Expression(x=graft(pce.Id), y=ids_2, Expression="x=y")
ma_3 = MassAddition(Input=expression_3)  # -> Result, PartialResults
trim_4 = TrimTree(Tree=ma_3.Result, Depth=1)
dispatch_2 = Dispatch(List=trim_3, DispatchPattern=trim_4)  # -> ListA, ListB

for_2 = ModelFormation(Formation=for.Formation, Pieces=dispatch_2.ListB, Attractions=dispatch.ListB)  # -> Formation, Name, Description, Icon, Variant, Unit, Pieces, Attractions, Qualities
fo_3 = Formation(for_2.Formation)
removed_pieces = Piece(dispatch_2.ListA)
removed_attractions = Attraction(dispatch.ListA)
fo_4 = ClusterOutput(fo_3)
removed_pieces_2 = ClusterOutput(removed_pieces)
removed_attractions_2 = ClusterOutput(removed_attractions)

# ==== cluster SumQal: A sum of the value of the quality of the pieces of the formation. NOTE: No unit conversion is performed.
fo = ClusterInput()
ty = ClusterInput()
name = ClusterInput()
fo_2 = Formation(fo)
ty_2 = Type(ty)
name_2 = Text(name)
for = ModelFormation(Formation=fo_2)  # -> Formation, Name, Description, Icon, Variant, Unit, Pieces, Attractions, Qualities
typ = ModelType(Type=ty_2)  # -> Type, Name, Description, Icon, Variant, Unit, Representations, Ports, Qualities
lng = ListLength(List=ty_2)
series = Series(Start=0, Step=1, Count=lng)
trim = TrimTree(Tree=for.Pieces, Depth=1)
qlt = ModelQuality(Quality=typ.Qualities)  # -> Quality, Name, Value, Unit
trim_2 = TrimTree(Tree=series, Depth=1)
pce = ModelPiece(Piece=trim)  # -> Piece, Id, TypeName, TypeVariant, RootPlane, DiagramScreenPoint
expression = Expression(x=name_2, y=qlt.Name, Expression="x=y")
expression_2 = Expression(x=graft(pce.TypeName), y=typ.Name, Expression="x=y")
expression_3 = Expression(x=graft(pce.TypeVariant), y=typ.Variant, Expression="x=y")
cull = CullPattern(List=typ.Qualities, CullPattern=expression)
qlt_2 = ModelQuality(Quality=cull)  # -> Quality, Name, flatten(Value), Unit
and = GateAnd(A=expression_2, B=expression_3)
cull_2 = CullPattern(List=ty_2, CullPattern=and)
txt = Text(ty_2)
txt_2 = Text(cull_2)
expression_4 = Expression(x=txt_2, y=txt, Expression="x=y")
cull_3 = CullPattern(List=trim_2, CullPattern=expression_4)
ql = Quality(qlt_2.Quality)
trim_3 = TrimTree(Tree=cull_3, Depth=1)
item = ListItem(List=qlt_2.Value, Index=trim_3, Wrap=True)
clean = CleanTree(RemoveNulls=True, RemoveInvalid=True, RemoveEmpty=False, Tree=item)
ma = MassAddition(Input=clean)  # -> Result, PartialResults
num = Number(ma.Result)
num_2 = ClusterOutput(num)
ql_2 = ClusterOutput(ql)
