# Grasshopper definition nakagincapsuletower.gh (Grasshopper 1.0.7)
# plug-ins: semio, eleFront

genes = GenePool(Decimals=0, Maximum=8, Minimum=0, Value=[0, 0, 0, 0, 0, 0, 0, 0, 0])
genes_2 = GenePool(Decimals=0, Maximum=8, Minimum=0, Value=[6, 6, 6, 6, 6, 6, 6, 6, 6])
genes_3 = GenePool(Decimals=0, Maximum=8, Minimum=0, Value=[6, 0, 0, 0, 6, 6, 0, 6, 0, 6, 3])
genes_4 = GenePool(Decimals=0, Maximum=8, Minimum=0, Value=[0, 0, 0, 0, 0, 0, 0, 0, 0, 0, 0])
qlt = ModelQuality(Name="storeys", Value="9")  # -> Quality, Name, Value, Unit
qlt_2 = ModelQuality(Name="storeys", Value="11")  # -> Quality, Name, Value, Unit
qlt_3 = ModelQuality(Name="cores", Value="2")  # -> Quality, Name, Value, Unit
pce = ModelPiece(TypeName="shaft", TypeQualities=qlt.Quality)  # -> Piece, Id, TypeName, TypeQualities
pce_2 = ModelPiece(TypeName="capital")  # -> Piece, Id, TypeName, TypeQualities
pce_3 = ModelPiece(TypeName="shaft", TypeQualities=qlt_2.Quality)  # -> Piece, Id, TypeName, TypeQualities
pce_4 = ModelPiece(TypeName="capital")  # -> Piece, Id, TypeName, TypeQualities
pce_5 = ModelPiece(TypeName="base", TypeQualities=qlt_3.Quality)  # -> Piece, Id, TypeName, TypeQualities
genes_5 = GenePool(Decimals=0, Maximum=8, Minimum=0, Value=[6, 0, 0, 6, 6, 3, 3, 6, 0])
genes_6 = GenePool(Decimals=0, Maximum=8, Minimum=0, Value=[6, 6, 6, 6, 6, 6, 6, 7, 7])
genes_7 = GenePool(Decimals=0, Maximum=8, Minimum=0, Value=[8, 8, 8, 8, 8, 8, 8, 8, 8, 8, 8])
genes_8 = GenePool(Decimals=0, Maximum=8, Minimum=0, Value=[6, 6, 6, 6, 6, 6, 6, 6, 6, 6, 6])
spc = ModelSpecifier(Context="core", Group="0")  # -> Specifier, Context, Group
spc_2 = ModelSpecifier(Context="bottom", Group="true")  # -> Specifier, Context, Group
spc_3 = ModelSpecifier(Context="core", Group="1")  # -> Specifier, Context, Group
spc_4 = ModelSpecifier(Context="bottom", Group="true")  # -> Specifier, Context, Group
spc_5 = ModelSpecifier(Context="top", Group="true")  # -> Specifier, Context, Group
tower = Tower(
    number_of_floors="9",
    shaftpieceid=pce.Id,
    capsulepatternnortheast=genes,
    capsulepatternsoutheast=genes_2,
    capsulepatternsouthwest=genes_5,
    capsulepatternnorthwest=genes_6,
    id="1")  # -> pc_2, at_2
tower_2 = Tower(
    number_of_floors="11",
    shaftpieceid=pce_3.Id,
    capsulepatternnortheast=genes_4,
    capsulepatternsoutheast=genes_8,
    capsulepatternsouthwest=genes_7,
    capsulepatternnorthwest=genes_3,
    id="0")  # -> pc_2, at_2
sde = ModelSide(PieceId=pce_5.Id, PieceTypePortSpecifiers=spc.Specifier)  # -> Side, PieceId, PieceTypePortSpecifiers
sde_2 = ModelSide(PieceId=pce_3.Id, PieceTypePortSpecifiers=spc_2.Specifier)  # -> Side, PieceId, PieceTypePortSpecifiers
sde_3 = ModelSide(PieceId=pce_5.Id, PieceTypePortSpecifiers=spc_3.Specifier)  # -> Side, PieceId, PieceTypePortSpecifiers
sde_4 = ModelSide(PieceId=pce.Id, PieceTypePortSpecifiers=spc_2.Specifier)  # -> Side, PieceId, PieceTypePortSpecifiers
sde_5 = ModelSide(PieceId=pce_3.Id, PieceTypePortSpecifiers=spc_5.Specifier)  # -> Side, PieceId, PieceTypePortSpecifiers
sde_6 = ModelSide(PieceId=pce_4.Id, PieceTypePortSpecifiers=spc_4.Specifier)  # -> Side, PieceId, PieceTypePortSpecifiers
sde_7 = ModelSide(PieceId=pce.Id, PieceTypePortSpecifiers=spc_5.Specifier)  # -> Side, PieceId, PieceTypePortSpecifiers
sde_8 = ModelSide(PieceId=pce_2.Id, PieceTypePortSpecifiers=spc_4.Specifier)  # -> Side, PieceId, PieceTypePortSpecifiers
kit = CreateKit(
    Name="metabolism",
    Explanation="Everything for metabolistic architecture.",
    Icon="🫀",
    Url="https://github.com/usalu/semio/examples/metabolism",
    Run=Toggle(False))
kit_2 = DeleteKit(Run=Toggle(False))
remove_types = BooleanToggle(False)
read_kit = BooleanToggle(False)
panel = Panel("cylindric shaft")
panel_2 = Panel("cylindric capital")
panel_3 = Panel("capsule")
atr = ModelAttraction(AttractingSide=sde_3.Side, AttractedSide=sde_4.Side)  # -> Attraction, AttractingSide, AttractedSide
panel_4 = Panel("base")
atr_2 = ModelAttraction(AttractingSide=sde.Side, AttractedSide=sde_2.Side)  # -> Attraction, AttractingSide, AttractedSide
panel_5 = Panel("capital")
atr_3 = ModelAttraction(AttractingSide=sde_5.Side, AttractedSide=sde_6.Side)  # -> Attraction, AttractingSide, AttractedSide
atr_4 = ModelAttraction(AttractingSide=sde_7.Side, AttractedSide=sde_8.Side)  # -> Attraction, AttractingSide, AttractedSide
kit_3 = LoadKit(Run=read_kit)  # -> Name, Explanation, Icon, Url, Types, Formations
merge = Merge(Data1=pce_5.Piece, Data2=pce_3.Piece, Data3=pce.Piece, Data4=pce_4.Piece, Data5=pce_2.Piece)
merge_2 = Merge(Data1=atr_2.Attraction, Data2=atr.Attraction, Data3=atr_3.Attraction, Data4=atr_4.Attraction)
typ = ModelType(Type=kit_3.Types)  # -> Type, Name, Explanation, Icon, Representations, Ports, Qualities
for = ModelFormation(Formation=kit_3.Formations)  # -> Formation, Name, Explanation, Icon, Pieces, Attractions, Qualities
merge_3 = Merge(Data1=merge, Data2=tower_2.pc_2, Data3=tower.pc_2)
merge_4 = Merge(Data1=merge_2, Data3=tower_2.at_2, Data4=tower.at_2)
tmatch = MatchText(Text=typ.Name, Pattern="shaft", Case=True)
for_2 = ModelFormation(
    Name="nakagin capsule tower",
    Explanation="The former Nakagin Capsule Tower from Tokyio.",
    Icon="🏯",
    Pieces=merge_3,
    Attractions=merge_4)  # -> Formation, Name, Explanation, Icon, Pieces, Attractions, Qualities
cull = CullPattern(List=kit_3.Types, CullPattern=tmatch)
replacetypeinformation = ReplaceTypeInFormation(fo=for_2.Formation, old_type_name="capsule", new_type_name="futuristic capsule")

_1_to_500_or_200 = BooleanToggle(False)
cylindric = BooleanToggle(False)
futuristic = BooleanToggle(False)
run = BooleanToggle(True)

typ_2 = ModelType(Type=cull)  # -> Type, Name, Explanation, Icon, Representations, Ports, Qualities
qlt_4 = ModelQuality(Quality=typ_2.Qualities)  # -> Quality, Name, Value, Unit
filter = StreamFilter(Gate=futuristic, Stream0=for_2.Formation, Stream1=replacetypeinformation)
replacetypeinformation_2 = ReplaceTypeInFormation(fo=filter, old_type_name="shaft", new_type_name="cylindric shaft")
filter_2 = StreamFilter(Gate=cylindric, Stream0=filter, Stream1=replacetypeinformation_2)
replacetypeinformation_3 = ReplaceTypeInFormation(fo=filter_2, old_type_name="capital", new_type_name="cylindric capital")
filter_3 = StreamFilter(Gate=cylindric, Stream0=filter_2, Stream1=replacetypeinformation_3)
panel_6 = Panel(qlt_4.Name)
for_3 = ModelFormation(Formation=filter_3)  # -> Formation, Name, Explanation, Icon, Pieces, Attractions, Qualities
for_4 = RemoveFormation(FormationName=for_3.Name, Run=remove_types)
or = GateOr(A=for_4, B=remove_types)
typ_3 = RemoveType(TypeName="shaft", TypeQualities=qlt_4.Quality, Run=or)
panel_7 = Panel(qlt_4.Value)
for_5 = RemoveFormation(FormationName=for_3.Name, FormationQualities=for_3.Qualities, Run=run)
or_2 = GateOr(A=run, B=for_5)
for_6 = AddFormation(Formation=for_3.Formation, Run=or_2)
scn = GetScene(FormationName=for_3.Name, FormationQualities=for_3.Qualities, Run=for_6)
filter_4 = StreamFilter(Gate=_1_to_500_or_200, Stream0="1to500", Stream1="1to200")
scn_2 = FilterScene(Scene=scn, LevelOfDetails=filter_4, Tags="volume", Formats=".3dm")  # -> Representations, Planes, PiecesIds, ParentsPiecesIds

rp = Representation(scn_2.Representations)
pln = Plane(scn_2.Planes)
trim = TrimTree(Tree=pln, Depth=1)  # -> graft(Tree)
trim_2 = TrimTree(Tree=rp, Depth=1)
rep = ModelRepresentation(Representation=trim_2)  # -> Representation, Url, LevelOfDetail, Tags
box = DomainBox(Base=PlaneXY(0, 0, 0), X=Domain(-2, 2), Y=Domain(-0.5, 0.5), Z=Domain(0, 0.25))
pl2pl = MoveObjectPlaneToPlane(G=box, S=PlaneXY(0, 0, 0), T=trim)  # -> TG, T; inputs S: Plane, T: Plane
# ---------- pl2pl: Python ----------
#Component Information
#--------------------------------------------------------------------------------------------
if ghenv.Component.RunCount<2:
    #General
    #--------------------------------------------------------------------------------------------
    __author__ = "Ueli Saluz"
    __version__ = "2023.02.12"
    
    ghenv.Component.Name = "MoveObjectPlaneToPlane"
    ghenv.Component.NickName = "Pl2Pl"
    ghenv.Component.Description = "Moves abitrary geometry from a source plane to a target plane."
    ghenv.Component.Message = "VER 1.2"
    ghenv.Component.Category = "Transform"
    ghenv.Component.SubCategory = "Euclidean"
    
     #Inputs
    #--------------------------------------------------------------------------------------------
    inputIndex=0
    
    ghenv.Component.Params.Input[inputIndex].Name = "Geometry"
    ghenv.Component.Params.Input[inputIndex].NickName = "G"
    ghenv.Component.Params.Input[inputIndex].Description = "Geometry to move."
    ghenv.Component.Params.Input[inputIndex].Optional = False
    inputIndex+=1
    
    ghenv.Component.Params.Input[inputIndex].Name = "SourcePlane"
    ghenv.Component.Params.Input[inputIndex].NickName = "S"
    ghenv.Component.Params.Input[inputIndex].Description = "Source plane of object."
    ghenv.Component.Params.Input[inputIndex].Optional = False
    inputIndex+=1
    
    ghenv.Component.Params.Input[inputIndex].Name = "TargetPlane"
    ghenv.Component.Params.Input[inputIndex].NickName = "T"
    ghenv.Component.Params.Input[inputIndex].Description = "Target plane of object."
    ghenv.Component.Params.Input[inputIndex].Optional = False
    inputIndex+=1
    
    #Outputs
    #--------------------------------------------------------------------------------------------
    outputIndex=0
    
    ghenv.Component.Params.Output[outputIndex].Name = "TranslatedGeometry"
    ghenv.Component.Params.Output[outputIndex].NickName = "TG"
    ghenv.Component.Params.Output[outputIndex].Description = "Translated geometry in target plane."
    outputIndex+=1
    
    ghenv.Component.Params.Output[outputIndex].Name = "Trasnform"
    ghenv.Component.Params.Output[outputIndex].NickName = "T"
    ghenv.Component.Params.Output[outputIndex].Description = "Transform describing translation form source to target plane."
    outputIndex+=1


#Imports
#--------------------------------------------------------------------------------------------
import Rhino.Geometry.Transform as trsf

def MvObjPlnToPln (geo,plnObj,plnDest):
    transform = trsf.PlaneToPlane(plnObj,plnDest)
    geo.Transform(transform)
    return (geo,transform)

TG, T = MvObjPlnToPln(G,S,T)
# ---------- end pl2pl ----------
curdir = CurrentDirectory()  # -> D, P, S
# ---------- curdir: Python ----------
#Component Information
#--------------------------------------------------------------------------------------------
if ghenv.Component.RunCount<2:
    #General
    #--------------------------------------------------------------------------------------------
    __author__ = "Ueli Saluz"
    __version__ = "2023.09.29"
    
    ghenv.Component.Name = "CurrentDirectory"
    ghenv.Component.NickName = "CurDir"
    ghenv.Component.Description = "Current directory of the current grasshopper file."
    ghenv.Component.Message = "VER 1.0"
    ghenv.Component.Category = "Params"
    ghenv.Component.SubCategory = "Util"
    
    #Outputs
    #--------------------------------------------------------------------------------------------
    outputIndex=0
    
    ghenv.Component.Params.Output[outputIndex].Name = "Directory"
    ghenv.Component.Params.Output[outputIndex].NickName = "D"
    ghenv.Component.Params.Output[outputIndex].Description = "Directory of the current grasshopper file."
    outputIndex+=1
    
    ghenv.Component.Params.Output[outputIndex].Name = "Path"
    ghenv.Component.Params.Output[outputIndex].NickName = "P"
    ghenv.Component.Params.Output[outputIndex].Description = "Path of the current grasshopper file."
    outputIndex+=1
    
    ghenv.Component.Params.Output[outputIndex].Name = "Separator"
    ghenv.Component.Params.Output[outputIndex].NickName = "S"
    ghenv.Component.Params.Output[outputIndex].Description = "Separator of the current system."
    outputIndex+=1

#Imports
#--------------------------------------------------------------------------------------------
from os.path import dirname
from os import sep

#Solver - Run with trees to enhance performance drastically
#--------------------------------------------------------------------------------------------
if __name__ == "__main__":
    P = ghenv.Component.OnPingDocument().FilePath
    D = dirname(P)
    S = sep
# ---------- end curdir ----------
concat = Concatenate(FragmentA=curdir.D, FragmentB=curdir.S, FragmentC=rep.Url)
refbake = ReferenceByBakeName(FilePath=graft(concat), BakeName="*", Key="*", Val="*", lightweight=False)
trim_3 = TrimTree(Tree=refbake, Depth=1)  # -> graft(Tree)
mtchanc = MatchAncestor(AT=pl2pl.T, CT=trim_3)  # -> MAT; inputs AT: tree, CT: tree
# ---------- mtchanc: Python ----------
if ghenv.Component.RunCount<2:
    __author__ = "Ueli Saluz"
    __version__ = "2022.04.25"
    
    ghenv.Component.Name = "Match Ancestor"
    ghenv.Component.NickName = "MtchAnc"
    ghenv.Component.Description = "Duplicates all elements of an ancestor tree to match the amount of elements in the child tree."
    ghenv.Component.Message = "VER 1.1"
    
    ghenv.Component.Params.Input[0].Name = "AncestorTree"
    ghenv.Component.Params.Input[0].NickName = "AT"
    ghenv.Component.Params.Input[0].Description = "Ancestor tree that data will the duplicated until it matches the child tree"
    ghenv.Component.Params.Input[0].Optional = False
    
    ghenv.Component.Params.Input[1].Name = "ChildTree"
    ghenv.Component.Params.Input[1].NickName = "CT"
    ghenv.Component.Params.Input[1].Description = "Child tree that branches will the guide to duplicat the data of the ancestor tree"
    ghenv.Component.Params.Input[0].Optional = False
    
    ghenv.Component.Params.Output[0].Name = "MatchedAncestorTree"
    ghenv.Component.Params.Output[0].NickName = "MAT"
    ghenv.Component.Params.Output[0].Description = "Matched ancestor tree with the amount of items and the branch paths of the child tree"

from System import Object
from Grasshopper import DataTree

"""Returns a new tree with the ancestor data being duplicated along all child branches which where child paths of that ancestor.
    Inputs:
        ancestorTree: Ancestor tree that data will the duplicated until it matches the child tree
        childTree: Child tree that branches will the guide to duplicat the data of the ancestor tree
    Output:
        matchedAncestorTree: Matched ancestor tree with the amount of items and the branch paths of the child tree"""
def MatchAncestorTreeToChildTree (ancestorTree, childTree):
    
    matchedAncestorTree = DataTree[Object]()
    dummy = 0
    for i,pathAncestor in enumerate(ancestorTree.Paths):
        branch = ancestorTree.Branch(pathAncestor)
        if len(branch)!=1:
            raise Exception("Ancestor must be grafted and containing one item per branch")
        #The item to be duplicated
        item = branch[0]
        for j,pathChild in enumerate(childTree.Paths):
            #Returns a tuple and not like in the documentation described a bool with a pointer to the int to store the generations
            checkAncestor = pathChild.IsAncestor(pathAncestor,dummy)
            if(checkAncestor[0]):
                matchedAncestorTree.AddRange([item]*childTree.Branch(pathChild).Count,pathChild)
    return matchedAncestorTree

if __name__ == "__main__":
    MAT = MatchAncestorTreeToChildTree (AT,CT)
# ---------- end mtchanc ----------
trim_4 = TrimTree(Tree=mtchanc, Depth=1)
transform = Transform(Geometry=refbake, Transform=trim_4)
geo = Geometry(transform)

previewplane = PreviewPlane(plane=pln, axis_length=Slider(200, range=0..1000))
filtertype = FilterByType(ObjectType="Brep", Geometry=flatten(geo), invertFilter=False, returnNulls=False)  # -> ExcludedGeometry, IncludedGeometry
swatch = ColourSwatch(SwatchColor=RGB(0, 0, 0))
filtertype_2 = FilterByType(ObjectType="Curve", Geometry=flatten(geo), invertFilter=False, returnNulls=False)  # -> ExcludedGeometry, IncludedGeometry
debrep = DeconstructBrep(Brep=geo)  # -> Faces, Edges, Vertices
preview = CustomPreview(Geometry=flatten(filtertype.IncludedGeometry), Material=ColourSwatch(SwatchColor=RGB(255, 255, 255)))
preview_2 = CustomPreview(Geometry=flatten(filtertype_2.IncludedGeometry), Material=swatch)
preview_3 = CustomPreview(Geometry=flatten(debrep.Edges), Material=swatch)

# ==== cluster PreviewPlane: Preview a plane with axis colors and naming.
axis_length = ClusterInput()
plane = ClusterInput()
axis_length_2 = Number(axis_length)
plane_2 = Plane(plane)
deplane = DeconstructPlane(Plane=plane_2)  # -> Origin, XAxis, YAxis, ZAxis
line = LineSDL(Start=deplane.Origin, Direction=deplane.YAxis, Length=axis_length_2)
line_2 = LineSDL(Start=deplane.Origin, Direction=deplane.XAxis, Length=axis_length_2)
line_3 = LineSDL(Start=deplane.Origin, Direction=deplane.ZAxis, Length=axis_length_2)
swatch = ColourSwatch(SwatchColor=RGB(235, 52, 79))
swatch_2 = ColourSwatch(SwatchColor=RGB(0, 166, 157))
swatch_3 = ColourSwatch(SwatchColor=RGB(240, 117, 24))
end = EndPoints(Curve=line_2)  # -> Start, End
end_2 = EndPoints(Curve=line)  # -> Start, End
end_3 = EndPoints(Curve=line_3)  # -> Start, End
tag = TextTag(Location=end.End, Text="X", Colour=swatch)
tag_2 = TextTag(Location=end_2.End, Text="Y", Colour=swatch_2)
tag_3 = TextTag(Location=end_3.End, Text="Z", Colour=swatch_3)
preview = CustomPreview(Geometry=line_2, Material=swatch)
preview_2 = CustomPreview(Geometry=line, Material=swatch_2)
preview_3 = CustomPreview(Geometry=line_3, Material=swatch_3)

# ==== cluster Tower
number_of_floors = ClusterInput()
shaftpieceid = ClusterInput()
capsulepatternnortheast = ClusterInput()
capsulepatternsoutheast = ClusterInput()
capsulepatternsouthwest = ClusterInput()
capsulepatternnorthwest = ClusterInput()
id = ClusterInput()
qlt = ModelQuality(Name="entrance", Value="back")  # -> Quality, Name, Value, Unit
qlt_2 = ModelQuality(Name="entrance", Value="side")  # -> Quality, Name, Value, Unit
qlt_3 = ModelQuality(Name="view", Value="front")  # -> Quality, Name, Value, Unit
qlt_4 = ModelQuality(Name="view", Value="side")  # -> Quality, Name, Value, Unit
qlt_5 = ModelQuality(Name="mirrored", Value="false")  # -> Quality, Name, Value, Unit
qlt_6 = ModelQuality(Name="mirrored", Value="true")  # -> Quality, Name, Value, Unit
number_of_floors_2 = Integer(number_of_floors)
shaftpieceid_2 = Text(shaftpieceid)
capsulepatternnortheast_2 = Integer(capsulepatternnortheast)
capsulepatternsoutheast_2 = Integer(capsulepatternsoutheast)
capsulepatternsouthwest_2 = Integer(capsulepatternsouthwest)
capsulepatternnorthwest_2 = Integer(capsulepatternnorthwest)
id_2 = Integer(id)
merge = Merge(Data1=qlt.Quality, Data2=qlt_3.Quality, Data3=qlt_5.Quality)
merge_2 = Merge(Data1=qlt.Quality, Data2=qlt_4.Quality, Data3=qlt_5.Quality)
merge_3 = Merge(Data1=qlt.Quality, Data2=qlt_4.Quality, Data3=qlt_6.Quality)
merge_4 = Merge(Data1=qlt_2.Quality, Data2=qlt_3.Quality, Data3=qlt_5.Quality)
merge_5 = Merge(Data1=qlt.Quality, Data2=qlt_3.Quality, Data3=qlt_6.Quality)
merge_6 = Merge(Data1=qlt_2.Quality, Data2=qlt_4.Quality, Data3=qlt_5.Quality)
merge_7 = Merge(Data1=qlt_2.Quality, Data2=qlt_4.Quality, Data3=qlt_6.Quality)
merge_8 = Merge(Data1=qlt_2.Quality, Data2=qlt_3.Quality, Data3=qlt_6.Quality)
capsule2ql = Quality(merge_5)
capsule1ql = Quality(merge)
capsule5ql = Quality(merge_4)
capsule3ql = Quality(merge_2)
capsule4ql = Quality(merge_3)
capsule7ql = Quality(merge_6)
capsule6ql = Quality(merge_8)
capsule8ql = Quality(merge_7)
mrg_a = MergeSeperatlyAppend(x=capsule1ql, y=capsule3ql, z=capsule5ql, u=capsule7ql)  # -> Mrgd; inputs x: tree, y: tree, z: tree, u: tree
# ---------- mrg_a: Python ----------
if ghenv.Component.RunCount<2:
    __author__ = "Ueli Saluz"
    __version__ = "2020.05.28"
    
    ghenv.Component.Name = "MergeSeperatly(Append)"
    ghenv.Component.NickName = "Mrg(A)"
    ghenv.Component.Description = "Merge inputs seperatly on a new path. Append index of input parameter for distincting."
    ghenv.Component.Message = "VER 1.0"

from System import Object
from Grasshopper import DataTree
from Grasshopper.Kernel import GH_ParamAccess as Access

if __name__ == "__main__":
    Mrgd = DataTree[Object]()
    access = Access()
    
    for input in ghenv.Component.Params.Input:  #set all Inputaccess to Tree Access
        input.Access = access.tree
    
    for i,input in enumerate(ghenv.Component.Params.Input):
        for j,source in enumerate(input.Sources):
            for path in source.VolatileData.Paths:
                Mrgd.AddRange(source.VolatileData[path],path.AppendElement(i))
# ---------- end mrg_a ----------
mrg_a_2 = MergeSeperatlyAppend(x=capsule2ql, y=capsule4ql, z=capsule6ql, u=capsule8ql)  # -> Mrgd; inputs x: tree, y: tree, z: tree, u: tree; same code as mrg_a
panel = Panel("""0
0
1
0
1
0
2
3
3""")
panel_2 = Panel("""2
3
3
0
0
1
0
0
1""")
tstat = TreeStatistics(Tree=mrg_a)  # -> Paths, Length, Count
tstat_2 = TreeStatistics(Tree=mrg_a_2)  # -> Paths, Length, Count

item = ListItem(List=panel, Index=capsulepatternnortheast_2, Wrap=True)
capsuletypenorthright = Integer(item)

item_2 = ListItem(List=panel_2, Index=capsulepatternnortheast_2, Wrap=True)
capsuletypeeastleft = Integer(item_2)

item_3 = ListItem(List=panel_2, Index=capsulepatternsoutheast_2, Wrap=True)
capsuletypesouthright = Integer(item_3)
item_4 = ListItem(List=tstat.Paths, Index=capsuletypesouthright, Wrap=True)
branch = TreeBranch(Tree=mrg_a, Path=item_4, MaintainPaths=False)
ids = RandomIds(Count=number_of_floors_2, Seed=id_2, UniqueComponent=True)
path_mapper = PathMapper(branch, source="{x}", target="{0;x}")
trim = TrimTree(Tree=ids, Depth=1)  # -> graft(Tree)
pce = ModelPiece(Id=trim, TypeName="capsule", TypeQualities=path_mapper)  # -> Piece, Id, TypeName, TypeQualities
trim_2 = TrimTree(Tree=pce.Id, Depth=1)
trim_3 = TrimTree(Tree=pce.Piece, Depth=1)

item_5 = ListItem(List=panel, Index=capsulepatternsoutheast_2, Wrap=True)
capsuletypeeastright = Integer(item_5)

item_6 = ListItem(List=panel, Index=capsulepatternnorthwest_2, Wrap=True)
capsuletypenorthleft = Integer(item_6)

item_7 = ListItem(List=panel, Index=capsulepatternsouthwest_2, Wrap=True)
capsuletypewestleft = Integer(item_7)
item_8 = ListItem(List=tstat.Paths, Index=capsuletypewestleft, Wrap=True)
branch_2 = TreeBranch(Tree=mrg_a, Path=item_8, MaintainPaths=False)
ids_2 = RandomIds(Count=number_of_floors_2, Seed=id_2, UniqueComponent=True)
path_mapper_2 = PathMapper(branch_2, source="{x}", target="{0;x}")
trim_4 = TrimTree(Tree=ids_2, Depth=1)  # -> graft(Tree)
pce_2 = ModelPiece(Id=trim_4, TypeName="capsule", TypeQualities=path_mapper_2)  # -> Piece, Id, TypeName, TypeQualities
trim_5 = TrimTree(Tree=pce_2.Id, Depth=1)
trim_6 = TrimTree(Tree=pce_2.Piece, Depth=1)

item_9 = ListItem(List=panel_2, Index=capsulepatternsouthwest_2, Wrap=True)
capsuletypesouthrigh = Integer(item_9)
item_10 = ListItem(List=tstat_2.Paths, Index=capsuletypesouthrigh, Wrap=True)
branch_3 = TreeBranch(Tree=mrg_a_2, Path=item_10, MaintainPaths=False)
ids_3 = RandomIds(Count=number_of_floors_2, Seed=id_2, UniqueComponent=True)
path_mapper_3 = PathMapper(branch_3, source="{x}", target="{0;x}")
trim_7 = TrimTree(Tree=ids_3, Depth=1)  # -> graft(Tree)
pce_3 = ModelPiece(Id=trim_7, TypeName="capsule", TypeQualities=path_mapper_3)  # -> Piece, Id, TypeName, TypeQualities
trim_8 = TrimTree(Tree=pce_3.Id, Depth=1)
trim_9 = TrimTree(Tree=pce_3.Piece, Depth=1)

item_11 = ListItem(List=panel_2, Index=capsulepatternnorthwest_2, Wrap=True)
capsuletypewestright = Integer(item_11)
item_12 = ListItem(List=tstat_2.Paths, Index=capsuletypewestright, Wrap=True)
branch_4 = TreeBranch(Tree=mrg_a_2, Path=item_12, MaintainPaths=False)
ids_4 = RandomIds(Count=number_of_floors_2, Seed=id_2, UniqueComponent=True)
path_mapper_4 = PathMapper(branch_4, source="{x}", target="{0;x}")
trim_10 = TrimTree(Tree=ids_4, Depth=1)  # -> graft(Tree)
pce_4 = ModelPiece(Id=trim_10, TypeName="capsule", TypeQualities=path_mapper_4)  # -> Piece, Id, TypeName, TypeQualities
trim_11 = TrimTree(Tree=pce_4.Id, Depth=1)
trim_12 = TrimTree(Tree=pce_4.Piece, Depth=1)

item_13 = ListItem(List=tstat.Paths, Index=capsuletypeeastleft, Wrap=True)
branch_5 = TreeBranch(Tree=mrg_a, Path=item_13, MaintainPaths=False)
ids_5 = RandomIds(Count=number_of_floors_2, Seed=id_2, UniqueComponent=True)
path_mapper_5 = PathMapper(branch_5, source="{x}", target="{0;x}")
trim_13 = TrimTree(Tree=ids_5, Depth=1)  # -> graft(Tree)
pce_5 = ModelPiece(Id=trim_13, TypeName="capsule", TypeQualities=path_mapper_5)  # -> Piece, Id, TypeName, TypeQualities
trim_14 = TrimTree(Tree=pce_5.Id, Depth=1)
trim_15 = TrimTree(Tree=pce_5.Piece, Depth=1)

item_14 = ListItem(List=tstat.Paths, Index=capsuletypenorthleft, Wrap=True)
branch_6 = TreeBranch(Tree=mrg_a, Path=item_14, MaintainPaths=False)
ids_6 = RandomIds(Count=number_of_floors_2, Seed=id_2, UniqueComponent=True)
path_mapper_6 = PathMapper(branch_6, source="{x}", target="{0;x}")
trim_16 = TrimTree(Tree=ids_6, Depth=1)  # -> graft(Tree)
pce_6 = ModelPiece(Id=trim_16, TypeName="capsule", TypeQualities=path_mapper_6)  # -> Piece, Id, TypeName, TypeQualities
trim_17 = TrimTree(Tree=pce_6.Id, Depth=1)
trim_18 = TrimTree(Tree=pce_6.Piece, Depth=1)

item_15 = ListItem(List=tstat.Paths, Index=capsuletypeeastright, Wrap=True)
branch_7 = TreeBranch(Tree=mrg_a_2, Path=item_15, MaintainPaths=False)
ids_7 = RandomIds(Count=number_of_floors_2, Seed=id_2, UniqueComponent=True)
path_mapper_7 = PathMapper(branch_7, source="{x}", target="{0;x}")
trim_19 = TrimTree(Tree=ids_7, Depth=1)  # -> graft(Tree)
pce_7 = ModelPiece(Id=trim_19, TypeName="capsule", TypeQualities=path_mapper_7)  # -> Piece, Id, TypeName, TypeQualities
trim_20 = TrimTree(Tree=pce_7.Id, Depth=1)
trim_21 = TrimTree(Tree=pce_7.Piece, Depth=1)

item_16 = ListItem(List=tstat.Paths, Index=capsuletypenorthright, Wrap=True)
branch_8 = TreeBranch(Tree=mrg_a_2, Path=item_16, MaintainPaths=False)
ids_8 = RandomIds(Count=number_of_floors_2, Seed=id_2, UniqueComponent=True)
path_mapper_8 = PathMapper(branch_8, source="{x}", target="{0;x}")
trim_22 = TrimTree(Tree=ids_8, Depth=1)  # -> graft(Tree)
pce_8 = ModelPiece(Id=trim_22, TypeName="capsule", TypeQualities=path_mapper_8)  # -> Piece, Id, TypeName, TypeQualities
trim_23 = TrimTree(Tree=pce_8.Id, Depth=1)
trim_24 = TrimTree(Tree=pce_8.Piece, Depth=1)

series = Series(Start=0, Step=1, Count=number_of_floors_2)
trim_25 = TrimTree(Tree=series, Depth=1)  # -> graft(Tree)
expression = Expression(x="0", y=trim_25, Expression="x")
expression_2 = Expression(x="0", y=trim_25, Expression="x")
spc = ModelSpecifier(Context="floor", Group=trim_25)  # -> Specifier, Context, Group
spc_2 = ModelSpecifier(Context="split level", Group=expression)  # -> Specifier, Context, Group
spc_3 = ModelSpecifier(Context="door", Group=expression_2)  # -> Specifier, Context, Group
spc_4 = ModelSpecifier(Context="doors", Group="front")  # -> Specifier, Context, Group
merge_9 = Merge(Data1=spc.Specifier, Data2=spc_2.Specifier, Data3=spc_3.Specifier)
sde = ModelSide(PieceId=shaftpieceid_2, PieceTypePortSpecifiers=merge_9)  # -> Side, PieceId, PieceTypePortSpecifiers
sde_2 = ModelSide(PieceId=trim_2, PieceTypePortSpecifiers=spc_4.Specifier)  # -> Side, PieceId, PieceTypePortSpecifiers
trim_26 = TrimTree(Tree=sde.Side, Depth=1)
atr = ModelAttraction(AttractingSide=trim_26, AttractedSide=sde_2.Side)  # -> Attraction, AttractingSide, AttractedSide

expression_3 = Expression(x="1", y=trim_25, Expression="x")
spc_5 = ModelSpecifier(Context="door", Group=expression_3)  # -> Specifier, Context, Group
merge_10 = Merge(Data1=spc.Specifier, Data2=spc_2.Specifier, Data3=spc_5.Specifier)
sde_3 = ModelSide(PieceId=shaftpieceid_2, PieceTypePortSpecifiers=merge_10)  # -> Side, PieceId, PieceTypePortSpecifiers
sde_4 = ModelSide(PieceId=trim_20, PieceTypePortSpecifiers=spc_4.Specifier)  # -> Side, PieceId, PieceTypePortSpecifiers
trim_27 = TrimTree(Tree=sde_3.Side, Depth=1)
atr_2 = ModelAttraction(AttractingSide=trim_27, AttractedSide=sde_4.Side)  # -> Attraction, AttractingSide, AttractedSide

expression_4 = Expression(x="3", y=trim_25, Expression="x")
spc_6 = ModelSpecifier(Context="door", Group=expression_4)  # -> Specifier, Context, Group
merge_11 = Merge(Data1=spc.Specifier, Data2=spc_2.Specifier, Data3=spc_6.Specifier)
sde_5 = ModelSide(PieceId=shaftpieceid_2, PieceTypePortSpecifiers=merge_11)  # -> Side, PieceId, PieceTypePortSpecifiers
sde_6 = ModelSide(PieceId=trim_23, PieceTypePortSpecifiers=spc_4.Specifier)  # -> Side, PieceId, PieceTypePortSpecifiers
trim_28 = TrimTree(Tree=sde_5.Side, Depth=1)
atr_3 = ModelAttraction(AttractingSide=trim_28, AttractedSide=sde_6.Side)  # -> Attraction, AttractingSide, AttractedSide

expression_5 = Expression(x="1", y=trim_25, Expression="x")
spc_7 = ModelSpecifier(Context="split level", Group=expression_5)  # -> Specifier, Context, Group
merge_12 = Merge(Data1=spc.Specifier, Data2=spc_7.Specifier, Data3=spc_3.Specifier)
sde_7 = ModelSide(PieceId=shaftpieceid_2, PieceTypePortSpecifiers=merge_12)  # -> Side, PieceId, PieceTypePortSpecifiers
sde_8 = ModelSide(PieceId=trim_17, PieceTypePortSpecifiers=spc_4.Specifier)  # -> Side, PieceId, PieceTypePortSpecifiers
trim_29 = TrimTree(Tree=sde_7.Side, Depth=1)
atr_4 = ModelAttraction(AttractingSide=trim_29, AttractedSide=sde_8.Side)  # -> Attraction, AttractingSide, AttractedSide

expression_6 = Expression(x="2", y=trim_25, Expression="x")
spc_8 = ModelSpecifier(Context="door", Group=expression_6)  # -> Specifier, Context, Group
merge_13 = Merge(Data1=spc.Specifier, Data2=spc_2.Specifier, Data3=spc_8.Specifier)
sde_9 = ModelSide(PieceId=shaftpieceid_2, PieceTypePortSpecifiers=merge_13)  # -> Side, PieceId, PieceTypePortSpecifiers
sde_10 = ModelSide(PieceId=trim_14, PieceTypePortSpecifiers=spc_4.Specifier)  # -> Side, PieceId, PieceTypePortSpecifiers
trim_30 = TrimTree(Tree=sde_9.Side, Depth=1)
atr_5 = ModelAttraction(AttractingSide=trim_30, AttractedSide=sde_10.Side)  # -> Attraction, AttractingSide, AttractedSide

expression_7 = Expression(x="2", y=trim_25, Expression="x")
spc_9 = ModelSpecifier(Context="split level", Group=expression_7)  # -> Specifier, Context, Group
merge_14 = Merge(Data1=spc.Specifier, Data2=spc_9.Specifier, Data3=spc_3.Specifier)
sde_11 = ModelSide(PieceId=shaftpieceid_2, PieceTypePortSpecifiers=merge_14)  # -> Side, PieceId, PieceTypePortSpecifiers
sde_12 = ModelSide(PieceId=trim_5, PieceTypePortSpecifiers=spc_4.Specifier)  # -> Side, PieceId, PieceTypePortSpecifiers
trim_31 = TrimTree(Tree=sde_11.Side, Depth=1)
atr_6 = ModelAttraction(AttractingSide=trim_31, AttractedSide=sde_12.Side)  # -> Attraction, AttractingSide, AttractedSide

merge_15 = Merge(Data1=spc.Specifier, Data2=spc_7.Specifier, Data3=spc_5.Specifier)
sde_13 = ModelSide(PieceId=shaftpieceid_2, PieceTypePortSpecifiers=merge_15)  # -> Side, PieceId, PieceTypePortSpecifiers
sde_14 = ModelSide(PieceId=trim_11, PieceTypePortSpecifiers=spc_4.Specifier)  # -> Side, PieceId, PieceTypePortSpecifiers
trim_32 = TrimTree(Tree=sde_13.Side, Depth=1)
atr_7 = ModelAttraction(AttractingSide=trim_32, AttractedSide=sde_14.Side)  # -> Attraction, AttractingSide, AttractedSide

merge_16 = Merge(Data1=spc.Specifier, Data2=spc_9.Specifier, Data3=spc_5.Specifier)
sde_15 = ModelSide(PieceId=shaftpieceid_2, PieceTypePortSpecifiers=merge_16)  # -> Side, PieceId, PieceTypePortSpecifiers
sde_16 = ModelSide(PieceId=trim_8, PieceTypePortSpecifiers=spc_4.Specifier)  # -> Side, PieceId, PieceTypePortSpecifiers
trim_33 = TrimTree(Tree=sde_15.Side, Depth=1)
atr_8 = ModelAttraction(AttractingSide=trim_33, AttractedSide=sde_16.Side)  # -> Attraction, AttractingSide, AttractedSide

merge_17 = Merge(Data1=trim_3, Data2=trim_21, Data3=trim_15, Data4=trim_24, Data5=trim_18, Data6=trim_12, Data7=trim_6, Data8=trim_9)
merge_18 = Merge(
    Data1=atr.Attraction,
    Data2=atr_2.Attraction,
    Data3=atr_5.Attraction,
    Data4=atr_3.Attraction,
    Data5=atr_4.Attraction,
    Data6=atr_7.Attraction,
    Data7=atr_6.Attraction,
    Data8=atr_8.Attraction)
at = Attraction(merge_18)
pc = Piece(merge_17)
at_2 = ClusterOutput(at)
pc_2 = ClusterOutput(pc)

# ==== cluster ReplaceTypeInFormation
fo = ClusterInput()
old_type_name = ClusterInput()
new_type_name = ClusterInput()
fo_2 = Formation(fo)
old_type_name_2 = Text(old_type_name)
new_type_name_2 = Text(new_type_name)
for = ModelFormation(Formation=fo_2)  # -> Formation, Name, Explanation, Icon, Pieces, Attractions, Qualities
pce = ModelPiece(Piece=for.Pieces)  # -> Piece, Id, TypeName, TypeQualities
tmatch = MatchText(Text=pce.TypeName, Pattern=old_type_name_2, Case=True)
dispatch = Dispatch(List=pce.Piece, DispatchPattern=tmatch)  # -> ListA, ListB
pce_2 = ModelPiece(Piece=dispatch.ListA, TypeName=new_type_name_2)  # -> Piece, Id, TypeName, TypeQualities
merge = Merge(Data1=pce_2.Piece, Data2=dispatch.ListB)
for_2 = ModelFormation(Formation=for.Formation, Pieces=merge)  # -> Formation, Name, Explanation, Icon, Pieces, Attractions, Qualities
fo_3 = Formation(for_2.Formation)
fo_4 = ClusterOutput(fo_3)
