# Grasshopper definition test.gh (Grasshopper 1.0.7)
# plug-ins: semio

panel = Panel("""    RuleFor(customer => customer.Surname).NotNull();
  }
}

To run the validator, instantiate the validator object and call the Validate method, passing in the object to validate.

Customer customer = new Customer();
CustomerValidator validator = new CustomerValidator();

ValidationResult result = validator.Validate(customer);

The Validate method returns a ValidationResult object. This contains two properties:

    IsValid - a boolean that says whether the validation succeeded.
    Errors - a collection of ValidationFailure objects containing details about any validation failures.

The following code would write any validation failures to the console:

using FluentValidation.Results; 

Customer customer = new Customer();
CustomerValidator validator = new CustomerValidator();

ValidationResult results = validator.Validate(customer);

if(! results.IsValid) 
{
  foreach(var failure in results.Errors)
  {
    Console.WriteLine("Property " + failure.PropertyName + " failed validation. Error was: " + failure.ErrorMessage);
  }
}

You can also call ToString on the ValidationResult to combine all error messages into a single string. By default, the messages will be separated with new lines, but if you want to customize this behaviour you can pass a different separator character to ToString.

ValidationResult results = validator.Validate(customer);
string allMessages = results.ToString("~");     // In this case, each message will be separated with a `~`

Note : if there are no validation errors, ToString() will return an empty string.
Chaining validators""")
mime = Mime({".stl": "model/stl", ".obj": "model/obj", ".glb": "model/gltf-binary", ".gltf": "model/gltf+json", ".3dm": "model/vnd.3dm", ".speckle": "model/vnd.speckle+json", ".png": "image/png", ".jpg": "image/jpeg", ".jpeg": "image/jpeg", ".svg": "image/svg+xml", ".pdf": "application/pdf", ".zip": "application/zip", ".json": "application/json", ".csv": "text/csv", ".txt": "text/plain"}, selected=".glb")
panel_2 = Panel("""plan
floor
ground""")
merge = Merge(Data4=panel, Data5=panel)
rep = ModelRepresentation(Url="file3.3dm", Tags=merge)  # -> Representation, Url, Mime, Lod, Tags
rep_2 = ModelRepresentation(Url="file1", Mime=mime, Lod="1to200", Tags=panel_2)  # -> Representation, Url, Mime, Lod, Tags
merge_2 = Merge(Data1=rep_2.Representation, Data2=rep.Representation)
panel_3 = Panel(rep.Tags)
typ = ModelType(Name="Capsule", Description="A Capsule.", Icon="📦", Variant="1", Representations=merge_2)  # -> Type, Name, Description, Icon, Variant, Unit, Representations, Qualities
typ_2 = ModelType()  # -> Type, Name, Description, Icon, Variant, Unit, Representations, Qualities
trim = TrimTree(Tree=typ.Representations, Depth=1)
panel_4 = Panel(typ.Type)
panel_5 = Panel(typ_2.Type)
rep_3 = ModelRepresentation(Representation=trim)  # -> Representation, Url, Mime, Lod, Tags
panel_6 = Panel(rep_3.Mime)
