# Grasshopper definition nakagincapsuletower.gh (Grasshopper 1.0.7)
# plug-ins: Semio, Swiftlet

panel = Panel("C:\Git\Studium\PhD\semio\tests\assets\elements\Capsule_Simple.gh")
list = ValueList({"Back", "Side"}, selected="Side")
number_slider = Slider(300, range=0..1000)
number_slider_2 = Slider(-5, range=-1000..1000)
parameter = ConstructParameter(Name="Length", Value=Slider(440, range=0..1000))
parameter_2 = ConstructParameter(Name="Entrance", Value=list)
capsules = Integer(Slider(4, range=0..10))
xy = XYPlane(Origin=Point(0, 0, 0))
Z = UnitZ(Factor=number_slider)
X = UnitX(Factor=number_slider)
merge = Merge(Data1=parameter, Data3=parameter_2)
arrlinear = LinearArray(Geometry=xy, Direction=X, Count=capsules)  # -> Geometry, Transform
cluster = Cluster(
    X=Slider(-400, range=-1000..1000),
    Y=Slider(10, range=-1000..1000),
    Z=0,
    yaw=Slider(0, range=-360..360),
    pitch=Slider(0, range=-360..360),
    roll=Slider(0, range=-360..360))
plan = ConstructPlan(Url=panel, Parameters=merge)  # -> Plan, Hash
sobject = ConstructSobject(Plan=panel)
link = ConstructLink(Ports="Top")
link_2 = ConstructLink(Ports="Bottom")
sobject_2 = ConstructSobject(Plan=panel)
panel_2 = Panel(arrlinear.Geometry)
trim = TrimTree(Tree=arrlinear.Geometry, Depth=1)
sobject_3 = ConstructSobject(Pose=trim, Plan=plan.Plan)
link_3 = ConstructLink(Protocol="Simple")
connectable = ConstructConnectable(Sobject=sobject, Link=link)
connectable_2 = ConstructConnectable(Sobject=sobject_2, Link=link_2)
connectable_3 = ConstructConnectable(Sobject=sobject_3, Link=link_3)
merge_2 = Merge(Data1=sobject, Data2=sobject_2)
connection = ConstructConnection(Connecting=connectable_2, Connected=connectable)
shift = ShiftList(List=connectable_3, Shift="-1", Wrap="False")
shift_2 = ShiftList(List=connectable_3, Shift=1, Wrap="False")
link_4 = ConstructLink(Protocol="Simple", Ports="Top")
shift_3 = ShiftList(List=sobject_3, Shift="-1", Wrap="False")
layout = ConstructLayout(Sobjects=merge_2, Connections=connection, Assembly=sobject)
shift_4 = ShiftList(List=sobject_3, Shift=1, Wrap="False")
link_5 = ConstructLink(Protocol="Simple", Ports="Bottom")
connection_2 = ConstructConnection(Connecting=shift, Connected=shift_2)
item = ListItem(List=sobject_3, Index=0, Wrap=True)
connectable_4 = ConstructConnectable(Sobject=shift_3, Link=link_4)
connectable_5 = ConstructConnectable(Sobject=shift_3, Link=link_5)
layout_2 = ConstructLayout(Sobjects=sobject_3, Connections=connection_2, Assembly=item)
run = Boolean(Toggle(False))
server = Text("http://localhost:2999")
layout_design = LayoutDesign(Url=server, Layout=layout, Run=Toggle(True))
connection_3 = ConstructConnection(Connecting=connectable_4, Connected=connectable_5)
merge_3 = Merge(Data1=arrlinear.Geometry)
layout_design_2 = LayoutDesign(Url=server, Layout=layout_2, Run=run)
design = ShowDesign(Design=layout_design, Concepts="Wireframe")
panel_3 = Panel("Detailed")
layout_3 = ConstructLayout(Sobjects=sobject_3, Connections=connection_3, Assembly=item)
previewplane = PreviewPlane(plane=merge_3, axis_length=Slider(200, range=0..1000))
design_2 = ShowDesign(Design=layout_design_2, Concepts="Wireframe")
dedesign = DeconstructDesign(Design=layout_design_2)  # -> Prototypes, Elements
layout_design_3 = LayoutDesign(Url=server, Layout=layout_3, Run=Toggle(False))
deelement = DeconstructElement(Element=dedesign.Elements)  # -> SobjectId, PlanHash, Pose
design_3 = ShowDesign(Design=layout_design_3, Concepts="Wireframe")
previewplane_2 = PreviewPlane(plane=deelement.Pose, axis_length=Slider(100, range=0..1000))
fjs = FormatJsonString(JSONString=sobject_3)
panel_4 = Panel(fjs)

# ==== cluster Cluster
X = ClusterInput()
Y = ClusterInput()
Z = ClusterInput()
yaw = ClusterInput()
pitch = ClusterInput()
roll = ClusterInput()
yawpitchroll = NAME(yaw=yaw, pitch=pitch, roll=roll)  # -> t
# ---------- yawpitchroll: Python ----------
from Rhino.Geometry import Transform
from math import radians

t = Transform.RotationZYX(radians(yaw),radians(pitch),radians(roll))
# ---------- end yawpitchroll ----------
pt = ConstructPoint(XCoordinate=X, YCoordinate=Y, ZCoordinate=Z)
xy = XYPlane(Origin=Point(0, 0, 0))
transform = Transform(Geometry=xy, Transform=yawpitchroll)
pl_origin = PlaneOrigin(Base=transform, Origin=pt)
pln = Plane(pl_origin)
pln_2 = ClusterOutput(pln)

# ==== cluster PreviewPlane: Preview a plane with axis colors and naming.
axis_length = ClusterInput()
plane = ClusterInput()
axis_length_2 = Number(axis_length)
plane_2 = Plane(plane)
deplane = DeconstructPlane(Plane=plane_2)  # -> Origin, XAxis, YAxis, ZAxis
line = LineSDL(Start=deplane.Origin, Direction=deplane.YAxis, Length=axis_length_2)
line_2 = LineSDL(Start=deplane.Origin, Direction=deplane.XAxis, Length=axis_length_2)
line_3 = LineSDL(Start=deplane.Origin, Direction=deplane.ZAxis, Length=axis_length_2)
swatch = ColourSwatch(SwatchColor=RGB(235, 52, 79))
swatch_2 = ColourSwatch(SwatchColor=RGB(0, 166, 157))
swatch_3 = ColourSwatch(SwatchColor=RGB(240, 117, 24))
end = EndPoints(Curve=line_2)  # -> Start, End
end_2 = EndPoints(Curve=line)  # -> Start, End
end_3 = EndPoints(Curve=line_3)  # -> Start, End
tag = TextTag(Location=end.End, Text="X", Colour=swatch)
tag_2 = TextTag(Location=end_2.End, Text="Y", Colour=swatch_2)
tag_3 = TextTag(Location=end_3.End, Text="Z", Colour=swatch_3)
preview = CustomPreview(Geometry=line_2, Material=swatch)
preview_2 = CustomPreview(Geometry=line, Material=swatch_2)
preview_3 = CustomPreview(Geometry=line_3, Material=swatch_3)
