# Grasshopper definition opionionated-quality.gh (Grasshopper 1.0.8)
# Copyright: GNU Lesser General Public License Version 3
# plug-ins: semio

qal = StandardQuality({"Primary Energy Demand": "semio.energy.primary demand", "Primary Heating Energy Demand": "semio.energy.primary demand.primary heating", "Final Heating Energy Demand": "semio.energy.primary demand.primary heating.final", "Heating Energy Demand": "semio.energy.primary demand.primary heating.final.heating", "Transmission Heat Loss": "semio.energy.primary demand.primary heating.final.heating.transmission", "Final Ventilation Heat Loss": "semio.energy.primary demand.primary heating.final.heating.final ventilation", "Ventilation Heat Loss": "semio.energy.primary demand.primary heating.final.heating.final ventilation.ventialtion", "Primary Cooling Energy Demand": "semio.energy.primary demand.primary cooling", "Final Cooling Energy Demand": "semio.energy.primary demand.primary cooling.final", "Cooling Energy Demand": "semio.energy.primary demand.primary cooling.final.cooling energy", "Primary Electricity Energy Demand": "semio.energy.primary demand.primary electricity", "Electricity Energy Demand": "semio.energy.primary demand.primary electricity.electricity", "Technical Equipment Energy Demand": "semio.energy.primary demand.primary electricity.electricity.technical equipment"}, selected="Primary Energy Demand")
qal_2 = StandardQuality({"Area": "semio.area", "Gross Area": "semio.area.gross", "Net Area": "semio.area.gross.net", "Usable Area": "semio.area.gross.net.usable", "Living and Staying Area": "semio.area.gross.net.usable.living-and-staying", "Living Room Area": "semio.area.gross.net.usable.living-and-staying.living-room"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}, selected="Interior Wall Construction Area": "semio.area.gross.construction.interior-wall-construction")
qal_3 = StandardQuality({"Floor Area": "semio.area", "Gross Floor Area": "semio.area.gross", "Net Floor Area": "semio.area.gross.net", "Usable Floor Area": "semio.area.gross.net.usable", "Living and Staying Floor Area": "semio.area.gross.net.usable.living-and-staying", "Living Room Floor Area": "semio.area.gross.net.usable.living-and-staying.living-room", "Living Floor Area": "semio.area.gross.net.usable.living-and-staying.living-room.living", "Kitchen Floor Area": "semio.area.gross.net.usable.living-and-staying.living-room.kitchen", "Sanitary Floor Area": "semio.area.gross.net.usable.living-and-staying.living-room.sanitary", "Circulation Floor Area": "semio.area.gross.net.usable.living-and-staying.living-room.circulation", "Outdoor Seating Floor Area": "semio.area.gross.net.usable.living-and-staying.living-room.outdoor-seating", "Storage Floor Area": "semio.area.gross.net.usable.living-and-staying.living-room.storage", "Common Room Floor Area": "semio.area.gross.net.usable.living-and-staying.common-room", "Break Room Floor Area": "semio.area.gross.net.usable.living-and-staying.break-room", "Waiting Room Floor Area": "semio.area.gross.net.usable.living-and-staying.waiting-room", "Dining Room Floor Area": "semio.area.gross.net.usable.living-and-staying.dining-room", "Detention Room Floor Area": "semio.area.gross.net.usable.living-and-staying.detention-room"}, selected="Net Floor Area")
qal_4 = OpinionatedQuality(na=qal, value=Slider(9, range=0..1000), im=False)
qal_5 = OpinionatedQuality(na=qal_3, value=Slider(150, range=0..1000), im=False)
qal_6 = OpinionatedQuality(na=qal_2, value=Slider(9, range=0..1000), im=False)
merge = Merge(Data1=qal_5, Data2=qal_4, Data3=qal_6)
typ = ModelType(Qualities=merge)  # -> Type, Valid, Name, Description, Icon, Image, Variant, Stock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
qal_7 = ModelQuality(Quality=typ.Qualities)  # -> Quality, Valid, Name, Value, Unit, Definition
panel = Panel(qal_7.Value)
panel_2 = Panel(qal_7.Unit)
unt = ConvertUnit(Value=qal_7.Value, FromUnit=qal_7.Unit, ToUnit="ft²")
panel_3 = Panel(unt)

# ==== cluster OpinionatedQuality: Construct an opinionated quality with a standard name.
panel = Panel("""semio.area
semio.area.gross
semio.area.gross.net
semio.area.gross.net.usable
semio.area.gross.net.usable.living-and-staying
semio.area.gross.net.usable.living-and-staying.living-room
semio.area.gross.net.usable.living-and-staying.living-room.living
semio.area.gross.net.usable.living-and-staying.living-room.kitchen
semio.area.gross.net.usable.living-and-staying.living-room.sanitary
semio.area.gross.net.usable.living-and-staying.living-room.circulation
semio.area.gross.net.usable.living-and-staying.living-room.outdoor-seating
semio.area.gross.net.usable.living-and-staying.living-room.storage
semio.area.gross.net.usable.living-and-staying.common-room
semio.area.gross.net.usable.living-and-staying.break-room
semio.area.gross.net.usable.living-and-staying.waiting-room
semio.area.gross.net.usable.living-and-staying.dining-room
semio.area.gross.net.usable.living-and-staying.detention-room
semio.area.gross.net.usable.office-work
semio.area.gross.net.usable.office-work.office-room
semio.area.gross.net.usable.office-work.open-plan-office
semio.area.gross.net.usable.office-work.meeting-room
semio.area.gross.net.usable.office-work.design-room
semio.area.gross.net.usable.office-work.counter-room
semio.area.gross.net.usable.office-work.control-room
semio.area.gross.net.usable.office-work.supervision-room
semio.area.gross.net.usable.office-work.office-technology-room
semio.area.gross.net.usable.office-work.other
semio.area.gross.net.usable.production-experiments-work
semio.area.gross.net.usable.production-experiments-work.production-hall
semio.area.gross.net.usable.production-experiments-work.workshop
semio.area.gross.net.usable.production-experiments-work.technology-lab
semio.area.gross.net.usable.production-experiments-work.physics-electrical-lab
semio.area.gross.net.usable.production-experiments-work.chemistry-biology-lab
semio.area.gross.net.usable.production-experiments-work.animal-husbandry-room
semio.area.gross.net.usable.production-experiments-work.plant-cultivation-room
semio.area.gross.net.usable.production-experiments-work.kitchen
semio.area.gross.net.usable.production-experiments-work.special-work-room
semio.area.gross.net.usable.storage-distribution-sales
semio.area.gross.net.usable.storage-distribution-sales.storage-room
semio.area.gross.net.usable.storage-distribution-sales.collection-archive
semio.area.gross.net.usable.storage-distribution-sales.cold-storage-room
semio.area.gross.net.usable.storage-distribution-sales.receiving-dispatch-room
semio.area.gross.net.usable.storage-distribution-sales.sales-room
semio.area.gross.net.usable.storage-distribution-sales.exhibition-room
semio.area.gross.net.usable.storage-distribution-sales.other
semio.area.gross.net.usable.education-culture-instruction
semio.area.gross.net.usable.education-culture-instruction.classwith-fixed-seating
semio.area.gross.net.usable.education-culture-instruction.teaching-practice-room
semio.area.gross.net.usable.education-culture-instruction.special-classroom
semio.area.gross.net.usable.education-culture-instruction.library-room
semio.area.gross.net.usable.education-culture-instruction.sports-room
semio.area.gross.net.usable.education-culture-instruction.assembly-room
semio.area.gross.net.usable.education-culture-instruction.stage-studio-room
semio.area.gross.net.usable.education-culture-instruction.display-room
semio.area.gross.net.usable.education-culture-instruction.sacred-room
semio.area.gross.net.usable.healing-and-care
semio.area.gross.net.usable.healing-and-care.general-medical-equipment-room
semio.area.gross.net.usable.healing-and-care.special-medical-equipment-room
semio.area.gross.net.usable.healing-and-care.surgical-room
semio.area.gross.net.usable.healing-and-care.radiation-diagnostic-room
semio.area.gross.net.usable.healing-and-care.radiation-therapy-room
semio.area.gross.net.usable.healing-and-care.rehabilitation-physiotherapy
semio.area.gross.net.usable.healing-and-care.general-patient-room
semio.area.gross.net.usable.healing-and-care.special-patient-room
semio.area.gross.net.usable.healing-and-care.other
semio.area.gross.net.usable.other
semio.area.gross.net.usable.other.sanitary-room
semio.area.gross.net.usable.other.cloakroom
semio.area.gross.net.usable.other.storage-room
semio.area.gross.net.usable.other.vehicle-parking
semio.area.gross.net.usable.other.passenger
semio.area.gross.net.usable.other.central-technical-room
semio.area.gross.net.usable.other.protective-room
semio.area.gross.net.usable.other.laundry-room
semio.area.gross.net.usable.other.other
semio.area.gross.technical
semio.area.gross.technical.wastewater-gases-water-supply
semio.area.gross.technical.heating-hot-water
semio.area.gross.technical.ventilation-air-conditioning
semio.area.gross.technical.electrical-power-supply
semio.area.gross.technical.telecommunications
semio.area.gross.technical.elevator-conveyor-systems
semio.area.gross.technical.other
semio.area.gross.circulation
semio.area.gross.circulation.corridor-hall
semio.area.gross.circulation.stair
semio.area.gross.circulation.shaft-for-conveyor-system
semio.area.gross.circulation.vehicle-traffic
semio.area.gross.circulation.other
semio.area.construction
semio.area.construction.exterior-wall-construction
semio.area.construction.interior-wall-construction
semio.area.construction.partition-wall
semio.area.construction.column
semio.area.construction.shaft
semio.area.construction.beam
semio.area.construction.other
semio.area.property
semio.area.property.built-up
semio.area.property.unbuilt
semio.area.property.outdoor-facility
semio.area.property.outdoor-facility.traffic
semio.area.property.outdoor-facility.traffic.sidewalk
semio.area.property.outdoor-facility.traffic.driveway
semio.area.property.outdoor-facility.traffic.parking-space
semio.area.property.outdoor-facility.traffic.bicycle-parking
semio.area.property.outdoor-facility.traffic.turning
semio.area.property.outdoor-facility.traffic.other
semio.area.property.outdoor-facility.green
semio.area.property.outdoor-facility.green.lawn
semio.area.property.outdoor-facility.green.planted-bed
semio.area.property.outdoor-facility.green.hedge
semio.area.property.outdoor-facility.green.tree
semio.area.property.outdoor-facility.green.roof-greening
semio.area.property.outdoor-facility.green.facade-greening
semio.area.property.outdoor-facility.green.other
semio.area.property.outdoor-facility.paved
semio.area.property.outdoor-facility.paved.terrace
semio.area.property.outdoor-facility.paved.balcony
semio.area.property.outdoor-facility.paved.courtyard
semio.area.property.outdoor-facility.paved.storage-utility
semio.area.property.outdoor-facility.paved.playground
semio.area.property.outdoor-facility.paved.other
semio.area.property.outdoor-facility.technical-facility
semio.area.property.outdoor-facility.technical-facility.waste-collection-point
semio.area.property.outdoor-facility.technical-facility.utility-line
semio.area.property.outdoor-facility.technical-facility.stormwater-management
semio.area.property.outdoor-facility.technical-facility.lighting-system
semio.area.property.outdoor-facility.technical-facility.fence-enclosure
semio.area.property.outdoor-facility.technical-facility.other
semio.area.property.outdoor-facility.water
semio.area.property.outdoor-facility.water.pond
semio.area.property.outdoor-facility.water.fountain
semio.area.property.outdoor-facility.water.stormwater-retention
semio.area.property.outdoor-facility.water.other
semio.area.property.outdoor-facility.other""")
panel_2 = Panel("""semio.energy
semio.energy.primary demand
semio.energy.primary demand.primary heating
semio.energy.primary demand.primary heating.final
semio.energy.primary demand.primary heating.final.heating
semio.energy.primary demand.primary heating.final.heating.transmission
semio.energy.primary demand.primary heating.final.heating.final ventilation
semio.energy.primary demand.primary heating.final.heating.final ventilation.ventialtion
semio.energy.primary demand.primary cooling
semio.energy.primary demand.primary cooling.final
semio.energy.primary demand.primary cooling.final.cooling energy
semio.energy.primary demand.primary electricity
semio.energy.primary demand.primary electricity.electricity
semio.energy.primary demand.primary electricity.electricity.technical equipment""")
panel_3 = Panel("""semio.volume
semio.volume.gross-volume
semio.volume.gross-volume.net-volume
semio.volume.gross-volume.construction-volume""")
panel_4 = Panel("""semio.people
semio.people.stationary
semio.people.stationary.living
semio.people.stationary.living.residents
semio.people.stationary.living.guests
semio.people.stationary.working
semio.people.stationary.working.office
semio.people.stationary.working.production
semio.people.stationary.working.service
semio.people.stationary.working.education
semio.people.stationary.working.healthcare
semio.people.stationary.working.other
semio.people.stationary.students
semio.people.stationary.students.pupils
semio.people.stationary.students.students
semio.people.stationary.client
semio.people.stationary.client.customers
semio.people.stationary.client.visitors
semio.people.stationary.client.patients
semio.people.mobile
semio.people.mobile.visitors
semio.people.mobile.visitors.customers
semio.people.mobile.visitors.guests
semio.people.mobile.visitors.tourists
semio.people.mobile.employees
semio.people.mobile.employees.mobile-workers
semio.people.mobile.employees.delivery-personnel
semio.people.mobile.students
semio.people.mobile.students.commuters
semio.people.mobile.students.exchange-students""")
panel_5 = Panel("""semio.global-warming-potential
semio.global-warming-potential.embodied
semio.global-warming-potential.embodied.construction
semio.global-warming-potential.embodied.technical-equipment
semio.global-warming-potential.operational
semio.global-warming-potential.operational.heating
semio.global-warming-potential.operational.cooling
semio.global-warming-potential.operational.lighting
semio.global-warming-potential.operational.ventilation
semio.global-warming-potential.operational.hot-water
semio.global-warming-potential.operational.other""")
na = ClusterInput()
im = ClusterInput()
value = ClusterInput()
# Raumnutzungsarten nach DIN 277-2: https://search.bsdd.buildingsmart.org/uri/cafmring/din277-2/2024.0.1
qal = StandardQuality({"Area": "semio.area", "Gross Area": "semio.area.gross", "Net Area": "semio.area.gross.net", "Usable Area": "semio.area.gross.net.usable", "Living and Staying Area": "semio.area.gross.net.usable.living-and-staying", "Living Room Area": "semio.area.gross.net.usable.living-and-staying.living-room"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}, selected="Area")
na_2 = Name(na)
value_2 = Value(value)
im_2 = Boolean(im)
merge = Merge(Data1=panel, Data2=panel_2, Data3=panel_3, Data4=panel_4, Data5=panel_5)
expression = Expression(x="kWh/a", y=panel_2, Expression="x")
expression_2 = Expression(x="m³", y=panel_3, Expression="x")
expression_3 = Expression(x="kgCO₂e", y=panel_5, Expression="x")
expression_4 = Expression(x="m²", y=panel, Expression="x")
itemindex = ItemIndex(L=merge, I=na_2)  # -> i; inputs L: list
# ---------- itemindex: Python ----------
#Component Information
#--------------------------------------------------------------------------------------------
if ghenv.Component.RunCount<2:
    #General
    #--------------------------------------------------------------------------------------------
    __author__ = "Ueli Saluz"
    __version__ = "2022.11.18"
    
    ghenv.Component.Name = "ItemIndex"
    ghenv.Component.NickName = "ItemIndex"
    ghenv.Component.Description = "A better IdemIndex"
    ghenv.Component.Message = "VER 1.0"
    ghenv.Component.Category = "Set"
    ghenv.Component.SubCategory = "List"
    
     #Inputs
    #--------------------------------------------------------------------------------------------
    inputIndex=0
    
    ghenv.Component.Params.Input[inputIndex].Name = "List"
    ghenv.Component.Params.Input[inputIndex].NickName = "L"
    ghenv.Component.Params.Input[inputIndex].Description = "Input1 is..."
    ghenv.Component.Params.Input[inputIndex].Optional = False
    inputIndex+=1
    
    ghenv.Component.Params.Input[inputIndex].Name = "Item"
    ghenv.Component.Params.Input[inputIndex].NickName = "I"
    ghenv.Component.Params.Input[inputIndex].Description = "Input2 is..."
    ghenv.Component.Params.Input[inputIndex].Optional = False
    inputIndex+=1
    
    #Outputs
    #--------------------------------------------------------------------------------------------
    outputIndex=0
    
    ghenv.Component.Params.Output[outputIndex].Name = "Index"
    ghenv.Component.Params.Output[outputIndex].NickName = "i"
    ghenv.Component.Params.Output[outputIndex].Description = "Output1 is..."
    outputIndex+=1

i = L.index(I)
# ---------- end itemindex ----------
merge_2 = Merge(Data1=expression_4, Data2=expression, Data3=expression_2, Data4=expression_3)
expression_5 = Expression(x="ft²", y=panel, Expression="x")
expression_6 = Expression(x="kBtu/a", y=panel_2, Expression="x")
expression_7 = Expression(x="ft³", y=panel_3, Expression="x")
expression_8 = Expression(x="MtCO₂e", y=panel_5, Expression="x")
merge_3 = Merge(Data1=expression_5, Data2=expression_6, Data3=expression_7, Data4=expression_8)
filter = StreamFilter(Gate=im_2, Stream0=merge_2, Stream1=merge_3)
item = ListItem(List=filter, Index=itemindex, Wrap=True)
panel_6 = Panel("https://identifier.buildingsmart.org/uri/buildingsmart/ifc/4.3/prop/NetFloorArea")
item_2 = ListItem(List=panel_6, Index=itemindex, Wrap=True)
qal_2 = ModelQuality(Name=na_2, Value=value_2, Unit=item, Definition=item_2)  # -> Quality, Valid, Name, Value, Unit, Definition
ql = Quality(qal_2.Quality)
ql_2 = ClusterOutput(ql)
panel_7 = Panel(ql)
