# Grasshopper definition tests.gh (Grasshopper 1.0.8)
# Copyright: GNU Lesser General Public License Version 3
# plug-ins: semio

file = ReadFile(File="C:\git\semio\semio\assets\semio\kit_metabolism.json", PerLineParse=False)
kit = DeserializeKit(Text=file)
kit_2 = PassthroughKit(Kit=kit)  # -> Kit, Valid, Guid, Name, Version, Description, Icon, Image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
item = ListItem(List=kit_2.Design, Index=0, Wrap=True)
dsn = PassthroughDesign(Design=item)  # -> Design, Valid, Guid, Name, DesignId, IsAbstract, Folder, Description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
